vi "Interpret_Basic_Settings.gviweb"   [G Web Development Software 22.3.0]
inputs:
  "Error input": error
  "Device Type": string = "Device"
  "Config File infos": string[]
  "Basic Settings Entrys": string[]
outputs:
  "Output Error": error
  "Basic Informations": T1[]
types:
  T1 = cluster{"Parameter Name": string, "Value": string, "Dimension": string, "Comment": string}
uses:
  NI::G Core::Strings::Search and Replace Pattern.gvi
  NI::G Core::Strings::Trim Whitespace.gvi
  WebApp::Set_Eco_State.gviweb
diagram:
  s1 = ""  # shift register
  s2 = ""  # shift register
  for {
    w1 = each element of $"Basic Settings Entrys"
    Match Pattern(regular expression="dim", string=w1) -> (after substring=w3, before substring=w4)
    call "Search and Replace Pattern.gvi"(String=w4, Muster="_", Ersetzungs-String=" ", Alle ersetzen=TRUE) -> (Ergebnis-String=w5)
    call "Trim Whitespace.gvi"(string=w5) -> (trimmed string=w6)
    Match Pattern(regular expression="val", string=w3) -> (after substring=w7, before substring=w8)
    call "Search and Replace Pattern.gvi"(String=w8, Muster="=\"", Alle ersetzen=TRUE) -> (Ergebnis-String=w9)
    # w6: Param. Name
    # s2: Gas Type
    # s1: Control Mode
    call "Search and Replace Pattern.gvi"(String=w9, Muster="\"") -> (Ergebnis-String=w10)
    # w11: Dimension
    call "Trim Whitespace.gvi"(string=w10) -> (trimmed string=w11)
    call "Search and Replace Pattern.gvi"(String=w7, Muster="=\"", Alle ersetzen=TRUE) -> (Ergebnis-String=w12)
    # $"Device Type": Device type
    call "Search and Replace Pattern.gvi"(String=w12, Muster="\"") -> (Ergebnis-String=w13)
    # w14: value
    call "Trim Whitespace.gvi"(string=w13) -> (trimmed string=w14)
    case ($"Device Type") {
      frame "False", Default {
        w19 = "Unit_Type is missing/incorrect: Evaluation of the service report is not possible"
        w15 = w19
        w16 = w14
        w17 = s1
        w18 = s2
      }
      frame "623", "E523", "E623" {
        case (w6) {
          frame "False", Default {
            w15 = "✅"
            w16 = w14
            w17 = s1
          }
          frame "Drain Valve time0" {
            Decimal String To Number(default (0 I32)=0, string=w14) -> (number=w20)
            Decimal String To Number(default (0 I32)=0, string="7") -> (number=w21)
            Decimal String To Number(default (0 I32)=0, string="5") -> (number=w22)
            In Range And Coerce(lower limit=w22, upper limit=w21, x=w20) -> (In Range?=w23)
            case (w23) {
              frame False, Default {
                w24 = "❌"  # String {0}
                Concatenate Strings(w24, " ", w6, " ", "is out of range") -> w15
              }
              frame True {
                w15 = "✅"
              }
            }
            w16 = w14
            w17 = s1
          }
          frame "Drain Valve time1" {
            Decimal String To Number(default (0 I32)=0, string=w14) -> (number=w25)
            Decimal String To Number(default (0 I32)=0, string="20") -> (number=w26)
            Decimal String To Number(default (0 I32)=0, string="16") -> (number=w27)
            In Range And Coerce(lower limit=w27, upper limit=w26, x=w25) -> (In Range?=w28)
            case (w28) {
              frame False, Default {
                w29 = "❌"  # String {0}
                Concatenate Strings(w29, " ", w6, " ", "is out of range") -> w15
              }
              frame True {
                w15 = "✅"
              }
            }
            w16 = w14
            w17 = s1
          }
          frame "CDS-Sensor XS" {
            Decimal String To Number(string=w14) -> (number=w30)
            Is Equal(x=w30, y=1000) -> w31
            case (w31) {
              frame False, Default {
                w32 = "❌"  # String {0}
                Concatenate Strings(w32, "Incorrect calibration of the CDS sensor XS") -> w15
              }
              frame True {
                w15 = "✅"
              }
            }
            w16 = w14
            w17 = s1
          }
          frame "Installation voltage" {
            Is Not Equal(x=w14, y="") -> w33
            case (w33) {
              frame False, Default {
                w34 = "❌"  # String {0}
                Concatenate Strings(w34, " ", w6, " ", "is missing") -> w15
              }
              frame True {
                w15 = "✅"
              }
            }
            w16 = w14
            w17 = s1
          }
          frame "ShowMode" {
            Is Equal(x=w14, y="false") -> w35
            case (w35) {
              frame False, Default {
                Concatenate Strings("⚠️", " ShowMode is activated") -> w15
              }
              frame True {
                w15 = "✅"
              }
            }
            w16 = w14
            w17 = s1
          }
          frame "Control Temperature Dry Heat" {
            Decimal String To Number(default (0 I32)=0, string=w14) -> (number=w36)
            Decimal String To Number(default (0 I32)=0, string="45") -> (number=w37)
            Is Less Or Equal(x=w36, y=w37) -> w38
            case (w38) {
              frame True {
                w39 = "Temperature limit is too low, it could cause high water consumption"
                Concatenate Strings("⚠️", w39) -> w15
              }
              frame False {
                w15 = "✅"
              }
            }
            w16 = w14
            w17 = s1
          }
          frame "Control Temperature Moist Heat" {
            Decimal String To Number(default (0 I32)=0, string=w14) -> (number=w40)
            Decimal String To Number(default (0 I32)=0, string="40") -> (number=w41)
            Is Less Or Equal(x=w40, y=w41) -> w42
            case (w42) {
              frame True {
                w43 = "Temperature limit is too low, it could cause high water consumption"
                Concatenate Strings("⚠️", w43) -> w15
              }
              frame False {
                w15 = "✅"
              }
            }
            w16 = w14
            w17 = s1
          }
          frame "Control Temperature Off" {
            Decimal String To Number(default (0 I32)=0, string=w14) -> (number=w44)
            Decimal String To Number(default (0 I32)=0, string="60") -> (number=w45)
            Is Less Or Equal(x=w44, y=w45) -> w46
            case (w46) {
              frame True {
                w47 = "Temperature limit is too low, it could cause high water consumption"
                Concatenate Strings("⚠️", w47) -> w15
              }
              frame False {
                w15 = "✅"
              }
            }
            w16 = w14
            w17 = s1
          }
          frame "Control Mode" {
            Decimal String To Number(default (0 I32)=0, string=w14) -> (number=w48)
            case (w48) {
              frame 1, Default {
                w15 = "✅"
                w16 = "OFF"
              }
              frame 2 {
                w15 = "✅"
                w16 = "Eco"
              }
              frame 3 {
                w15 = "✅"
                w16 = "ON"
              }
              frame 0 {
                w15 = "✅"
                w16 = "Undefined"
              }
            }
            w17 = w16
          }
          frame "Plate a la carte weight" {
            Decimal String To Number(default (0 I32)=0, string=w14) -> (number=w49)
            case (w49) {
              frame 1, Default {
                w15 = "✅"
                w16 = "< 899g"
              }
              frame 2 {
                w15 = "✅"
                w16 = "1099 g"
              }
              frame 3 {
                w15 = "✅"
                w16 = "1100g"
              }
              frame 0 {
                w15 = "✅"
                w16 = "< 700g"
              }
            }
            w17 = w16
          }
          frame "Foam reduction iCareSystem" {
            Decimal String To Number(default (0 I32)=0, string=w14) -> (number=w50)
            case (w50) {
              frame 0 {
                w15 = "✅"
                w16 = "ON"
              }
              frame 1, Default {
                w15 = "✅"
                w16 = "OFF"
              }
            }
            w17 = s1
          }
          frame "Altitude boiling point" {
            Decimal String To Number(default (0 I32)=0, string=w14) -> (number=w51)
            Is Equal(x=w51, y=0) -> w52
            case (w52) {
              frame True {
                w53 = "❌"  # String {0}
                Concatenate Strings(w53, " Device is not calibrated!") -> w15
              }
              frame False {
                w15 = "✅"
              }
            }
            w16 = w14
            w17 = s1
          }
          frame "Altitude pressure sensor", "CDS-Sensor", "Gas blower speed Hot Air bottom Max RPM", "Gas blower speed Hot Air bottom Max Ultravent RPM", "Gas blower speed Hot Air bottom Min RPM", "Gas blower speed Hot Air bottom Min Ultravent RPM", "Gas blower speed Hot Air bottom Start RPM", "Gas blower speed Hot Air bottom Start Ultravent RPM", "Gas blower speed Hot Air top Max RPM", "Gas blower speed Hot Air top Max Ultravent RPM", "Gas blower speed Hot Air top Min RPM", "Gas blower speed Hot Air top Min UltraVent RPM", "Gas blower speed Hot Air top Start RPM", "Gas blower speed Hot Air top Start UltraVent RPM", "Gas blower speed Steam Max RPM", "Gas blower speed Steam Max Ultravent RPM", "Gas blower speed Steam Min RPM", "Gas blower speed Steam Min UltraVent RPM", "Gas blower speed Steam Start RPM", "Gas blower speed Steam Start UltraVent RPM", "Gas type", "Magnetron Safety Chain bottom" {
            w54 = " Information not required for this device type"  # String {0}
            Concatenate Strings("[ℹ]", w54) -> w15
            w16 = w14
            w17 = s1
          }
          frame "Chefline phone setting", "Ethernet eth0 active", "Ethernet eth0 dhcp", "Ethernet eth0 dns", "Ethernet eth0 gateway", "Ethernet eth0 ip", "Ethernet eth0 mac", "Ethernet eth0 netmask", "Service phone setting", "Wifi wlan0 dhcp", "Wifi wlan0 dns", "Wifi wlan0 gateway", "Wifi wlan0 ip", "Wifi wlan0 mac", "Wifi wlan0 netmask" {
            call "Trim Whitespace.gvi"(string=w14) -> (trimmed string=w55)
            Is Empty String Or Path(string/path=w55) -> w56
            case (w56) {
              frame False, Default {
                w15 = "✅"
              }
              frame True {
                w57 = " Information is missing for this device type"  # String {0}
                Concatenate Strings("[ℹ]", w57) -> w15
              }
            }
            w16 = w14
            w17 = s1
          }
        }
        w18 = s2
      }
      frame "E101", "E102", "E201", "E202", "E61", "E61T", "E62" {
        case (w6) {
          frame "False", Default {
            w15 = "✅"
            w16 = w14
            w17 = s1
          }
          frame "CDS-Sensor" {
            Decimal String To Number(string=w14) -> (number=w58)
            Is Equal(x=w58, y=1350) -> w59
            case (w59) {
              frame False, Default {
                w60 = "❌"  # String {0}
                Concatenate Strings(w60, "Incorrect calibration of the CDS sensor") -> w15
              }
              frame True {
                w15 = "✅"
              }
            }
            w16 = w14
            w17 = s1
          }
          frame "Installation voltage" {
            Is Not Equal(x=w14, y="") -> w61
            case (w61) {
              frame False, Default {
                w62 = "❌"  # String {0}
                Concatenate Strings(w62, " ", w6, " ", "is missing") -> w15
              }
              frame True {
                w15 = "✅"
              }
            }
            w16 = w14
            w17 = s1
          }
          frame "ShowMode" {
            Is Equal(x=w14, y="false") -> w63
            case (w63) {
              frame False, Default {
                Concatenate Strings("⚠️", " ShowMode is activated") -> w15
              }
              frame True {
                w15 = "✅"
              }
            }
            w16 = w14
            w17 = s1
          }
          frame "Control Temperature Dry Heat" {
            Decimal String To Number(default (0 I32)=0, string=w14) -> (number=w64)
            Decimal String To Number(default (0 I32)=0, string="45") -> (number=w65)
            Is Less Or Equal(x=w64, y=w65) -> w66
            case (w66) {
              frame True {
                w67 = "Temperature limit is too low, it could cause high water consumption"
                Concatenate Strings("⚠️", w67) -> w15
              }
              frame False {
                w15 = "✅"
              }
            }
            w16 = w14
            w17 = s1
          }
          frame "Control Temperature Moist Heat" {
            Decimal String To Number(default (0 I32)=0, string=w14) -> (number=w68)
            Decimal String To Number(default (0 I32)=0, string="40") -> (number=w69)
            Is Less Or Equal(x=w68, y=w69) -> w70
            case (w70) {
              frame True {
                w71 = "Temperature limit is too low, it could cause high water consumption"
                Concatenate Strings("⚠️", w71) -> w15
              }
              frame False {
                w15 = "✅"
              }
            }
            w16 = w14
            w17 = s1
          }
          frame "Control Temperature Off" {
            Decimal String To Number(default (0 I32)=0, string=w14) -> (number=w72)
            Decimal String To Number(default (0 I32)=0, string="60") -> (number=w73)
            Is Less Or Equal(x=w72, y=w73) -> w74
            case (w74) {
              frame True {
                w75 = "Temperature limit is too low, it could cause high water consumption"
                Concatenate Strings("⚠️", w75) -> w15
              }
              frame False {
                w15 = "✅"
              }
            }
            w16 = w14
            w17 = s1
          }
          frame "Control Mode" {
            Decimal String To Number(default (0 I32)=0, string=w14) -> (number=w76)
            case (w76) {
              frame 1, Default {
                w15 = "✅"
                w16 = "OFF"
              }
              frame 2 {
                w15 = "✅"
                w16 = "Eco"
              }
              frame 3 {
                w15 = "✅"
                w16 = "ON"
              }
              frame 0 {
                w15 = "✅"
                w16 = "Undefined"
              }
            }
            w17 = w16
          }
          frame "Plate a la carte weight" {
            Decimal String To Number(default (0 I32)=0, string=w14) -> (number=w77)
            case (w77) {
              frame 1, Default {
                w15 = "✅"
                w16 = "< 899g"
              }
              frame 2 {
                w15 = "✅"
                w16 = "1099 g"
              }
              frame 3 {
                w15 = "✅"
                w16 = "1100g"
              }
              frame 0 {
                w15 = "✅"
                w16 = "< 700g"
              }
            }
            w17 = w16
          }
          frame "Foam reduction iCareSystem" {
            Decimal String To Number(default (0 I32)=0, string=w14) -> (number=w78)
            case (w78) {
              frame 0 {
                w15 = "✅"
                w16 = "ON"
              }
              frame 1, Default {
                w15 = "✅"
                w16 = "OFF"
              }
            }
            w17 = s1
          }
          frame "Altitude boiling point" {
            Decimal String To Number(string=w14) -> (number=w79)
            Is Equal(x=w79, y=0) -> w80
            case (w80) {
              frame True {
                w81 = "❌"  # String {0}
                Concatenate Strings(w81, " Device is not calibrated!") -> w15
              }
              frame False {
                w15 = "✅"
              }
            }
            w16 = w14
            w17 = s1
          }
          frame "Altitude pressure sensor", "CDS-Sensor XS", "Drain Valve time0", "Drain Valve time1", "Gas blower speed Hot Air bottom Max RPM", "Gas blower speed Hot Air bottom Max Ultravent RPM", "Gas blower speed Hot Air bottom Min RPM", "Gas blower speed Hot Air bottom Min Ultravent RPM", "Gas blower speed Hot Air bottom Start RPM", "Gas blower speed Hot Air bottom Start Ultravent RPM", "Gas blower speed Hot Air top Max RPM", "Gas blower speed Hot Air top Max Ultravent RPM", "Gas blower speed Hot Air top Min RPM", "Gas blower speed Hot Air top Min UltraVent RPM", "Gas blower speed Hot Air top Start RPM", "Gas blower speed Hot Air top Start UltraVent RPM", "Gas blower speed Steam Max RPM", "Gas blower speed Steam Max Ultravent RPM", "Gas blower speed Steam Min RPM", "Gas blower speed Steam Min UltraVent RPM", "Gas blower speed Steam Start RPM", "Gas blower speed Steam Start UltraVent RPM", "Gas type" {
            w82 = " Information not required for this device type"  # String {0}
            Concatenate Strings("[ℹ]", w82) -> w15
            w16 = w14
            w17 = s1
          }
          frame "Chefline phone setting", "Ethernet eth0 active", "Ethernet eth0 dhcp", "Ethernet eth0 dns", "Ethernet eth0 gateway", "Ethernet eth0 ip", "Ethernet eth0 mac", "Ethernet eth0 netmask", "Service phone setting", "Wifi wlan0 dhcp", "Wifi wlan0 dns", "Wifi wlan0 gateway", "Wifi wlan0 ip", "Wifi wlan0 mac", "Wifi wlan0 netmask" {
            call "Trim Whitespace.gvi"(string=w14) -> (trimmed string=w83)
            Is Empty String Or Path(string/path=w83) -> w84
            case (w84) {
              frame False, Default {
                w15 = "✅"
              }
              frame True {
                w85 = " Information is missing for this device type"  # String {0}
                Concatenate Strings("[ℹ]", w85) -> w15
              }
            }
            w16 = w14
            w17 = s1
          }
        }
        w18 = s2
      }
      frame "G101", "G102", "G61", "G62" {
        case (w6) {
          frame "False", Default {
            w15 = "✅"
            w16 = w14
            w17 = s1
            w18 = s2
          }
          frame "CDS-Sensor" {
            Decimal String To Number(string=w14) -> (number=w86)
            Is Equal(x=w86, y=1350) -> w87
            case (w87) {
              frame False, Default {
                w88 = "❌"  # String {0}
                Concatenate Strings(w88, "Incorrect calibration of the CDS sensor") -> w15
              }
              frame True {
                w15 = "✅"
              }
            }
            w16 = w14
            w17 = s1
            w18 = s2
          }
          frame "Altitude pressure sensor" {
            Is Not Equal(x=w14, y="") -> w89
            case (w89) {
              frame False, Default {
                w90 = "❌"  # String {0}
                Concatenate Strings(w90, " ", w6, " ", "is missing") -> w15
              }
              frame True {
                w15 = "✅"
              }
            }
            w16 = w14
            w17 = s1
            w18 = s2
          }
          frame "Gas blower speed Hot Air top Max RPM", "Gas blower speed Hot Air top Min RPM", "Gas blower speed Hot Air top Start RPM", "Gas blower speed Steam Max RPM", "Gas blower speed Steam Min RPM", "Gas blower speed Steam Start RPM" {
            Decimal String To Number(default (0 I32)=0, string=w14) -> (number=w91)
            Is Not Equal To 0(x=w91) -> w92
            case (w92) {
              frame False, Default {
                w93 = "❌"  # String {0}
                Concatenate Strings(w93, " ", $"Device Type", " ", "is out of range!") -> w15
              }
              frame True {
                w15 = "✅"
              }
            }
            w16 = w14
            w17 = s1
            w18 = s2
          }
          frame "ShowMode" {
            Is Equal(x=w14, y="false") -> w94
            case (w94) {
              frame False, Default {
                Concatenate Strings("⚠️", " ShowMode is activated") -> w15
              }
              frame True {
                w15 = "✅"
              }
            }
            w16 = w14
            w17 = s1
            w18 = s2
          }
          frame "Control Temperature Dry Heat" {
            Decimal String To Number(default (0 I32)=0, string=w14) -> (number=w95)
            Decimal String To Number(default (0 I32)=0, string="45") -> (number=w96)
            Is Less Or Equal(x=w95, y=w96) -> w97
            case (w97) {
              frame True {
                w98 = "Temperature limit is too low, it could cause high water consumption"
                Concatenate Strings("⚠️", w98) -> w15
              }
              frame False {
                w15 = "✅"
              }
            }
            w16 = w14
            w17 = s1
            w18 = s2
          }
          frame "Control Temperature Moist Heat" {
            Decimal String To Number(default (0 I32)=0, string=w14) -> (number=w99)
            Decimal String To Number(default (0 I32)=0, string="40") -> (number=w100)
            Is Less Or Equal(x=w99, y=w100) -> w101
            case (w101) {
              frame True {
                w102 = "Temperature limit is too low, it could cause high water consumption"
                Concatenate Strings("⚠️", w102) -> w15
              }
              frame False {
                w15 = "✅"
              }
            }
            w16 = w14
            w17 = s1
            w18 = s2
          }
          frame "Control Temperature Off" {
            Decimal String To Number(default (0 I32)=0, string=w14) -> (number=w103)
            Decimal String To Number(default (0 I32)=0, string="60") -> (number=w104)
            Is Less Or Equal(x=w103, y=w104) -> w105
            case (w105) {
              frame True {
                w106 = "Temperature limit is too low, it could cause high water consumption"
                Concatenate Strings("⚠️", w106) -> w15
              }
              frame False {
                w15 = "✅"
              }
            }
            w16 = w14
            w17 = s1
            w18 = s2
          }
          frame "Control Mode" {
            Decimal String To Number(default (0 I32)=0, string=w14) -> (number=w107)
            case (w107) {
              frame 1, Default {
                w15 = "✅"
                w16 = "OFF"
              }
              frame 2 {
                w15 = "✅"
                w16 = "Eco"
              }
              frame 3 {
                w15 = "✅"
                w16 = "ON"
              }
              frame 0 {
                w15 = "✅"
                w16 = "Undefined"
              }
            }
            w17 = w16
            w18 = s2
          }
          frame "Plate a la carte weight" {
            Decimal String To Number(default (0 I32)=0, string=w14) -> (number=w108)
            case (w108) {
              frame 1, Default {
                w15 = "✅"
                w16 = "< 899g"
              }
              frame 2 {
                w15 = "✅"
                w16 = "1099 g"
              }
              frame 3 {
                w15 = "✅"
                w16 = "1100g"
              }
              frame 0 {
                w15 = "✅"
                w16 = "< 700g"
              }
            }
            w17 = w16
            w18 = s2
          }
          frame "Gas type" {
            w15 = "✅"
            w16 = w14
            w17 = s1
            w18 = w14
          }
          frame "Foam reduction iCareSystem" {
            Decimal String To Number(default (0 I32)=0, string=w14) -> (number=w109)
            case (w109) {
              frame 0 {
                w15 = "✅"
                w16 = "ON"
              }
              frame 1, Default {
                w15 = "✅"
                w16 = "OFF"
              }
            }
            w17 = s1
            w18 = s2
          }
          frame "Altitude boiling point" {
            Decimal String To Number(default (0 I32)=0, string=w14) -> (number=w110)
            Is Equal(x=w110, y=0) -> w111
            case (w111) {
              frame True {
                w112 = "❌"  # String {0}
                Concatenate Strings(w112, " Device is not calibrated!") -> w15
              }
              frame False {
                w15 = "✅"
              }
            }
            w16 = w14
            w17 = s1
            w18 = s2
          }
          frame "CDS-Sensor XS", "Drain Valve time0", "Drain Valve time1", "Gas blower speed Hot Air bottom Max RPM", "Gas blower speed Hot Air bottom Max Ultravent RPM", "Gas blower speed Hot Air bottom Min RPM", "Gas blower speed Hot Air bottom Min Ultravent RPM", "Gas blower speed Hot Air bottom Start RPM", "Gas blower speed Hot Air bottom Start Ultravent RPM", "Installation voltage" {
            w113 = " Information not required for this device type"  # String {0}
            Concatenate Strings("[ℹ]", w113) -> w15
            w16 = w14
            w17 = s1
            w18 = s2
          }
          frame "Chefline phone setting", "Ethernet eth0 active", "Ethernet eth0 dhcp", "Ethernet eth0 dns", "Ethernet eth0 gateway", "Ethernet eth0 ip", "Ethernet eth0 mac", "Ethernet eth0 netmask", "Service phone setting", "Wifi wlan0 dhcp", "Wifi wlan0 dns", "Wifi wlan0 gateway", "Wifi wlan0 ip", "Wifi wlan0 mac", "Wifi wlan0 netmask" {
            call "Trim Whitespace.gvi"(string=w14) -> (trimmed string=w114)
            Is Empty String Or Path(string/path=w114) -> w115
            case (w115) {
              frame False, Default {
                w15 = "✅"
              }
              frame True {
                w116 = " Information is missing for this device type"  # String {0}
                Concatenate Strings("[ℹ]", w116) -> w15
              }
            }
            w16 = w14
            w17 = s1
            w18 = s2
          }
        }
      }
      frame "G201", "G202" {
        case (w6) {
          frame "False", Default {
            w15 = "✅"
            w16 = w14
            w17 = s1
            w18 = s2
          }
          frame "CDS-Sensor" {
            Decimal String To Number(string=w14) -> (number=w117)
            Is Equal(x=w117, y=1350) -> w118
            case (w118) {
              frame False, Default {
                w119 = "❌"  # String {0}
                Concatenate Strings(w119, "Incorrect calibration of the CDS sensor") -> w15
              }
              frame True {
                w15 = "✅"
              }
            }
            w16 = w14
            w17 = s1
            w18 = s2
          }
          frame "Altitude pressure sensor" {
            Is Not Equal(x=w14, y="") -> w120
            case (w120) {
              frame False, Default {
                w121 = "❌"  # String {0}
                Concatenate Strings(w121, " ", w6, " ", "is missing") -> w15
              }
              frame True {
                w15 = "✅"
              }
            }
            w16 = w14
            w17 = s1
            w18 = s2
          }
          frame "Gas blower speed Hot Air bottom Max RPM", "Gas blower speed Hot Air bottom Min RPM", "Gas blower speed Hot Air bottom Start RPM", "Gas blower speed Hot Air top Max RPM", "Gas blower speed Hot Air top Min RPM", "Gas blower speed Hot Air top Start RPM", "Gas blower speed Steam Max RPM", "Gas blower speed Steam Min RPM", "Gas blower speed Steam Start RPM" {
            Decimal String To Number(default (0 I32)=0, string=w14) -> (number=w122)
            Is Not Equal To 0(x=w122) -> w123
            case (w123) {
              frame False, Default {
                w124 = "❌"  # String {0}
                Concatenate Strings(w124, " ", w6, " ", "is out of range!") -> w15
              }
              frame True {
                w15 = "✅"
              }
            }
            w16 = w14
            w17 = s1
            w18 = s2
          }
          frame "ShowMode" {
            Is Equal(x=w14, y="false") -> w125
            case (w125) {
              frame False, Default {
                Concatenate Strings("⚠️", " ShowMode is activated") -> w15
              }
              frame True {
                w15 = "✅"
              }
            }
            w16 = w14
            w17 = s1
            w18 = s2
          }
          frame "Control Temperature Dry Heat" {
            Decimal String To Number(default (0 I32)=0, string=w14) -> (number=w126)
            Decimal String To Number(default (0 I32)=0, string="45") -> (number=w127)
            Is Less Or Equal(x=w126, y=w127) -> w128
            case (w128) {
              frame True {
                w129 = "Temperature limit is too low, it could cause high water consumption"
                Concatenate Strings("⚠️", w129) -> w15
              }
              frame False {
                w15 = "✅"
              }
            }
            w16 = w14
            w17 = s1
            w18 = s2
          }
          frame "Control Temperature Moist Heat" {
            Decimal String To Number(default (0 I32)=0, string=w14) -> (number=w130)
            Decimal String To Number(default (0 I32)=0, string="40") -> (number=w131)
            Is Less Or Equal(x=w130, y=w131) -> w132
            case (w132) {
              frame True {
                w133 = "Temperature limit is too low, it could cause high water consumption"
                Concatenate Strings("⚠️", w133) -> w15
              }
              frame False {
                w15 = "✅"
              }
            }
            w16 = w14
            w17 = s1
            w18 = s2
          }
          frame "Control Temperature Off" {
            Decimal String To Number(default (0 I32)=0, string=w14) -> (number=w134)
            Decimal String To Number(default (0 I32)=0, string="60") -> (number=w135)
            Is Less Or Equal(x=w134, y=w135) -> w136
            case (w136) {
              frame True {
                w137 = "Temperature limit is too low, it could cause high water consumption"
                Concatenate Strings("⚠️", w137) -> w15
              }
              frame False {
                w15 = "✅"
              }
            }
            w16 = w14
            w17 = s1
            w18 = s2
          }
          frame "Control Mode" {
            Decimal String To Number(default (0 I32)=0, string=w14) -> (number=w138)
            case (w138) {
              frame 1, Default {
                w15 = "✅"
                w16 = "OFF"
              }
              frame 2 {
                w15 = "✅"
                w16 = "Eco"
              }
              frame 3 {
                w15 = "✅"
                w16 = "ON"
              }
              frame 0 {
                w15 = "✅"
                w16 = "Undefined"
              }
            }
            w17 = w16
            w18 = s2
          }
          frame "Plate a la carte weight" {
            Decimal String To Number(default (0 I32)=0, string=w14) -> (number=w139)
            case (w139) {
              frame 1, Default {
                w15 = "✅"
                w16 = "< 899g"
              }
              frame 2 {
                w15 = "✅"
                w16 = "1099 g"
              }
              frame 3 {
                w15 = "✅"
                w16 = "1100g"
              }
              frame 0 {
                w15 = "✅"
                w16 = "< 700g"
              }
            }
            w17 = w16
            w18 = s2
          }
          frame "Gas type" {
            w15 = "✅"
            w16 = w14
            w17 = s1
            w18 = w14
          }
          frame "Foam reduction iCareSystem" {
            Decimal String To Number(default (0 I32)=0, string=w14) -> (number=w140)
            case (w140) {
              frame 0 {
                w15 = "✅"
                w16 = "ON"
              }
              frame 1, Default {
                w15 = "✅"
                w16 = "OFF"
              }
            }
            w17 = s1
            w18 = s2
          }
          frame "Altitude boiling point" {
            Decimal String To Number(default (0 I32)=0, string=w14) -> (number=w141)
            Is Equal(x=w141, y=0) -> w142
            case (w142) {
              frame True {
                w143 = "❌"  # String {0}
                Concatenate Strings(w143, " Device is not calibrated!") -> w15
              }
              frame False {
                w15 = "✅"
              }
            }
            w16 = w14
            w17 = s1
            w18 = s2
          }
          frame "CDS-Sensor XS", "Drain Valve time0", "Drain Valve time1", "Installation voltage" {
            w144 = " Information not required for this device type"  # String {0}
            Concatenate Strings("[ℹ]", w144) -> w15
            w16 = w14
            w17 = s1
            w18 = s2
          }
          frame "Chefline phone setting", "Ethernet eth0 active", "Ethernet eth0 dhcp", "Ethernet eth0 dns", "Ethernet eth0 gateway", "Ethernet eth0 ip", "Ethernet eth0 mac", "Ethernet eth0 netmask", "Service phone setting", "Wifi wlan0 dhcp", "Wifi wlan0 dns", "Wifi wlan0 gateway", "Wifi wlan0 ip", "Wifi wlan0 mac", "Wifi wlan0 netmask" {
            call "Trim Whitespace.gvi"(string=w14) -> (trimmed string=w145)
            Is Empty String Or Path(string/path=w145) -> w146
            case (w146) {
              frame False, Default {
                w15 = "✅"
              }
              frame True {
                w147 = " Information is missing for this device type"  # String {0}
                Concatenate Strings("[ℹ]", w147) -> w15
              }
            }
            w16 = w14
            w17 = s1
            w18 = s2
          }
        }
      }
    }
    Property Node(instance in=T1 {all zero or empty}, "Parameter Name"=w6, "Value"=w16, "Dimension"=w11, "Comment"=w15) -> (instance out=w148)
    append w148 to w2
    next s1 = w17
    next s2 = w18
  }
  for {
    w149 = each element of w2
    Property Node(instance in=w149) -> ("Parameter Name"=w151, "Value"=w152, "Dimension"=w153, "Comment"=w154)
    call "Set_Eco_State.gviweb"(Control Mode=s1, Parameter Name=w151, Comment in=w154, Error input=$"Error input") -> (Comment out=w155, Output=w156)
    Property Node(instance in=T1 {all zero or empty}, "Parameter Name"=w151, "Value"=w152, "Dimension"=w153, "Comment"=w155) -> (instance out=w157)
    append w157 to w150
  }
  $"Basic Informations" <- w150
  $"Output Error" <- w156
