vi "Interpret_Common_Information.gviweb"   [G Web Development Software 22.3.0]
inputs:
  "Common Information Entrys": string[]
  "Error Cluster Constant": error
  "Language Entrys": string[]
outputs:
  "Output Error": error
  "Boards Informations:": T1[]
  "Device:": string
  "common": T2[]
  "Unit-type": string
  "Ultravent": string
  "Startup Date and Time": string
  "Output": string
types:
  T1 = cluster{"Boards": string, "Informations": string}
  T2 = cluster{"Parameter Name": string, "Value": string, "Comment": string}
uses:
  WebApp::Get_Config_ini_Part.gviweb
  NI::G Core::Strings::Search and Replace Pattern.gvi
  NI::G Core::Strings::Trim Whitespace.gvi
  WebApp::Change_to_validate_Date.gvi
diagram:
  call "Get_Config_ini_Part.gviweb"(Ini Array=$"Language Entrys", ini Part from Array=0, Error in=$"Error Cluster Constant") -> (Ini Part as Array=w1, Output Error=w2)
  call "Get_Config_ini_Part.gviweb"(Ini Array=$"Language Entrys", ini Part from Array=1, Error in=w2) -> (Ini Part as Array=w3, Output Error=w4)
  call "Get_Config_ini_Part.gviweb"(Ini Array=$"Language Entrys", ini Part from Array=2, Error in=w4) -> (Ini Part as Array=w5, Output Error=w6)
  # "": Auto Dose
  s1 = "Device"  # shift register
  s2 = "AutoDose_not_available"  # shift register
  s3 = ""  # shift register
  s4 = ""  # shift register
  for {
    w7 = each element of $"Common Information Entrys"
    Match Pattern(regular expression="=", string=w7) -> (after substring=w9, before substring=w10)
    call "Search and Replace Pattern.gvi"(String=w10, Muster="val", Alle ersetzen=TRUE) -> (Ergebnis-String=w11)
    call "Search and Replace Pattern.gvi"(String=w11, Muster="_", Ersetzungs-String=" ", Alle ersetzen=TRUE) -> (Ergebnis-String=w12)
    call "Trim Whitespace.gvi"(String=w12) -> (Gekürzter String=w13)
    call "Search and Replace Pattern.gvi"(String=w9, Muster="\"", Alle ersetzen=TRUE) -> (Ergebnis-String=w14)
    # parm.value
    case (w13) {
      frame "False", Default {
        w15 = s1
        w16 = s2
        w17 = FALSE
        w18 = s4
      }
      frame "Chemical Controller Revision" {
        Is Equal(x=w14, y="0") -> w19
        case (w19) {
          frame False, Default {
            w18 = "AutoDose_available"
          }
          frame True {
            w18 = "AutoDose_not_available"
          }
        }
        w15 = s1
        w16 = w14
        w17 = FALSE
      }
      frame "Status UltraVent" {
        case (w14) {
          frame "false", Default {
            w16 = "Ultravent_not_available"
          }
          frame "true" {
            w16 = "Ultravent_available"
          }
        }
        w15 = s1
        w17 = FALSE
        w18 = s4
      }
      frame "Unit Type" {
        case (w14) {
          frame "False", Default {
            w20 = "No_Analyse.png"
            w15 = w14
            w17 = TRUE
          }
          frame "623", "E523" {
            call "Search and Replace Pattern.gvi"(string=s1, pattern="Device", replace string=w14) -> (result string=w15)
            w20 = "E523.jpg"
            w17 = FALSE
          }
          frame "E61", "E61T" {
            call "Search and Replace Pattern.gvi"(string=s1, pattern="Device", replace string=w14) -> (result string=w15)
            w20 = "E61.jpg"
            w17 = FALSE
          }
          frame "G61" {
            call "Search and Replace Pattern.gvi"(string=s1, pattern="Device", replace string=w14) -> (result string=w15)
            w20 = "G61.jpg"
            w17 = FALSE
          }
          frame "G62" {
            call "Search and Replace Pattern.gvi"(string=s1, pattern="Device", replace string=w14) -> (result string=w15)
            w20 = "G62.jpg"
            w17 = FALSE
          }
          frame "E62" {
            call "Search and Replace Pattern.gvi"(string=s1, pattern="Device", replace string=w14) -> (result string=w15)
            w20 = "E62.jpg"
            w17 = FALSE
          }
          frame "E101", "G101" {
            call "Search and Replace Pattern.gvi"(string=s1, pattern="Device", replace string=w14) -> (result string=w15)
            w20 = "E101.jpg"
            w17 = FALSE
          }
          frame "E102", "G102" {
            call "Search and Replace Pattern.gvi"(string=s1, pattern="Device", replace string=w14) -> (result string=w15)
            w20 = "E102.jpg"
            w17 = FALSE
          }
          frame "E201", "G201" {
            call "Search and Replace Pattern.gvi"(string=s1, pattern="Device", replace string=w14) -> (result string=w15)
            w20 = "E102.jpg"
            w17 = FALSE
          }
          frame "E202", "G202" {
            call "Search and Replace Pattern.gvi"(string=s1, pattern="Device", replace string=w14) -> (result string=w15)
            w20 = "E202.jpg"
            w17 = FALSE
          }
        }
        $"Device:" <- w20
        w16 = s2
        w18 = s4
      }
    }
    Is Empty String Or Path(string/path=w14) -> w21
    case (w21) {
      frame False {
        # w14: param_values
        # w13: param_name
        # w5: ini_Ultravent_infos
        # w16: Ultravent state
        # w15: Device type
        # w1: ini_Languages
        # w3: ini Comm_infos
        case (w13) {
          frame "False", Default {
            w22 = "✅"
            w23 = w14
            w24 = w16
            w25 = w6
            w26 = s3
          }
          frame "Date and Time" {
            call "Change_to_validate_Date.gvi"(Date_Time_String input=w14, Error Cluster input=w6) -> (Validate date and time=w23, Error Cluster output=w25)
            Decimal String To Number(string=w14) -> (offset past number=w27)
            Is Equal(x=w27, y=14) -> w28
            case (w28) {
              frame False, Default {
                w29 = "❌"  # String {0}
                Concatenate Strings(w29, " ", w13, " ", "is incorrect") -> w22
              }
              frame True {
                w22 = "✅"
              }
            }
            w24 = w16
            w26 = s3
          }
          frame "Startup Date and Time" {
            call "Change_to_validate_Date.gvi"(Date_Time_String input=w14, Error Cluster input=w6) -> (Validate date and time=w23, Error Cluster output=w25)
            Decimal String To Number(string=w14) -> (offset past number=w30)
            Is Equal(x=w30, y=14) -> w31
            case (w31) {
              frame False, Default {
                w32 = "❌"  # String {0}
                Concatenate Strings(w32, " ", w13, " ", "is incorrect") -> w22
              }
              frame True {
                w22 = "✅"
              }
            }
            w24 = w16
            w26 = w14
          }
          frame "Unit Serial number" {
            String Length(string=w14) -> (length=w33)
            Is Equal(x=w33, y=16) -> w34
            case (w34) {
              frame False, Default {
                w35 = "❌"  # String {0}
                Concatenate Strings(w35, " ", w13, " ", "is incorrect") -> w22
              }
              frame True {
                w22 = "✅"
              }
            }
            w23 = w14
            w24 = w16
            w25 = w6
            w26 = s3
          }
          frame "Language" {
            Decimal String To Number(string=w14) -> (number=w36)
            Is Greater Or Equal(x=w36, y=1) -> w37
            Is Less Or Equal(x=w36, y=65) -> w38
            Logical And(w37, w38) -> w39
            case (w39) {
              frame False, Default {
                w40 = "❌"  # String {0}
                Concatenate Strings(w40, " ", w13, " ", "is missing") -> w22
                w25 = w6
                w23 = w14
              }
              frame True {
                case (w36) {
                  frame 0, Default {
                    w25 = w6
                    w23 = w14
                  }
                  frame 1 {
                    w25 = w6
                    w23 = "catalan"
                  }
                  frame 2 {
                    w25 = w6
                    w23 = "czech"
                  }
                  frame 3 {
                    w25 = w6
                    w23 = "cymraeg"
                  }
                  frame 4 {
                    w25 = w6
                    w23 = "danish"
                  }
                  frame 5 {
                    w25 = w6
                    w23 = "german"
                  }
                  frame 6 {
                    w25 = w6
                    w23 = "german (Austria)"
                  }
                  frame 7 {
                    w25 = w6
                    w23 = "german (Swiss)"
                  }
                  frame 8 {
                    w25 = w6
                    w23 = "estonian"
                  }
                  frame 9 {
                    w25 = w6
                    w23 = "english (Australia)"
                  }
                  frame 10 {
                    w25 = w6
                    w23 = "english (Canada)"
                  }
                  frame 11 {
                    w25 = w6
                    w23 = "english (UK)"
                  }
                  frame 12 {
                    w25 = w6
                    w23 = "english (USA)"
                  }
                  frame 13 {
                    w25 = w6
                    w23 = "english (others)"
                  }
                  frame 14 {
                    w25 = w6
                    w23 = "spanish"
                  }
                  frame 15 {
                    w25 = w6
                    w23 = "spanish (Chile)"
                  }
                  frame 16 {
                    w25 = w6
                    w23 = "spanish (Peru)"
                  }
                  frame 17 {
                    w25 = w6
                    w23 = "spanish (USA)"
                  }
                  frame 18 {
                    w25 = w6
                    w23 = "spanish (Mexiko)"
                  }
                  frame 19 {
                    w25 = w6
                    w23 = "basque"
                  }
                  frame 20 {
                    w25 = w6
                    w23 = "french"
                  }
                  frame 21 {
                    w25 = w6
                    w23 = "french (Swiss)"
                  }
                  frame 22 {
                    w25 = w6
                    w23 = "french (Canada)"
                  }
                  frame 23 {
                    w25 = w6
                    w23 = "gaelic"
                  }
                  frame 24 {
                    w25 = w6
                    w23 = "croatian"
                  }
                  frame 25 {
                    w25 = w6
                    w23 = "icelandic"
                  }
                  frame 26 {
                    w25 = w6
                    w23 = "italian"
                  }
                  frame 27 {
                    w25 = w6
                    w23 = "italian (Swiss)"
                  }
                  frame 28 {
                    w25 = w6
                    w23 = "latvian"
                  }
                  frame 29 {
                    w25 = w6
                    w23 = "lithuanian"
                  }
                  frame 30 {
                    w25 = w6
                    w23 = "hungarian"
                  }
                  frame 31 {
                    w25 = w6
                    w23 = "malay"
                  }
                  frame 32 {
                    w25 = w6
                    w23 = "dutch"
                  }
                  frame 33 {
                    w25 = w6
                    w23 = "norgwgian"
                  }
                  frame 34 {
                    w25 = w6
                    w23 = "polish"
                  }
                  frame 35 {
                    w25 = w6
                    w23 = "portugese"
                  }
                  frame 36 {
                    w25 = w6
                    w23 = "portugese (Brasil)"
                  }
                  frame 37 {
                    w25 = w6
                    w23 = "romanian"
                  }
                  frame 38 {
                    w25 = w6
                    w23 = "slovensky"
                  }
                  frame 39 {
                    w25 = w6
                    w23 = "slovene"
                  }
                  frame 40 {
                    w25 = w6
                    w23 = "serbian"
                  }
                  frame 41 {
                    w25 = w6
                    w23 = "serbian (cyrill)"
                  }
                  frame 42 {
                    w25 = w6
                    w23 = "finnish"
                  }
                  frame 43 {
                    w25 = w6
                    w23 = "swedish"
                  }
                  frame 44 {
                    w25 = w6
                    w23 = "turkish"
                  }
                  frame 45 {
                    w25 = w6
                    w23 = "greek"
                  }
                  frame 46 {
                    w25 = w6
                    w23 = "bulgarian"
                  }
                  frame 47 {
                    w25 = w6
                    w23 = "russian"
                  }
                  frame 48 {
                    w25 = w6
                    w23 = "ukrainian"
                  }
                  frame 49 {
                    w25 = w6
                    w23 = "hebrew"
                  }
                  frame 50 {
                    w25 = w6
                    w23 = "arabic"
                  }
                  frame 51 {
                    w25 = w6
                    w23 = "hindi"
                  }
                  frame 52 {
                    w25 = w6
                    w23 = "thai"
                  }
                  frame 53 {
                    w25 = w6
                    w23 = "korean"
                  }
                  frame 54 {
                    w25 = w6
                    w23 = "japanese"
                  }
                  frame 55 {
                    w25 = w6
                    w23 = "chinese (new)"
                  }
                  frame 56 {
                    w25 = w6
                    w23 = "chinese (old)"
                  }
                  frame 57 {
                    w25 = w6
                    w23 = "philippine"
                  }
                  frame 58 {
                    w25 = w6
                    w23 = "english (India)"
                  }
                  frame 59 {
                    w25 = w6
                    w23 = "indonesian"
                  }
                  frame 60 {
                    w25 = w6
                    w23 = "persian"
                  }
                  frame 61 {
                    w25 = w6
                    w23 = "chinese (traditional & others)"
                  }
                  frame 62 {
                    w25 = w6
                    w23 = "spanish (Argentina)"
                  }
                  frame 63 {
                    w25 = w6
                    w23 = "spanish (Colombia)"
                  }
                  frame 64 {
                    w25 = w6
                    w23 = "azerbaijan"
                  }
                  frame 65 {
                    w25 = w6
                    w23 = "vietnamese"
                  }
                }
                w22 = "✅"
              }
            }
            w24 = w16
            w26 = s3
          }
          frame "Unit Type" {
            case (w14) {
              frame "False", Default {
                w41 = "Unit type is incorrect, analysis of the service report XML file is not possible"
                One Button Dialog(button name ("OK")="OK", message=w41)
                w42 = "❌"  # String {0}
                Concatenate Strings(w42, " ", w13, " ", "is incorrect") -> w22
              }
              frame "623", "E101", "E102", "E201", "E202", "E523", "E61", "E61T", "E62", "E623", "G101", "G102", "G201", "G202", "G61", "G62" {
                w22 = "✅"
              }
            }
            w23 = w14
            w24 = w16
            w25 = w6
            w26 = s3
          }
          frame "UltraVent Serial number" {
            case (w16) {
              frame "False", Default {
                w22 = "✅"
              }
              frame "Ultravent_available" {
                call "Trim Whitespace.gvi"(String=w14) -> (Gekürzter String=w43)
                Is Not Equal(x=w43, y="") -> w44
                case (w44) {
                  frame False, Default {
                    w45 = "❌"  # String {0}
                    Concatenate Strings(w45, " ", w13, " ", "is missing") -> w22
                  }
                  frame True {
                    case (w43) {
                      frame "False", Default {
                        w22 = "✅"
                      }
                      frame "0" {
                        w46 = "❌"  # String {0}
                        Concatenate Strings(w46, " ", w13, " ", "is incorrect") -> w22
                      }
                      frame "" {
                        w47 = "❌"  # String {0}
                        Concatenate Strings(w47, " ", w13, " ", "is missing") -> w22
                      }
                    }
                  }
                }
              }
            }
            w23 = w14
            w24 = w16
            w25 = w6
            w26 = s3
          }
          frame "UltraVent SW-version" {
            case (w16) {
              frame "False", Default {
                w22 = "✅"
              }
              frame "Ultravent_available" {
                Is Not Equal(x=w14, y="") -> w48
                case (w48) {
                  frame False, Default {
                    w49 = "❌"  # String {0}
                    Concatenate Strings(w49, " ", w13, " ", "is missing") -> w22
                  }
                  frame True {
                    case (w14) {
                      frame "False", Default {
                        w22 = "✅"
                      }
                      frame "0.0.0" {
                        w50 = "❌"  # String {0}
                        Concatenate Strings(w50, " ", w13, " ", "is incorrect") -> w22
                      }
                    }
                  }
                }
              }
            }
            w23 = w14
            w24 = w16
            w25 = w6
            w26 = s3
          }
          frame "Software version" {
            Match Pattern(regular expression="LM100", string=w14) -> (match substring=w51)
            Is Equal(x=w51, y="LM100") -> w52
            case (w52) {
              frame False, Default {
                w53 = "❌"  # String {0}
                Concatenate Strings(w53, " ", w13, " ", "is incorrect") -> w22
              }
              frame True {
                w22 = "✅"
              }
            }
            w23 = w14
            w24 = w16
            w25 = w6
            w26 = s3
          }
          frame "Chemical Controller Revision", "Chemical Controller SW-version", "Chemical Controller Serial number", "Conductivity Sensor Revision", "Conductivity Sensor SW-version", "Conductivity Sensor Serial number" {
            Is Equal(x=w18, y="AutoDose_available") -> w54
            case (w54) {
              frame False, Default {
                w55 = " Information not required for this device type"  # String {0}
                Concatenate Strings("[ℹ]", w55) -> w22
              }
              frame True {
                w22 = "✅"
              }
            }
            w23 = w14
            w24 = w16
            w25 = w6
            w26 = s3
          }
          frame "SDcard inserted" {
            Match Pattern(regular expression="OK", string=w14) -> (match substring=w56)
            Is Equal(x=w14, y=w56) -> w57
            case (w57) {
              frame False, Default {
                w58 = "❌"  # String {0}
                Concatenate Strings(w58, " ", "Check the inserted SDcard !", " ") -> w22
              }
              frame True {
                w22 = "✅"
              }
            }
            w23 = w14
            w24 = w16
            w25 = w6
            w26 = s3
          }
        }
      }
      frame True {
        case (w15) {
          frame "False", Default {
            case (w13) {
              frame "False", Default {
                w59 = "❌"  # String {0}
                Concatenate Strings(w59, " ", w13, " ", "is missing") -> w22
              }
              frame "Unit Type" {
                w60 = "Unit type is missing, analysis of the service report XML file is not possible"
                One Button Dialog(button name ("OK")="OK", message=w60)
                w61 = "❌"  # String {0}
                Concatenate Strings(w61, " ", w13, " ", "is missing") -> w22
              }
            }
          }
          frame "623", "E523" {
            # w13: par.name
            case (w13) {
              frame "Burner Control Manufactoring date", "Burner Control Revision", "Burner Control SW-version", "Burner Control Serial number", "Chemical Controller Revision", "Chemical Controller SW-version", "Chemical Controller Serial number", "Conductivity Sensor Revision", "Conductivity Sensor SW-version", "Conductivity Sensor Serial number", "Fan M16 Revision", "Fan M16 SW-version", "Fan M16 Serial number", "Fan M22 Revision", "Fan M22 SW-version", "Fan M22 Serial number", "Magnetron bottom Revision", "Magnetron bottom SW-version", "Magnetron bottom Serial number", "Magnetron top Revision", "Magnetron top SW-version", "Magnetron top Serial number", "Pump-Board Manufacturing date", "Pump-Board Revision", "Pump-Board SW-version", "Pump-Board Serial number" {
                w62 = " Information not required for this device type"  # String {0}
                Concatenate Strings("[ℹ]", w62) -> w22
              }
              frame "Energy optimisation", "Script version" {
                w63 = " Information is not available for this device"  # String {0}
                Concatenate Strings("[ℹ]", w63) -> w22
              }
              frame "UltraVent SW-version" {
                case (w16) {
                  frame "False", Default {
                    w64 = " Ultravent is not available for this device !"  # String {0}
                    Concatenate Strings("[ℹ]", w64) -> w22
                  }
                  frame "Ultravent_available" {
                    Is Not Equal(x=w14, y="") -> w65
                    case (w65) {
                      frame False, Default {
                        w66 = "❌"  # String {0}
                        Concatenate Strings(w66, " ", w13, " ", "is missing") -> w22
                      }
                      frame True {
                        case (w14) {
                          frame "False", Default {
                            w22 = "✅"
                          }
                          frame "0.0.0" {
                            w67 = "❌"  # String {0}
                            Concatenate Strings(w67, " ", w13, " ", "is incorrect") -> w22
                          }
                        }
                      }
                    }
                  }
                }
              }
              frame "UltraVent Serial number" {
                case (w16) {
                  frame "False", Default {
                    w68 = " Ultravent is not available for this device !"  # String {0}
                    Concatenate Strings("[ℹ]", w68) -> w22
                  }
                  frame "Ultravent_available" {
                    Is Not Equal(x=w14, y="") -> w69
                    case (w69) {
                      frame False, Default {
                        w70 = "❌"  # String {0}
                        Concatenate Strings(w70, " ", w13, " ", "is missing") -> w22
                      }
                      frame True {
                        case (w14) {
                          frame "False", Default {
                            w22 = "✅"
                          }
                          frame "0" {
                            w71 = "❌"  # String {0}
                            Concatenate Strings(w71, " ", w13, " ", "is incorrect") -> w22
                          }
                        }
                      }
                    }
                  }
                }
              }
              frame "True", Default {
                w72 = "❌"  # String {0}
                Concatenate Strings(w72, " ", w13, " ", "is missing") -> w22
              }
            }
          }
          frame "E61", "E62" {
            case (w13) {
              frame "Burner Control Manufactoring date", "Burner Control Revision", "Burner Control SW-version", "Burner Control Serial number", "Chemical Controller Revision", "Chemical Controller SW-version", "Chemical Controller Serial number", "Conductivity Sensor Revision", "Conductivity Sensor SW-version", "Conductivity Sensor Serial number", "Fan M16 Revision", "Fan M16 SW-version", "Fan M16 Serial number", "Fan M22 Revision", "Fan M22 SW-version", "Fan M22 Serial number", "Magnetron bottom Revision", "Magnetron bottom SW-version", "Magnetron bottom Serial number", "Magnetron top Revision", "Magnetron top SW-version", "Magnetron top Serial number", "SW-Version", "XS Additional PCB", "XS Additional PCB Revision", "XS Additional PCB SW-Version", "XS Additional PCB Serial Number" {
                w73 = " Information not required for this device type"  # String {0}
                Concatenate Strings("[ℹ]", w73) -> w22
              }
              frame "Script version" {
                w74 = " Information is not available for this device"  # String {0}
                Concatenate Strings("[ℹ]", w74) -> w22
              }
              frame "UltraVent SW-version" {
                case (w16) {
                  frame "False", Default {
                    w75 = " Ultravent is not available for this device !"  # String {0}
                    Concatenate Strings("[ℹ]", w75) -> w22
                  }
                  frame "Ultravent_available" {
                    Is Not Equal(x=w14, y="") -> w76
                    case (w76) {
                      frame False, Default {
                        w77 = "❌"  # String {0}
                        Concatenate Strings(w77, " ", w13, " ", "is missing") -> w22
                      }
                      frame True {
                        case (w14) {
                          frame "False", Default {
                            w22 = "✅"
                          }
                          frame "0.0.0" {
                            w78 = "❌"  # String {0}
                            Concatenate Strings(w78, " ", w13, " ", "is incorrect") -> w22
                          }
                        }
                      }
                    }
                  }
                }
              }
              frame "UltraVent Serial number" {
                case (w16) {
                  frame "False", Default {
                    w79 = " Ultravent is not available for this device !"  # String {0}
                    Concatenate Strings("[ℹ]", w79) -> w22
                  }
                  frame "Ultravent_available" {
                    Is Not Equal(x=w14, y="") -> w80
                    case (w80) {
                      frame False, Default {
                        w81 = "❌"  # String {0}
                        Concatenate Strings(w81, " ", w13, " ", "is missing") -> w22
                      }
                      frame True {
                        case (w14) {
                          frame "False", Default {
                            w22 = "✅"
                          }
                          frame "0.0.0" {
                            w82 = "❌"  # String {0}
                            Concatenate Strings(w82, " ", w13, " ", "is incorrect") -> w22
                          }
                        }
                      }
                    }
                  }
                }
              }
              frame "True", Default {
                w83 = "❌"  # String {0}
                Concatenate Strings(w83, " ", w13, " ", "is missing") -> w22
              }
            }
          }
          frame "E61T", "E62T" {
            case (w13) {
              frame "Burner Control Revision", "Burner Control SW-version", "Burner Control Serial number", "Fan M16 Revision", "Fan M16 SW-version", "Fan M16 Serial number", "Fan M22 Revision", "Fan M22 SW-version", "Fan M22 Serial number", "SW-Version", "XS Additional PCB", "XS Additional PCB Revision", "XS Additional PCB SW-Version", "XS Additional PCB Serial Number" {
                w84 = " Information not required for this device type"  # String {0}
                Concatenate Strings("[ℹ]", w84) -> w22
              }
              frame "Energy optimisation", "Script version" {
                w85 = " Information is not available for this device"  # String {0}
                Concatenate Strings("[ℹ]", w85) -> w22
              }
              frame "UltraVent SW-version" {
                case (w16) {
                  frame "False", Default {
                    w86 = " Ultravent is not available for this device !"  # String {0}
                    Concatenate Strings("[ℹ]", w86) -> w22
                  }
                  frame "Ultravent_available" {
                    Is Not Equal(x=w14, y="") -> w87
                    case (w87) {
                      frame False, Default {
                        w88 = "❌"  # String {0}
                        Concatenate Strings(w88, " ", w13, " ", "is missing") -> w22
                      }
                      frame True {
                        case (w14) {
                          frame "False", Default {
                            w22 = "✅"
                          }
                          frame "0.0.0" {
                            w89 = "❌"  # String {0}
                            Concatenate Strings(w89, " ", w13, " ", "is incorrect") -> w22
                          }
                        }
                      }
                    }
                  }
                }
              }
              frame "UltraVent Serial number" {
                case (w16) {
                  frame "False", Default {
                    w90 = " Ultravent is not available for this device !"  # String {0}
                    Concatenate Strings("[ℹ]", w90) -> w22
                  }
                  frame "Ultravent_available" {
                    Is Not Equal(x=w14, y="") -> w91
                    case (w91) {
                      frame False, Default {
                        w92 = "❌"  # String {0}
                        Concatenate Strings(w92, " ", w13, " ", "is missing") -> w22
                      }
                      frame True {
                        case (w14) {
                          frame "False", Default {
                            w22 = "✅"
                          }
                          frame "0" {
                            w93 = "❌"  # String {0}
                            Concatenate Strings(w93, " ", w13, " ", "is incorrect") -> w22
                          }
                        }
                      }
                    }
                  }
                }
              }
              frame "True", Default {
                w94 = "❌"  # String {0}
                Concatenate Strings(w94, " ", w13, " ", "is missing") -> w22
              }
            }
          }
          frame "E101", "E102" {
            case (w13) {
              frame "Burner Control Manufactoring date", "Burner Control Revision", "Burner Control SW-version", "Burner Control Serial number", "Chemical Controller Revision", "Chemical Controller SW-version", "Chemical Controller Serial number", "Conductivity Sensor Revision", "Conductivity Sensor SW-version", "Conductivity Sensor Serial number", "Fan M22 Revision", "Fan M22 SW-version", "Fan M22 Serial number", "Magnetron bottom Revision", "Magnetron bottom SW-version", "Magnetron bottom Serial number", "Magnetron top Revision", "Magnetron top SW-version", "Magnetron top Serial number", "SW-Version", "XS Additional PCB", "XS Additional PCB Revision", "XS Additional PCB SW-Version", "XS Additional PCB Serial Number" {
                w95 = " Information not required for this device type"  # String {0}
                Concatenate Strings("[ℹ]", w95) -> w22
              }
              frame "Energy optimisation", "Script version" {
                w96 = "  Information is not available for this device"  # String {0}
                Concatenate Strings("[ℹ]", w96) -> w22
              }
              frame "UltraVent SW-version" {
                case (w16) {
                  frame "False", Default {
                    w97 = " Ultravent is not available for this device !"  # String {0}
                    Concatenate Strings("[ℹ]", w97) -> w22
                  }
                  frame "Ultravent_available" {
                    Is Not Equal(x=w14, y="") -> w98
                    case (w98) {
                      frame False, Default {
                        w99 = "❌"  # String {0}
                        Concatenate Strings(w99, " ", w13, " ", "is missing") -> w22
                      }
                      frame True {
                        case (w14) {
                          frame "False", Default {
                            w22 = "✅"
                          }
                          frame "0.0.0" {
                            w100 = "❌"  # String {0}
                            Concatenate Strings(w100, " ", w13, " ", "is incorrect") -> w22
                          }
                        }
                      }
                    }
                  }
                }
              }
              frame "UltraVent Serial number" {
                case (w16) {
                  frame "False", Default {
                    w101 = " Ultravent is not available for this device !"  # String {0}
                    Concatenate Strings("[ℹ]", w101) -> w22
                  }
                  frame "Ultravent_available" {
                    Is Not Equal(x=w14, y="") -> w102
                    case (w102) {
                      frame False, Default {
                        w103 = "❌"  # String {0}
                        Concatenate Strings(w103, " ", w13, " ", "is missing") -> w22
                      }
                      frame True {
                        case (w14) {
                          frame "False", Default {
                            w22 = "✅"
                          }
                          frame "0" {
                            w104 = "❌"  # String {0}
                            Concatenate Strings(w104, " ", w13, " ", "is incorrect") -> w22
                          }
                        }
                      }
                    }
                  }
                }
              }
              frame "True", Default {
                w105 = "❌"  # String {0}
                Concatenate Strings(w105, " ", w13, " ", "is missing") -> w22
              }
            }
          }
          frame "G101", "G102" {
            case (w13) {
              frame "Chemical Controller Revision", "Chemical Controller SW-version", "Chemical Controller Serial number", "Conductivity Sensor Revision", "Conductivity Sensor SW-version", "Conductivity Sensor Serial number", "Fan M22 Revision", "Fan M22 SW-version", "Fan M22 Serial number", "Magnetron bottom Revision", "Magnetron bottom SW-version", "Magnetron bottom Serial number", "Magnetron top Revision", "Magnetron top SW-version", "Magnetron top Serial number", "XS Additional PCB", "XS Additional PCB Revision", "XS Additional PCB SW-Version", "XS Additional PCB Serial Number" {
                w106 = " Information not required for this device type"  # String {0}
                Concatenate Strings("[ℹ]", w106) -> w22
              }
              frame "Energy optimisation", "Script version" {
                w107 = " Information is not available for this device"  # String {0}
                Concatenate Strings("[ℹ]", w107) -> w22
              }
              frame "UltraVent SW-version" {
                case (w16) {
                  frame "False", Default {
                    w108 = " Ultravent is not available for this device !"  # String {0}
                    Concatenate Strings("[ℹ]", w108) -> w22
                  }
                  frame "Ultravent_available" {
                    Is Not Equal(x=w14, y="") -> w109
                    case (w109) {
                      frame False, Default {
                        w110 = "❌"  # String {0}
                        Concatenate Strings(w110, " ", w13, " ", "is missing") -> w22
                      }
                      frame True {
                        case (w14) {
                          frame "False", Default {
                            w22 = "✅"
                          }
                          frame "0.0.0" {
                            w111 = "❌"  # String {0}
                            Concatenate Strings(w111, " ", w13, " ", "is incorrect") -> w22
                          }
                        }
                      }
                    }
                  }
                }
              }
              frame "UltraVent Serial number" {
                case (w16) {
                  frame "False", Default {
                    w112 = " Ultravent is not available for this device !"  # String {0}
                    Concatenate Strings("[ℹ]", w112) -> w22
                  }
                  frame "Ultravent_available" {
                    Is Not Equal(x=w14, y="") -> w113
                    case (w113) {
                      frame False, Default {
                        w114 = "❌"  # String {0}
                        Concatenate Strings(w114, " ", w13, " ", "is missing") -> w22
                      }
                      frame True {
                        case (w14) {
                          frame "False", Default {
                            w22 = "✅"
                          }
                          frame "0" {
                            w115 = "❌"  # String {0}
                            Concatenate Strings(w115, " ", w13, " ", "is incorrect") -> w22
                          }
                        }
                      }
                    }
                  }
                }
              }
              frame "True", Default {
                w116 = "❌"  # String {0}
                Concatenate Strings(w116, " ", w13, " ", "is missing") -> w22
              }
            }
          }
          frame "E201", "E202" {
            case (w13) {
              frame "Burner Control Manufactoring date", "Burner Control Revision", "Burner Control SW-version", "Burner Control Serial number", "Chemical Controller Revision", "Chemical Controller SW-version", "Chemical Controller Serial number", "Conductivity Sensor Revision", "Conductivity Sensor SW-version", "Conductivity Sensor Serial number", "Magnetron bottom Revision", "Magnetron bottom SW-version", "Magnetron bottom Serial number", "Magnetron top Revision", "Magnetron top SW-version", "Magnetron top Serial number", "SW-Version", "XS Additional PCB", "XS Additional PCB Revision", "XS Additional PCB SW-Version", "XS Additional PCB Serial Number" {
                w117 = " Information not required for this device type"  # String {0}
                Concatenate Strings("[ℹ]", w117) -> w22
              }
              frame "Energy optimisation", "Script version" {
                w118 = " Information is not available for this device"  # String {0}
                Concatenate Strings("[ℹ]", w118) -> w22
              }
              frame "UltraVent SW-version" {
                case (w16) {
                  frame "False", Default {
                    w119 = " Ultravent is not available for this device !"  # String {0}
                    Concatenate Strings("[ℹ]", w119) -> w22
                  }
                  frame "Ultravent_available" {
                    Is Not Equal(x=w14, y="") -> w120
                    case (w120) {
                      frame False, Default {
                        w121 = "❌"  # String {0}
                        Concatenate Strings(w121, " ", w13, " ", "is missing") -> w22
                      }
                      frame True {
                        case (w14) {
                          frame "False", Default {
                            w22 = "✅"
                          }
                          frame "0.0.0" {
                            w122 = "❌"  # String {0}
                            Concatenate Strings(w122, " ", w13, " ", "is incorrect") -> w22
                          }
                        }
                      }
                    }
                  }
                }
              }
              frame "UltraVent Serial number" {
                case (w16) {
                  frame "False", Default {
                    w123 = " Ultravent is not available for this device !"  # String {0}
                    Concatenate Strings("[ℹ]", w123) -> w22
                  }
                  frame "Ultravent_available" {
                    Is Not Equal(x=w14, y="") -> w124
                    case (w124) {
                      frame False, Default {
                        w125 = "❌"  # String {0}
                        Concatenate Strings(w125, " ", w13, " ", "is missing") -> w22
                      }
                      frame True {
                        case (w14) {
                          frame "False", Default {
                            w22 = "✅"
                          }
                          frame "0" {
                            w126 = "❌"  # String {0}
                            Concatenate Strings(w126, " ", w13, " ", "is incorrect") -> w22
                          }
                        }
                      }
                    }
                  }
                }
              }
              frame "True", Default {
                w127 = "❌"  # String {0}
                Concatenate Strings(w127, " ", w13, " ", "is missing") -> w22
              }
            }
          }
          frame "G201", "G202" {
            case (w13) {
              frame "Chemical Controller Revision", "Chemical Controller SW-version", "Chemical Controller Serial number", "Conductivity Sensor Revision", "Conductivity Sensor SW-version", "Conductivity Sensor Serial number", "Magnetron bottom Revision", "Magnetron bottom SW-version", "Magnetron bottom Serial number", "Magnetron top Revision", "Magnetron top SW-version", "Magnetron top Serial number", "XS Additional PCB", "XS Additional PCB Revision", "XS Additional PCB SW-Version", "XS Additional PCB Serial Number" {
                w128 = " Information not required for this device type"  # String {0}
                Concatenate Strings("[ℹ]", w128) -> w22
              }
              frame "Energy optimisation", "Script version" {
                w129 = " Information is not available for this device"  # String {0}
                Concatenate Strings("[ℹ]", w129) -> w22
              }
              frame "UltraVent SW-version" {
                case (w16) {
                  frame "False", Default {
                    w130 = " Ultravent is not available for this device !"  # String {0}
                    Concatenate Strings("[ℹ]", w130) -> w22
                  }
                  frame "Ultravent_available" {
                    Is Not Equal(x=w14, y="") -> w131
                    case (w131) {
                      frame False, Default {
                        w132 = "❌"  # String {0}
                        Concatenate Strings(w132, " ", w13, " ", "is missing") -> w22
                      }
                      frame True {
                        case (w14) {
                          frame "False", Default {
                            w22 = "✅"
                          }
                          frame "0.0.0" {
                            w133 = "❌"  # String {0}
                            Concatenate Strings(w133, " ", w13, " ", "is incorrect") -> w22
                          }
                        }
                      }
                    }
                  }
                }
              }
              frame "UltraVent Serial number" {
                case (w16) {
                  frame "False", Default {
                    w134 = " Ultravent is not available for this device !"  # String {0}
                    Concatenate Strings("[ℹ]", w134) -> w22
                  }
                  frame "Ultravent_available" {
                    Is Not Equal(x=w14, y="") -> w135
                    case (w135) {
                      frame False, Default {
                        w136 = "❌"  # String {0}
                        Concatenate Strings(w136, " ", w13, " ", "is missing") -> w22
                      }
                      frame True {
                        case (w14) {
                          frame "False", Default {
                            w22 = "✅"
                          }
                          frame "0" {
                            w137 = "❌"  # String {0}
                            Concatenate Strings(w137, " ", w13, " ", "is incorrect") -> w22
                          }
                        }
                      }
                    }
                  }
                }
              }
              frame "True", Default {
                w138 = "❌"  # String {0}
                Concatenate Strings(w138, " ", w13, " ", "is missing") -> w22
              }
            }
          }
          frame "G61", "G62" {
            case (w13) {
              frame "Chemical Controller Revision", "Chemical Controller SW-version", "Chemical Controller Serial number", "Conductivity Sensor Revision", "Conductivity Sensor SW-version", "Conductivity Sensor Serial number", "Fan M16 Revision", "Fan M16 SW-version", "Fan M16 Serial number", "Fan M22 Revision", "Fan M22 SW-version", "Fan M22 Serial number", "Magnetron bottom Revision", "Magnetron bottom SW-version", "Magnetron bottom Serial number", "Magnetron top Revision", "Magnetron top SW-version", "Magnetron top Serial number", "XS Additional PCB", "XS Additional PCB Revision", "XS Additional PCB SW-Version", "XS Additional PCB Serial Number" {
                w139 = " Information not required for this device type"  # String {0}
                Concatenate Strings("[ℹ]", w139) -> w22
              }
              frame "Energy optimisation", "Script version" {
                w140 = " Information is not available for this device"  # String {0}
                Concatenate Strings("[ℹ]", w140) -> w22
              }
              frame "UltraVent SW-version" {
                case (w16) {
                  frame "False", Default {
                    w141 = " Ultravent is not available for this device !"  # String {0}
                    Concatenate Strings("[ℹ]", w141) -> w22
                  }
                  frame "Ultravent_available" {
                    Is Not Equal(x=w14, y="") -> w142
                    case (w142) {
                      frame False, Default {
                        w143 = "❌"  # String {0}
                        Concatenate Strings(w143, " ", w13, " ", "is missing") -> w22
                      }
                      frame True {
                        case (w14) {
                          frame "False", Default {
                            w22 = "✅"
                          }
                          frame "0.0.0" {
                            w144 = "❌"  # String {0}
                            Concatenate Strings(w144, " ", w13, " ", "is incorrect") -> w22
                          }
                        }
                      }
                    }
                  }
                }
              }
              frame "UltraVent Serial number" {
                case (w16) {
                  frame "False", Default {
                    w145 = " Ultravent is not available for this device !"  # String {0}
                    Concatenate Strings("[ℹ]", w145) -> w22
                  }
                  frame "Ultravent_available" {
                    Is Not Equal(x=w14, y="") -> w146
                    case (w146) {
                      frame False, Default {
                        w147 = "❌"  # String {0}
                        Concatenate Strings(w147, " ", w13, " ", "is missing") -> w22
                      }
                      frame True {
                        case (w14) {
                          frame "False", Default {
                            w22 = "✅"
                          }
                          frame "0" {
                            w148 = "❌"  # String {0}
                            Concatenate Strings(w148, " ", w13, " ", "is incorrect") -> w22
                          }
                        }
                      }
                    }
                  }
                }
              }
              frame "True", Default {
                w149 = "❌"  # String {0}
                Concatenate Strings(w149, " ", w13, " ", "is missing") -> w22
              }
            }
          }
        }
        w23 = w14
        w24 = w16
        w25 = w6
        w26 = s3
      }
    }
    Property Node(instance in=T2 {all zero or empty}, "Parameter Name"=w13, "Value"=w23, "Comment"=w22) -> (instance out=w150)
    append w150 to w8
    next s1 = w15
    next s2 = w24
    next s3 = w26
    next s4 = w18
    stop if w17
  }
  $common <- w8
  s5 = string[] []  # shift register
  s6 = string[] []  # shift register
  for {
    w151 = each element of w8
    Property Node(instance in=w151) -> ("Parameter Name"=w152, "Value"=w153)
    case (w152) {
      frame "False", Default {
        w154 = s5
        w155 = s6
      }
      frame "Touchcontroller type" {
        Insert Into Array(inArray=s6, new=w152) -> w155
        case (w153) {
          frame "False", Default {
            w156 = "------"
          }
          frame "T1" {
            w156 = "Atmel Chip"
          }
          frame "T2" {
            w156 = "ILITEK"
          }
        }
        Insert Into Array(inArray=s5, new=w156) -> w154
      }
      frame "CPU-Board Revision" {
        Insert Into Array(inArray=s6, new=w152) -> w155
        case (w153) {
          frame "False", Default {
            w157 = "Benchmark Board"
          }
          frame "A0" {
            w157 = "Avnet Board"
          }
        }
        Insert Into Array(inArray=s5, new=w157) -> w154
      }
      frame "IO-Board Serial number" {
        Insert Into Array(inArray=s6, new=w152) -> w155
        String Subset(length (rest)=1, string=w153) -> w158
        case (w158) {
          frame "False", Default {
            w159 = "IO"
          }
          frame "C" {
            w159 = "IO LO"
          }
        }
        Insert Into Array(inArray=s5, new=w159) -> w154
      }
      frame "Pump-Board Serial number" {
        Insert Into Array(inArray=s6, new="Pump-Board μC-Type") -> w155
        String Subset(length (rest)=3, string=w153) -> w160
        case (w160) {
          frame "False", Default {
            w161 = "IO"
          }
          frame "PC6" {
            w161 = "G4"
          }
          frame "PC3" {
            w161 = "F1"
          }
        }
        Insert Into Array(inArray=s5, new=w161) -> w154
      }
    }
    next s5 = w154
    next s6 = w155
  }
  for {
    w162 = each element of s6
    w163 = each element of s5
    Property Node(instance in=T1 {all zero or empty}, "Boards"=w162, "Informations"=w163) -> (instance out=w165)
    append w165 to w164
  }
  $"Boards Informations:" <- w164
  $"Unit-type" <- s1
  $"Output Error" <- w25
  $"Startup Date and Time" <- s3
  $Ultravent <- s2
  $Output <- s4
