vi "Interpret_Diagnostic_RT_Data_Sensors.gviweb"   [G Web Development Software 22.3.0]
inputs:
  "Diagnostic Settings Entrys": string[]
  "Config File infos": string[]
  "Device Type": string = "Device"
  "Error input": error
outputs:
  "Output Error": error
  "Diagnostic_RT_Data_Sensors": T1[]
types:
  T1 = cluster{"Parameter Name": string, "Actual": string, "Dimension": string, "Limit": string, "maximum": string, "Time_stamp": string, "Comment": string}
  T2 = cluster{"Parameter Name": string, "Actual": string, "Dimension": string, "Limit": string, "maximum": string, "time_stamp": string, "comment": string}
uses:
  WebApp::Get_Config_ini_Part.gviweb
  NI::G Core::Strings::Search and Replace Pattern.gvi
  NI::G Core::Strings::Trim Whitespace.gvi
diagram:
  call "Get_Config_ini_Part.gviweb"(Ini Array=$"Config File infos", ini Part from Array=6, Error in=$"Error input") -> (Ini Part as Array=w1, Output Error=w2)
  for (after w1) {
    w3 = each element of $"Diagnostic Settings Entrys"
    Match Pattern(regular expression="actual", string=w3) -> (after substring=w5, before substring=w6)
    call "Search and Replace Pattern.gvi"(String=w6, Muster="_", Ersetzungs-String=" ", Alle ersetzen=TRUE) -> (Ergebnis-String=w7)
    call "Trim Whitespace.gvi"(string=w7) -> (trimmed string=w8)
    Match Pattern(regular expression="dim", string=w5) -> (after substring=w9, before substring=w10)
    call "Search and Replace Pattern.gvi"(String=w10, Muster="=\"", Alle ersetzen=TRUE) -> (Ergebnis-String=w11)
    call "Search and Replace Pattern.gvi"(String=w11, Muster="\"", Alle ersetzen=TRUE) -> (Ergebnis-String=w12)
    # w8: parm name
    call "Trim Whitespace.gvi"(string=w12) -> (trimmed string=w13)
    call "Search and Replace Pattern.gvi"(String=w9, Muster="=\"", Alle ersetzen=TRUE) -> (Ergebnis-String=w14)
    Match Pattern(regular expression="lim", string=w14) -> (after substring=w15, before substring=w16)
    Match Pattern(regular expression="maximum", string=w15) -> (after substring=w17, before substring=w18)
    Match Pattern(regular expression="time_stamp", string=w17) -> (after substring=w19, before substring=w20)
    # timestamp
    case ($"Device Type") {
      frame "False", Default {
        w21 = "✅"
      }
      frame "623", "E523", "E623" {
        # w8: parm name
        # w13: actual
        # w19: timestamp
        case (w8) {
          frame "False", Default {
            Decimal String To Number(string=w19) -> (offset past number=w22)
            Is Greater(x=w22, y=10) -> w23
            case (w23) {
              frame False, Default {
                Decimal String To Number(default (0 I32)=0, string=w13) -> (number=w24)
                In Range And Coerce(lower limit=0, upper limit=614, x=w24) -> (In Range?=w25)
                case (w25) {
                  frame False, Default {
                    w21 = "❌ Temperature not plausible, please check the sensor"
                  }
                  frame True {
                    w21 = "✅"
                  }
                }
              }
              frame True {
                call "Search and Replace Pattern.gvi"(String=w8, Muster="Temperature ", Alle ersetzen=TRUE) -> (Ergebnis-String=w26)
                w27 = "❌"  # String {0}
                Concatenate Strings(w27, "maximum temperatur of", " ", w26, "\r\n", "was reached") -> w21
              }
            }
          }
          frame "Cabinet B9", "HotAir Bottom Average HeatReq Lifetime Burner", "HotAir Bottom Average HeatReq Lifetime Device", "HotAir Top Average HeatReq Lifetime Burner", "HotAir Top Average HeatReq Lifetime Device", "Steam Average HeatReq Lifetime Burner", "Steam Average HeatReq Lifetime Device", "Temperature Fan Bottom", "Temperature Fan Middle", "Temperature LED handle side", "Temperature LED hinge side", "Temperature Pump Board" {
            w28 = " Information not required for this device type"  # String {0}
            Concatenate Strings("[ℹ]", w28) -> w21
          }
        }
      }
      frame "E61", "E62" {
        case (w8) {
          frame "False", Default {
            Decimal String To Number(string=w19) -> (offset past number=w29)
            Is Greater(x=w29, y=10) -> w30
            case (w30) {
              frame False, Default {
                Decimal String To Number(default (0 I32)=0, string=w13) -> (number=w31)
                In Range And Coerce(lower limit=0, upper limit=614, x=w31) -> (In Range?=w32)
                case (w32) {
                  frame False, Default {
                    w21 = "❌ Temperature not plausible, please check the sensor"
                  }
                  frame True {
                    w21 = "✅"
                  }
                }
              }
              frame True {
                call "Search and Replace Pattern.gvi"(String=w8, Muster="Temperature ", Alle ersetzen=TRUE) -> (Ergebnis-String=w33)
                w34 = "❌"  # String {0}
                Concatenate Strings(w34, "maximum temperatur of", " ", w33, "\r\n", "was reached") -> w21
              }
            }
          }
          frame "Cabinet B9", "Electrical Compartment B10", "HotAir Bottom Average HeatReq Lifetime Burner", "HotAir Bottom Average HeatReq Lifetime Device", "HotAir Top Average HeatReq Lifetime Burner", "HotAir Top Average HeatReq Lifetime Device", "Magnetron Power Supply Temperature bottom", "Magnetron Power Supply Temperature top", "Magnetron Temperature bottom", "Magnetron Temperature top", "Steam Average HeatReq Lifetime Burner", "Steam Average HeatReq Lifetime Device", "Temperature Fan Bottom", "Temperature Fan Middle" {
            w35 = " Information not required for this device type"  # String {0}
            Concatenate Strings("[ℹ]", w35) -> w21
          }
        }
      }
      frame "E61T", "E62T" {
        case (w8) {
          frame "False", Default {
            Decimal String To Number(string=w19) -> (offset past number=w36)
            Is Greater(x=w36, y=10) -> w37
            case (w37) {
              frame False, Default {
                Decimal String To Number(default (0 I32)=0, string=w13) -> (number=w38)
                In Range And Coerce(lower limit=0, upper limit=614, x=w38) -> (In Range?=w39)
                case (w39) {
                  frame False, Default {
                    w21 = "❌ Temperature not plausible, please check the sensor"
                  }
                  frame True {
                    w21 = "✅"
                  }
                }
              }
              frame True {
                call "Search and Replace Pattern.gvi"(String=w8, Muster="Temperature ", Alle ersetzen=TRUE) -> (Ergebnis-String=w40)
                w41 = "❌"  # String {0}
                Concatenate Strings(w41, "maximum temperatur of", " ", w40, "\r\n", "was reached") -> w21
              }
            }
          }
          frame "Cabinet B9", "Electrical Compartment B10", "HotAir Bottom Average HeatReq Lifetime Burner", "HotAir Bottom Average HeatReq Lifetime Device", "HotAir Top Average HeatReq Lifetime Burner", "HotAir Top Average HeatReq Lifetime Device", "Steam Average HeatReq Lifetime Burner", "Steam Average HeatReq Lifetime Device", "Temperature Fan Bottom", "Temperature Fan Middle" {
            w42 = " Information not required for this device type"  # String {0}
            Concatenate Strings("[ℹ]", w42) -> w21
          }
        }
      }
      frame "G61", "G62" {
        case (w8) {
          frame "False", Default {
            Decimal String To Number(string=w19) -> (offset past number=w43)
            Is Greater(x=w43, y=10) -> w44
            case (w44) {
              frame False, Default {
                Decimal String To Number(default (0 I32)=0, string=w13) -> (number=w45)
                In Range And Coerce(lower limit=0, upper limit=614, x=w45) -> (In Range?=w46)
                case (w46) {
                  frame False, Default {
                    w21 = "❌ Temperature not plausible, please check the sensor"
                  }
                  frame True {
                    w21 = "✅"
                  }
                }
              }
              frame True {
                call "Search and Replace Pattern.gvi"(String=w8, Muster="Temperature ", Alle ersetzen=TRUE) -> (Ergebnis-String=w47)
                w48 = "❌"  # String {0}
                Concatenate Strings(w48, "maximum temperatur of", " ", w47, "\r\n", "was reached") -> w21
              }
            }
          }
          frame "Cabinet B9", "Electrical Compartment B10", "HotAir Bottom Average HeatReq Last3Month", "HotAir Bottom Average HeatReq Lifetime Burner", "HotAir Bottom Average HeatReq Lifetime Device", "Magnetron Power Supply Temperature bottom", "Magnetron Power Supply Temperature top", "Magnetron Temperature bottom", "Magnetron Temperature top", "Temperature Fan Bottom", "Temperature Fan Middle" {
            w49 = " Information not required for this device type"  # String {0}
            Concatenate Strings("[ℹ]", w49) -> w21
          }
        }
      }
      frame "E101", "E102" {
        case (w8) {
          frame "False", Default {
            Decimal String To Number(string=w19) -> (offset past number=w50)
            Is Greater(x=w50, y=10) -> w51
            case (w51) {
              frame False, Default {
                Decimal String To Number(default (0 I32)=0, string=w13) -> (number=w52)
                In Range And Coerce(lower limit=0, upper limit=614, x=w52) -> (In Range?=w53)
                case (w53) {
                  frame False, Default {
                    w21 = "❌ Temperature not plausible, please check the sensor"
                  }
                  frame True {
                    w21 = "✅"
                  }
                }
              }
              frame True {
                call "Search and Replace Pattern.gvi"(String=w8, Muster="Temperature ", Alle ersetzen=TRUE) -> (Ergebnis-String=w54)
                w55 = "❌"  # String {0}
                Concatenate Strings(w55, "maximum temperatur of", " ", w54, "\r\n", "was reached") -> w21
              }
            }
          }
          frame "Cabinet B9", "Electrical Compartment B10", "HotAir Bottom Average HeatReq Lifetime Burner", "HotAir Bottom Average HeatReq Lifetime Device", "HotAir Top Average HeatReq Lifetime Burner", "HotAir Top Average HeatReq Lifetime Device", "Magnetron Power Supply Temperature bottom", "Magnetron Power Supply Temperature top", "Magnetron Temperature bottom", "Magnetron Temperature top", "Steam Average HeatReq Lifetime Burner", "Steam Average HeatReq Lifetime Device", "Temperature Fan Bottom" {
            w56 = " Information not required for this device type"  # String {0}
            Concatenate Strings("[ℹ]", w56) -> w21
          }
        }
      }
      frame "E201", "E202" {
        case (w8) {
          frame "False", Default {
            Decimal String To Number(string=w19) -> (offset past number=w57)
            Is Greater(x=w57, y=10) -> w58
            case (w58) {
              frame False, Default {
                Decimal String To Number(default (0 I32)=0, string=w13) -> (number=w59)
                In Range And Coerce(lower limit=0, upper limit=614, x=w59) -> (In Range?=w60)
                case (w60) {
                  frame False, Default {
                    w21 = "❌ Temperature not plausible, please check the sensor"
                  }
                  frame True {
                    w21 = "✅"
                  }
                }
              }
              frame True {
                call "Search and Replace Pattern.gvi"(String=w8, Muster="Temperature ", Alle ersetzen=TRUE) -> (Ergebnis-String=w61)
                w62 = "❌"  # String {0}
                Concatenate Strings(w62, "maximum temperatur of", " ", w61, "\r\n", "was reached") -> w21
              }
            }
          }
          frame "Electrical Compartment B10", "HotAir Bottom Average HeatReq Lifetime Burner", "HotAir Bottom Average HeatReq Lifetime Device", "HotAir Top Average HeatReq Lifetime Burner", "HotAir Top Average HeatReq Lifetime Device", "Magnetron Power Supply Temperature bottom", "Magnetron Power Supply Temperature top", "Magnetron Temperature bottom", "Magnetron Temperature top", "Steam Average HeatReq Lifetime Burner", "Steam Average HeatReq Lifetime Device", "Temperature LED handle side", "Temperature LED hinge side" {
            w63 = " Information not required for this device type"  # String {0}
            Concatenate Strings("[ℹ]", w63) -> w21
          }
        }
      }
      frame "G101", "G102" {
        case (w8) {
          frame "False", Default {
            Decimal String To Number(string=w19) -> (offset past number=w64)
            Is Greater(x=w64, y=10) -> w65
            case (w65) {
              frame False, Default {
                Decimal String To Number(default (0 I32)=0, string=w13) -> (number=w66)
                In Range And Coerce(lower limit=0, upper limit=614, x=w66) -> (In Range?=w67)
                case (w67) {
                  frame False, Default {
                    w21 = "❌ Temperature not plausible, please check the sensor"
                  }
                  frame True {
                    w21 = "✅"
                  }
                }
              }
              frame True {
                call "Search and Replace Pattern.gvi"(String=w8, Muster="Temperature ", Alle ersetzen=TRUE) -> (Ergebnis-String=w68)
                w69 = "❌"  # String {0}
                Concatenate Strings(w69, "maximum temperatur of", " ", w68, "\r\n", "was reached") -> w21
              }
            }
          }
          frame "Cabinet B9", "Electrical Compartment B10", "HotAir Bottom Average HeatReq Lifetime Burner", "HotAir Bottom Average HeatReq Lifetime Device", "Magnetron Power Supply Temperature bottom", "Magnetron Power Supply Temperature top", "Magnetron Temperature bottom", "Magnetron Temperature top", "Temperature Fan Bottom" {
            w70 = " Information not required for this device type"  # String {0}
            Concatenate Strings("[ℹ]", w70) -> w21
          }
        }
      }
      frame "G201", "G202" {
        case (w8) {
          frame "False", Default {
            Decimal String To Number(string=w19) -> (offset past number=w71)
            Is Greater(x=w71, y=10) -> w72
            case (w72) {
              frame False, Default {
                Decimal String To Number(default (0 I32)=0, string=w13) -> (number=w73)
                In Range And Coerce(lower limit=0, upper limit=614, x=w73) -> (In Range?=w74)
                case (w74) {
                  frame False, Default {
                    w21 = "❌ Temperature not plausible, please check the sensor"
                  }
                  frame True {
                    w21 = "✅"
                  }
                }
              }
              frame True {
                call "Search and Replace Pattern.gvi"(String=w8, Muster="Temperature ", Alle ersetzen=TRUE) -> (Ergebnis-String=w75)
                w76 = "❌"  # String {0}
                Concatenate Strings(w76, "maximum temperatur of", " ", w75, "\r\n", "was reached") -> w21
              }
            }
          }
          frame "Electrical Compartment B10", "Magnetron Power Supply Temperature bottom", "Magnetron Power Supply Temperature top", "Magnetron Temperature bottom", "Magnetron Temperature top" {
            w77 = " Information not required for this device type"  # String {0}
            Concatenate Strings("[ℹ]", w77) -> w21
          }
        }
      }
    }
    call "Search and Replace Pattern.gvi"(String=w16, Muster="\"", Alle ersetzen=TRUE) -> (Ergebnis-String=w78)
    call "Trim Whitespace.gvi"(string=w78) -> (trimmed string=w79)
    call "Search and Replace Pattern.gvi"(String=w19, Muster="\"", Alle ersetzen=TRUE) -> (Ergebnis-String=w80)
    call "Trim Whitespace.gvi"(string=w80) -> (trimmed string=w81)
    String Length(string=w81) -> (length=w82)
    Is Greater(x=w82, y=10) -> w83
    case (w83) {
      frame False, Default {
        w84 = w81
      }
      frame True {
        String Subset(length (rest)=4, string=w81) -> w85
        String Subset(length (rest)=2, offset (0)=4, string=w81) -> w86
        String Subset(length (rest)=2, offset (0)=6, string=w81) -> w87
        String Subset(length (rest)=2, offset (0)=8, string=w81) -> w88
        String Subset(length (rest)=2, offset (0)=10, string=w81) -> w89
        String Subset(offset (0)=12, string=w81) -> w90
        Concatenate Strings(w85, ".", w86, ".", w87, " ", w88, ":", w89, ":", w90) -> w84
      }
    }
    call "Search and Replace Pattern.gvi"(String=w18, Muster="=\"", Alle ersetzen=TRUE) -> (Ergebnis-String=w91)
    call "Search and Replace Pattern.gvi"(String=w91, Muster="\"", Alle ersetzen=TRUE) -> (Ergebnis-String=w92)
    call "Trim Whitespace.gvi"(string=w92) -> (trimmed string=w93)
    call "Search and Replace Pattern.gvi"(String=w20, Muster="=\"", Alle ersetzen=TRUE) -> (Ergebnis-String=w94)
    call "Search and Replace Pattern.gvi"(String=w94, Muster="\"", Alle ersetzen=TRUE) -> (Ergebnis-String=w95)
    call "Trim Whitespace.gvi"(string=w95) -> (trimmed string=w96)
    Property Node(instance in=T2 {all zero or empty}, "Parameter Name"=w8, "Actual"=w13, "Dimension"=w79, "Limit"=w93, "maximum"=w96, "time_stamp"=w84, "comment"=w21) -> (instance out=w97)
    append w97 to w4
  }
  $Diagnostic_RT_Data_Sensors <- w4
  $"Output Error" <- w2
