vi "Interpret_Diagnostic_Water_iCS_Switch.gviweb"   [G Web Development Software 22.3.0]
inputs:
  "Error Cluster input": error
  "Diagnostic Water iCS Switch Entrys": string[]
  "Device Type": string = "Device"
outputs:
  "Diagnostic Water iCS Switch Output": T1[]
  "Output_Error": error
types:
  T1 = cluster{"Parameter Name": string, "Status": string, "Dimension": string, "Comment": string}
uses:
  NI::G Core::Strings::Search and Replace Pattern.gvi
  NI::G Core::Strings::Trim Whitespace.gvi
diagram:
  # 0: Fill
  # 0: Reference Volume Steam Generator
  s1 = 0  # shift register
  s2 = 0  # shift register
  for {
    w1 = each element of $"Diagnostic Water iCS Switch Entrys"
    # s2: Fill
    # s1: Norm
    Match Pattern(regular expression="Status=", string=w1) -> (after substring=w3, before substring=w4)
    call "Search and Replace Pattern.gvi"(String=w4, Muster="_", Ersetzungs-String=" ", Alle ersetzen=TRUE) -> (Ergebnis-String=w5)
    call "Trim Whitespace.gvi"(string=w5) -> (trimmed string=w6)
    Match Pattern(regular expression="dim=", string=w3) -> (after substring=w7, before substring=w8)
    call "Search and Replace Pattern.gvi"(String=w8, Muster="\"", Alle ersetzen=TRUE) -> (Ergebnis-String=w9)
    call "Trim Whitespace.gvi"(string=w9) -> (trimmed string=w10)
    case ($"Device Type") {
      frame "False", Default {
        w11 = $"Error Cluster input"
        w12 = "✅"
        w13 = s1
        w14 = s2
      }
      frame "623", "E523" {
        case (w6) {
          frame "False", Default {
            w11 = $"Error Cluster input"
            w12 = "✅"
            w13 = s1
            w14 = s2
          }
          frame "Active Pump", "Active RPM", "Gas blower Hot Air1 M8", "Gas blower Hot Air2 M10", "Gas blower Steam M9", "Gas valve Hot Air 1 Y12", "Gas valve Hot Air 2 Y13", "Gas valve Steam Y11", "Hot Air Bottom Heat Request", "Hot Air Top Flame Current", "Hot Air Top Heat Request", "Magnetron Cooling Fan bottom", "Magnetron Cooling Fan top", "Magnetron Safety Chain top", "Microwave Anode current bottom", "Microwave Anode current top", "Microwave Heating Voltage bottom", "Microwave Heating Voltage top", "Microwave High Voltage actual bottom", "Microwave High Voltage actual top", "Microwave Target bottom", "Microwave Target top", "Motor Floor M22", "Motor TableFloor M16", "Solenoid Valve Flush Y14", "Steam Flame Current", "Steam Heat Request" {
            w15 = " Information not required for this device type"  # String {0}
            Concatenate Strings("[ℹ]", w15) -> w12
            w11 = $"Error Cluster input"
            w13 = s1
            w14 = s2
          }
          frame "Reference Volume Steam Generator" {
            Floating Point String To Number(default (0 DBL)=0, string=w10, use system decimal point (T)=TRUE) -> (number=w13)
            Multiply(1.9, 1.1) -> w16
            Multiply(1.9, 0.9) -> w17
            In Range And Coerce(lower limit=w17, upper limit=w16, x=w13) -> (In Range?=w18)
            # E623_Volume_Steam_Generator_Norm = 1.9
            case (w18) {
              frame False, Default {
                w19 = "❌"  # String {0}
                Concatenate Strings(w19, " ", w6, " ", "is out of range !") -> w12
              }
              frame True {
                w12 = "✅"
              }
            }
            w11 = $"Error Cluster input"
            w14 = s2
          }
          frame "Actual Filling Volume Steam Generator" {
            Floating Point String To Number(default (0 DBL)=0, string=w10, use system decimal point (T)=TRUE) -> (number=w14)
            Multiply(s1, 0.2) -> w20
            Add(w20, s1) -> w21
            Subtract(x=s1, y=w20) -> w22
            In Range And Coerce(lower limit=w22, upper limit=w21, x=w14) -> (In Range?=w23)
            case (w23) {
              frame False, Default {
                w24 = "❌"  # String {0}
                Concatenate Strings(w24, " ", w6, " ", "doesn't fit to the norm level") -> w12
              }
              frame True {
                w12 = "✅"
              }
            }
            w11 = $"Error Cluster input"
            w13 = s1
          }
          frame "CalcCheck Volume Steam Generator" {
            Floating Point String To Number(default (0 DBL)=0, string=w10, use system decimal point (T)=TRUE) -> (number=w25)
            Is Greater(x=w25, y=s2) -> w26
            Divide(x=s2, y=w25) -> w27
            Is Less(x=w27, y=1.08) -> w28
            Logical Or(w28, w26) -> w29
            case (w29) {
              frame True {
                w30 = "❌"  # String {0}
                Concatenate Strings(w30, " ", "Too much calc in the steam generator!") -> w12
              }
              frame False {
                w12 = "✅"
              }
            }
            w11 = $"Error Cluster input"
            w13 = s1
            w14 = s2
          }
        }
      }
      frame "E61" {
        case (w6) {
          frame "False", Default {
            w11 = $"Error Cluster input"
            w12 = "✅"
            w13 = s1
            w14 = s2
          }
          frame "Ball Valve Motor M7", "Care Pump XS M18", "CleanJet Pump XS M6", "Gas blower Hot Air1 M8", "Gas blower Hot Air2 M10", "Gas blower Steam M9", "Gas valve Hot Air 1 Y12", "Gas valve Hot Air 2 Y13", "Gas valve Steam Y11", "Hot Air Bottom Heat Request", "Hot Air Top Flame Current", "Hot Air Top Heat Request", "Magnetron Cooling Fan bottom", "Magnetron Cooling Fan top", "Magnetron Safety Chain bottom", "Magnetron Safety Chain top", "Microwave Anode current bottom", "Microwave Anode current top", "Microwave Heating Voltage bottom", "Microwave Heating Voltage top", "Microwave High Voltage actual bottom", "Microwave High Voltage actual top", "Microwave Target bottom", "Microwave Target top", "Motor Floor M22", "Motor TableFloor M16", "SC Pump XS M4", "Steam Flame Current", "Steam Heat Request" {
            w31 = " Information not required for this device type"  # String {0}
            Concatenate Strings("[ℹ]", w31) -> w12
            w11 = $"Error Cluster input"
            w13 = s1
            w14 = s2
          }
          frame "Reference Volume Steam Generator" {
            Floating Point String To Number(default (0 DBL)=0, string=w10, use system decimal point (T)=TRUE) -> (number=w13)
            Multiply(3.9, 1.1) -> w32
            Multiply(3.9, 0.9) -> w33
            In Range And Coerce(lower limit=w33, upper limit=w32, x=w13) -> (In Range?=w34)
            # E61_Volume_Steam_Generator_Norm = 3.9
            case (w34) {
              frame False, Default {
                w35 = "❌"  # String {0}
                Concatenate Strings(w35, " ", w6, " ", "is out of range !") -> w12
              }
              frame True {
                w12 = "✅"
              }
            }
            w11 = $"Error Cluster input"
            w14 = s2
          }
          frame "Actual Filling Volume Steam Generator" {
            Floating Point String To Number(default (0 DBL)=0, string=w10, use system decimal point (T)=TRUE) -> (number=w14)
            Multiply(s1, 0.2) -> w36
            Add(w36, s1) -> w37
            Subtract(x=s1, y=w36) -> w38
            In Range And Coerce(lower limit=w38, upper limit=w37, x=w14) -> (In Range?=w39)
            case (w39) {
              frame False, Default {
                w40 = "❌"  # String {0}
                Concatenate Strings(w40, " ", w6, " ", "doesn't fit to the norm level") -> w12
              }
              frame True {
                w12 = "✅"
              }
            }
            w11 = $"Error Cluster input"
            w13 = s1
          }
          frame "CalcCheck Volume Steam Generator" {
            Floating Point String To Number(default (0 DBL)=0, string=w10, use system decimal point (T)=TRUE) -> (number=w41)
            Is Greater(x=w41, y=s2) -> w42
            Divide(x=s2, y=w41) -> w43
            Is Less(x=w43, y=1.08) -> w44
            Logical Or(w44, w42) -> w45
            case (w45) {
              frame True {
                w46 = "❌"  # String {0}
                Concatenate Strings(w46, " ", "Too much calc in the steam generator!") -> w12
              }
              frame False {
                w12 = "✅"
              }
            }
            w11 = $"Error Cluster input"
            w13 = s1
            w14 = s2
          }
        }
      }
      frame "E62" {
        case (w6) {
          frame "False", Default {
            w11 = $"Error Cluster input"
            w12 = "✅"
            w13 = s1
            w14 = s2
          }
          frame "Ball Valve Motor M7", "Care Pump XS M18", "CleanJet Pump XS M6", "Gas blower Hot Air1 M8", "Gas blower Hot Air2 M10", "Gas blower Steam M9", "Gas valve Hot Air 1 Y12", "Gas valve Hot Air 2 Y13", "Gas valve Steam Y11", "Hot Air Bottom Heat Request", "Hot Air Top Flame Current", "Hot Air Top Heat Request", "Magnetron Cooling Fan bottom", "Magnetron Cooling Fan top", "Magnetron Safety Chain bottom", "Magnetron Safety Chain top", "Microwave Anode current bottom", "Microwave Anode current top", "Microwave Heating Voltage bottom", "Microwave Heating Voltage top", "Microwave High Voltage actual bottom", "Microwave High Voltage actual top", "Microwave Target bottom", "Microwave Target top", "Motor Floor M22", "Motor TableFloor M16", "SC Pump XS M4", "Steam Flame Current", "Steam Heat Request" {
            w47 = " Information not required for this device type"  # String {0}
            Concatenate Strings("[ℹ]", w47) -> w12
            w11 = $"Error Cluster input"
            w13 = s1
            w14 = s2
          }
          frame "Reference Volume Steam Generator" {
            Floating Point String To Number(default (0 DBL)=0, string=w10, use system decimal point (T)=TRUE) -> (number=w13)
            Multiply(7.5, 1.1) -> w48
            Multiply(7.5, 0.9) -> w49
            In Range And Coerce(lower limit=w49, upper limit=w48, x=w13) -> (In Range?=w50)
            # E62_Volume_Steam_Generator_Norm = 7.5
            case (w50) {
              frame False, Default {
                w51 = "❌"  # String {0}
                Concatenate Strings(w51, " ", w6, " ", "is out of range !") -> w12
              }
              frame True {
                w12 = "✅"
              }
            }
            w11 = $"Error Cluster input"
            w14 = s2
          }
          frame "Actual Filling Volume Steam Generator" {
            Floating Point String To Number(default (0 DBL)=0, string=w10, use system decimal point (T)=TRUE) -> (number=w14)
            Multiply(s1, 0.2) -> w52
            Add(w52, s1) -> w53
            Subtract(x=s1, y=w52) -> w54
            In Range And Coerce(lower limit=w54, upper limit=w53, x=w14) -> (In Range?=w55)
            case (w55) {
              frame False, Default {
                w56 = "❌"  # String {0}
                Concatenate Strings(w56, " ", w6, " ", "doesn't fit to the norm level") -> w12
              }
              frame True {
                w12 = "✅"
              }
            }
            w11 = $"Error Cluster input"
            w13 = s1
          }
          frame "CalcCheck Volume Steam Generator" {
            Floating Point String To Number(default (0 DBL)=0, string=w10, use system decimal point (T)=TRUE) -> (number=w57)
            Is Greater(x=w57, y=s2) -> w58
            Divide(x=s2, y=w57) -> w59
            Is Less(x=w59, y=1.08) -> w60
            Logical Or(w60, w58) -> w61
            case (w61) {
              frame True {
                w62 = "❌"  # String {0}
                Concatenate Strings(w62, " ", "Too much calc in the steam generator!") -> w12
              }
              frame False {
                w12 = "✅"
              }
            }
            w11 = $"Error Cluster input"
            w13 = s1
            w14 = s2
          }
        }
      }
      frame "E61T" {
        case (w6) {
          frame "False", Default {
            w11 = $"Error Cluster input"
            w12 = "✅"
            w13 = s1
            w14 = s2
          }
          frame "Ball Valve Motor M7", "Care Pump XS M18", "CleanJet Pump XS M6", "Gas blower Hot Air1 M8", "Gas blower Hot Air2 M10", "Gas blower Steam M9", "Gas valve Hot Air 1 Y12", "Gas valve Hot Air 2 Y13", "Gas valve Steam Y11", "Hot Air Bottom Heat Request", "Hot Air Top Flame Current", "Hot Air Top Heat Request", "Magnetron Cooling Fan bottom", "Magnetron Cooling Fan top", "Magnetron Safety Chain bottom", "Magnetron Safety Chain top", "Microwave Anode current bottom", "Microwave Anode current top", "Microwave Heating Voltage bottom", "Microwave Heating Voltage top", "Microwave High Voltage actual bottom", "Microwave High Voltage actual top", "Microwave Target bottom", "Microwave Target top", "Motor Floor M22", "Motor TableFloor M16", "SC Pump XS M4", "Steam Flame Current", "Steam Heat Request" {
            w63 = " Information not required for this device type"  # String {0}
            Concatenate Strings("[ℹ]", w63) -> w12
            w11 = $"Error Cluster input"
            w13 = s1
            w14 = s2
          }
          frame "Reference Volume Steam Generator" {
            Floating Point String To Number(default (0 DBL)=0, string=w10, use system decimal point (T)=TRUE) -> (number=w13)
            Multiply(3.9, 1.1) -> w64
            Multiply(3.9, 0.9) -> w65
            In Range And Coerce(lower limit=w65, upper limit=w64, x=w13) -> (In Range?=w66)
            # E61_Volume_Steam_Generator_Norm = 3.9
            case (w66) {
              frame False, Default {
                w67 = "❌"  # String {0}
                Concatenate Strings(w67, " ", w6, " ", "is out of range !") -> w12
              }
              frame True {
                w12 = "✅"
              }
            }
            w11 = $"Error Cluster input"
            w14 = s2
          }
          frame "Actual Filling Volume Steam Generator" {
            Floating Point String To Number(default (0 DBL)=0, string=w10, use system decimal point (T)=TRUE) -> (number=w14)
            Multiply(s1, 0.2) -> w68
            Add(w68, s1) -> w69
            Subtract(x=s1, y=w68) -> w70
            In Range And Coerce(lower limit=w70, upper limit=w69, x=w14) -> (In Range?=w71)
            case (w71) {
              frame False, Default {
                w72 = "❌"  # String {0}
                Concatenate Strings(w72, " ", w6, " ", "doesn't fit to the norm level") -> w12
              }
              frame True {
                w12 = "✅"
              }
            }
            w11 = $"Error Cluster input"
            w13 = s1
          }
          frame "CalcCheck Volume Steam Generator" {
            Floating Point String To Number(default (0 DBL)=0, string=w10, use system decimal point (T)=TRUE) -> (number=w73)
            Is Greater(x=w73, y=s2) -> w74
            Divide(x=s2, y=w73) -> w75
            Is Less(x=w75, y=1.08) -> w76
            Logical Or(w76, w74) -> w77
            case (w77) {
              frame True {
                w78 = "❌"  # String {0}
                Concatenate Strings(w78, " ", "Too much calc in the steam generator!") -> w12
              }
              frame False {
                w12 = "✅"
              }
            }
            w11 = $"Error Cluster input"
            w13 = s1
            w14 = s2
          }
        }
      }
      frame "G61" {
        case (w6) {
          frame "False", Default {
            w11 = $"Error Cluster input"
            w12 = "✅"
            w13 = s1
            w14 = s2
          }
          frame "Reference Volume Steam Generator" {
            Floating Point String To Number(default (0 DBL)=0, string=w10, use system decimal point (T)=TRUE) -> (number=w13)
            Multiply(4.5, 1.1) -> w79
            Multiply(4.5, 0.9) -> w80
            In Range And Coerce(lower limit=w80, upper limit=w79, x=w13) -> (In Range?=w81)
            # G61_Volume_Steam_Generator_Norm = 4.5
            case (w81) {
              frame False, Default {
                w82 = "❌"  # String {0}
                Concatenate Strings(w82, " ", w6, " ", "is out of range !") -> w12
              }
              frame True {
                w12 = "✅"
              }
            }
            w11 = $"Error Cluster input"
            w14 = s2
          }
          frame "Actual Filling Volume Steam Generator" {
            Floating Point String To Number(default (0 DBL)=0, string=w10, use system decimal point (T)=TRUE) -> (number=w14)
            Multiply(s1, 0.2) -> w83
            Add(w83, s1) -> w84
            Subtract(x=s1, y=w83) -> w85
            In Range And Coerce(lower limit=w85, upper limit=w84, x=w14) -> (In Range?=w86)
            case (w86) {
              frame False, Default {
                w87 = "❌"  # String {0}
                Concatenate Strings(w87, " ", w6, " ", "doesn't fit to the norm level") -> w12
              }
              frame True {
                w12 = "✅"
              }
            }
            w11 = $"Error Cluster input"
            w13 = s1
          }
          frame "CalcCheck Volume Steam Generator" {
            Floating Point String To Number(default (0 DBL)=0, string=w10, use system decimal point (T)=TRUE) -> (number=w88)
            Is Greater(x=w88, y=s2) -> w89
            Divide(x=s2, y=w88) -> w90
            Is Less(x=w90, y=1.08) -> w91
            Logical Or(w91, w89) -> w92
            case (w92) {
              frame True {
                w93 = "❌"  # String {0}
                Concatenate Strings(w93, " ", "Too much calc in the steam generator!") -> w12
              }
              frame False {
                w12 = "✅"
              }
            }
            w11 = $"Error Cluster input"
            w13 = s1
            w14 = s2
          }
          frame "Ball Valve Motor M7", "Care Pump XS M18", "CleanJet Pump XS M6", "Gas blower Hot Air2 M10", "Gas valve Hot Air 2 Y13", "Hot Air Bottom Flame Current", "Hot Air Bottom Heat Request", "Magnetron Cooling Fan bottom", "Magnetron Cooling Fan top", "Magnetron Safety Chain bottom", "Magnetron Safety Chain top", "Microwave Anode current bottom", "Microwave Anode current top", "Microwave Heating Voltage bottom", "Microwave Heating Voltage top", "Microwave High Voltage actual bottom", "Microwave High Voltage actual top", "Microwave Target bottom", "Microwave Target top", "Motor Floor M22", "Motor TableFloor M16", "SC Pump XS M4", "Steam Flame Current", "Steam Heat Request" {
            w94 = " Information not required for this device type"  # String {0}
            Concatenate Strings("[ℹ]", w94) -> w12
            w11 = $"Error Cluster input"
            w13 = s1
            w14 = s2
          }
        }
      }
      frame "G62" {
        case (w6) {
          frame "False", Default {
            w11 = $"Error Cluster input"
            w12 = "✅"
            w13 = s1
            w14 = s2
          }
          frame "Reference Volume Steam Generator" {
            Floating Point String To Number(default (0 DBL)=0, string=w10, use system decimal point (T)=TRUE) -> (number=w13)
            Multiply(7.6, 1.1) -> w95
            Multiply(7.6, 0.9) -> w96
            In Range And Coerce(lower limit=w96, upper limit=w95, x=w13) -> (In Range?=w97)
            # G62_Volume_Steam_Generator_Norm = 7.6
            case (w97) {
              frame False, Default {
                w98 = "❌"  # String {0}
                Concatenate Strings(w98, " ", w6, " ", "is out of range !") -> w12
              }
              frame True {
                w12 = "✅"
              }
            }
            w11 = $"Error Cluster input"
            w14 = s2
          }
          frame "Actual Filling Volume Steam Generator" {
            Floating Point String To Number(default (0 DBL)=0, string=w10, use system decimal point (T)=TRUE) -> (number=w14)
            Multiply(s1, 0.2) -> w99
            Add(w99, s1) -> w100
            Subtract(x=s1, y=w99) -> w101
            In Range And Coerce(lower limit=w101, upper limit=w100, x=w14) -> (In Range?=w102)
            case (w102) {
              frame False, Default {
                w103 = "❌"  # String {0}
                Concatenate Strings(w103, " ", w6, " ", "doesn't fit to the norm level") -> w12
              }
              frame True {
                w12 = "✅"
              }
            }
            w11 = $"Error Cluster input"
            w13 = s1
          }
          frame "CalcCheck Volume Steam Generator" {
            Floating Point String To Number(default (0 DBL)=0, string=w10, use system decimal point (T)=TRUE) -> (number=w104)
            Is Greater(x=w104, y=s2) -> w105
            Divide(x=s2, y=w104) -> w106
            Is Less(x=w106, y=1.08) -> w107
            Logical Or(w107, w105) -> w108
            case (w108) {
              frame True {
                w109 = "❌"  # String {0}
                Concatenate Strings(w109, " ", "Too much calc in the steam generator!") -> w12
              }
              frame False {
                w12 = "✅"
              }
            }
            w11 = $"Error Cluster input"
            w13 = s1
            w14 = s2
          }
          frame "Ball Valve Motor M7", "Care Pump XS M18", "CleanJet Pump XS M6", "Gas blower Hot Air2 M10", "Gas valve Hot Air 2 Y13", "Hot Air Bottom Flame Current", "Hot Air Bottom Heat Request", "Magnetron Cooling Fan bottom", "Magnetron Cooling Fan top", "Magnetron Safety Chain bottom", "Magnetron Safety Chain top", "Microwave Anode current bottom", "Microwave Anode current top", "Microwave Heating Voltage bottom", "Microwave Heating Voltage top", "Microwave High Voltage actual bottom", "Microwave High Voltage actual top", "Microwave Target bottom", "Microwave Target top", "Motor Floor M22", "Motor TableFloor M16", "SC Pump XS M4", "Steam Flame Current", "Steam Heat Request" {
            w110 = " Information not required for this device type"  # String {0}
            Concatenate Strings("[ℹ]", w110) -> w12
            w11 = $"Error Cluster input"
            w13 = s1
            w14 = s2
          }
        }
      }
      frame "E101" {
        case (w6) {
          frame "False", Default {
            w11 = $"Error Cluster input"
            w12 = "✅"
            w13 = s1
            w14 = s2
          }
          frame "Ball Valve Motor M7", "Care Pump XS M18", "CleanJet Pump XS M6", "Gas blower Hot Air1 M8", "Gas blower Hot Air2 M10", "Gas blower Steam M9", "Gas valve Hot Air 1 Y12", "Gas valve Hot Air 2 Y13", "Gas valve Steam Y11", "Hot Air Bottom Flame Current", "Hot Air Bottom Heat Request", "Hot Air Top Flame Current", "Hot Air Top Heat Request", "Magnetron Cooling Fan bottom", "Magnetron Cooling Fan top", "Magnetron Safety Chain bottom", "Magnetron Safety Chain top", "Microwave Anode current bottom", "Microwave Anode current top", "Microwave Heating Voltage bottom", "Microwave Heating Voltage top", "Microwave High Voltage actual bottom", "Microwave High Voltage actual top", "Microwave Target bottom", "Microwave Target top", "Motor Floor M22", "SC Pump XS M4", "Steam Flame Current", "Steam Heat Request" {
            w111 = " Information not required for this device type"  # String {0}
            Concatenate Strings("[ℹ]", w111) -> w12
            w11 = $"Error Cluster input"
            w13 = s1
            w14 = s2
          }
          frame "Reference Volume Steam Generator" {
            Floating Point String To Number(default (0 DBL)=0, string=w10, use system decimal point (T)=TRUE) -> (number=w13)
            Multiply(3.8, 1.1) -> w112
            Multiply(3.8, 0.9) -> w113
            In Range And Coerce(lower limit=w113, upper limit=w112, x=w13) -> (In Range?=w114)
            # E101_Volume_Steam_Generator_Norm = 3.8
            case (w114) {
              frame False, Default {
                w115 = "❌"  # String {0}
                Concatenate Strings(w115, " ", w6, " ", "is out of range !") -> w12
              }
              frame True {
                w12 = "✅"
              }
            }
            w11 = $"Error Cluster input"
            w14 = s2
          }
          frame "Actual Filling Volume Steam Generator" {
            Floating Point String To Number(default (0 DBL)=0, string=w10, use system decimal point (T)=TRUE) -> (number=w14)
            Multiply(s1, 0.2) -> w116
            Add(w116, s1) -> w117
            Subtract(x=s1, y=w116) -> w118
            In Range And Coerce(lower limit=w118, upper limit=w117, x=w14) -> (In Range?=w119)
            case (w119) {
              frame False, Default {
                w120 = "❌"  # String {0}
                Concatenate Strings(w120, " ", w6, " ", "doesn't fit to the norm level") -> w12
              }
              frame True {
                w12 = "✅"
              }
            }
            w11 = $"Error Cluster input"
            w13 = s1
          }
          frame "CalcCheck Volume Steam Generator" {
            Floating Point String To Number(default (0 DBL)=0, string=w10, use system decimal point (T)=TRUE) -> (number=w121)
            Is Greater(x=w121, y=s2) -> w122
            Divide(x=s2, y=w121) -> w123
            Is Less(x=w123, y=1.08) -> w124
            Logical Or(w124, w122) -> w125
            case (w125) {
              frame True {
                w126 = "❌"  # String {0}
                Concatenate Strings(w126, " ", "Too much calc in the steam generator!") -> w12
              }
              frame False {
                w12 = "✅"
              }
            }
            w11 = $"Error Cluster input"
            w13 = s1
            w14 = s2
          }
        }
      }
      frame "E102" {
        case (w6) {
          frame "False", Default {
            w11 = $"Error Cluster input"
            w12 = "✅"
            w13 = s1
            w14 = s2
          }
          frame "Ball Valve Motor M7", "Care Pump XS M18", "CleanJet Pump XS M6", "Gas blower Hot Air1 M8", "Gas blower Hot Air2 M10", "Gas blower Steam M9", "Gas valve Hot Air 1 Y12", "Gas valve Hot Air 2 Y13", "Gas valve Steam Y11", "Hot Air Bottom Flame Current", "Hot Air Bottom Heat Request", "Hot Air Top Flame Current", "Hot Air Top Heat Request", "Magnetron Cooling Fan bottom", "Magnetron Cooling Fan top", "Magnetron Safety Chain bottom", "Magnetron Safety Chain top", "Microwave Anode current bottom", "Microwave Anode current top", "Microwave Heating Voltage bottom", "Microwave Heating Voltage top", "Microwave High Voltage actual bottom", "Microwave High Voltage actual top", "Microwave Target bottom", "Microwave Target top", "Motor Floor M22", "SC Pump XS M4", "Steam Flame Current", "Steam Heat Request" {
            w127 = " Information not required for this device type"  # String {0}
            Concatenate Strings("[ℹ]", w127) -> w12
            w11 = $"Error Cluster input"
            w13 = s1
            w14 = s2
          }
          frame "Reference Volume Steam Generator" {
            Floating Point String To Number(default (0 DBL)=0, string=w10, use system decimal point (T)=TRUE) -> (number=w13)
            Multiply(9.5, 1.1) -> w128
            Multiply(9.5, 0.9) -> w129
            In Range And Coerce(lower limit=w129, upper limit=w128, x=w13) -> (In Range?=w130)
            # E102_Volume_Steam_Generator_Norm = 9.5
            case (w130) {
              frame False, Default {
                w131 = "❌"  # String {0}
                Concatenate Strings(w131, " ", w6, " ", "is out of range !") -> w12
              }
              frame True {
                w12 = "✅"
              }
            }
            w11 = $"Error Cluster input"
            w14 = s2
          }
          frame "Actual Filling Volume Steam Generator" {
            Floating Point String To Number(default (0 DBL)=0, string=w10, use system decimal point (T)=TRUE) -> (number=w14)
            Multiply(s1, 0.2) -> w132
            Add(w132, s1) -> w133
            Subtract(x=s1, y=w132) -> w134
            In Range And Coerce(lower limit=w134, upper limit=w133, x=w14) -> (In Range?=w135)
            case (w135) {
              frame False, Default {
                w136 = "❌"  # String {0}
                Concatenate Strings(w136, " ", w6, " ", "doesn't fit to the norm level") -> w12
              }
              frame True {
                w12 = "✅"
              }
            }
            w11 = $"Error Cluster input"
            w13 = s1
          }
          frame "CalcCheck Volume Steam Generator" {
            Floating Point String To Number(default (0 DBL)=0, string=w10, use system decimal point (T)=TRUE) -> (number=w137)
            Is Greater(x=w137, y=s2) -> w138
            Divide(x=s2, y=w137) -> w139
            Is Less(x=w139, y=1.08) -> w140
            Logical Or(w140, w138) -> w141
            case (w141) {
              frame True {
                w142 = "❌"  # String {0}
                Concatenate Strings(w142, " ", "Too much calc in the steam generator!") -> w12
              }
              frame False {
                w12 = "✅"
              }
            }
            w11 = $"Error Cluster input"
            w13 = s1
            w14 = s2
          }
        }
      }
      frame "G101" {
        case (w6) {
          frame "False", Default {
            w11 = $"Error Cluster input"
            w12 = "✅"
            w13 = s1
            w14 = s2
          }
          frame "Ball Valve Motor M7", "Care Pump XS M18", "CleanJet Pump XS M6", "Gas blower Hot Air2 M10", "Gas valve Hot Air 2 Y13", "Hot Air Bottom Flame Current", "Hot Air Bottom Heat Request", "Magnetron Cooling Fan bottom", "Magnetron Cooling Fan top", "Magnetron Safety Chain bottom", "Magnetron Safety Chain top", "Microwave Anode current bottom", "Microwave Anode current top", "Microwave Heating Voltage bottom", "Microwave Heating Voltage top", "Microwave High Voltage actual bottom", "Microwave High Voltage actual top", "Microwave Target bottom", "Microwave Target top", "Motor Floor M22", "SC Pump XS M4" {
            w143 = " Information not required for this device type"  # String {0}
            Concatenate Strings("[ℹ]", w143) -> w12
            w11 = $"Error Cluster input"
            w13 = s1
            w14 = s2
          }
          frame "Reference Volume Steam Generator" {
            Floating Point String To Number(default (0 DBL)=0, string=w10, use system decimal point (T)=TRUE) -> (number=w13)
            Multiply(8.4, 1.1) -> w144
            Multiply(8.4, 0.9) -> w145
            In Range And Coerce(lower limit=w145, upper limit=w144, x=w13) -> (In Range?=w146)
            # G101_Volume_Steam_Generator_Norm = 8.4
            case (w146) {
              frame False, Default {
                w147 = "❌"  # String {0}
                Concatenate Strings(w147, " ", w6, " ", "is out of range !") -> w12
              }
              frame True {
                w12 = "✅"
              }
            }
            w11 = $"Error Cluster input"
            w14 = s2
          }
          frame "Actual Filling Volume Steam Generator" {
            Floating Point String To Number(default (0 DBL)=0, string=w10, use system decimal point (T)=TRUE) -> (number=w14)
            Multiply(s1, 0.2) -> w148
            Add(w148, s1) -> w149
            Subtract(x=s1, y=w148) -> w150
            In Range And Coerce(lower limit=w150, upper limit=w149, x=w14) -> (In Range?=w151)
            case (w151) {
              frame False, Default {
                w152 = "❌"  # String {0}
                Concatenate Strings(w152, " ", w6, " ", "doesn't fit to the norm level") -> w12
              }
              frame True {
                w12 = "✅"
              }
            }
            w11 = $"Error Cluster input"
            w13 = s1
          }
          frame "CalcCheck Volume Steam Generator" {
            Floating Point String To Number(default (0 DBL)=0, string=w10, use system decimal point (T)=TRUE) -> (number=w153)
            Is Greater(x=w153, y=s2) -> w154
            Divide(x=s2, y=w153) -> w155
            Is Less(x=w155, y=1.08) -> w156
            Logical Or(w156, w154) -> w157
            case (w157) {
              frame True {
                w158 = "❌"  # String {0}
                Concatenate Strings(w158, " ", "Too much calc in the steam generator!") -> w12
              }
              frame False {
                w12 = "✅"
              }
            }
            w11 = $"Error Cluster input"
            w13 = s1
            w14 = s2
          }
        }
      }
      frame "G102" {
        case (w6) {
          frame "False", Default {
            w11 = $"Error Cluster input"
            w12 = "✅"
            w13 = s1
            w14 = s2
          }
          frame "Ball Valve Motor M7", "Care Pump XS M18", "CleanJet Pump XS M6", "Gas blower Hot Air2 M10", "Gas valve Hot Air 2 Y13", "Hot Air Bottom Flame Current", "Hot Air Bottom Heat Request", "Magnetron Cooling Fan bottom", "Magnetron Cooling Fan top", "Magnetron Safety Chain bottom", "Magnetron Safety Chain top", "Microwave Anode current bottom", "Microwave Anode current top", "Microwave Heating Voltage bottom", "Microwave Heating Voltage top", "Microwave High Voltage actual bottom", "Microwave High Voltage actual top", "Microwave Target bottom", "Microwave Target top", "Motor Floor M22", "SC Pump XS M4" {
            w159 = " Information not required for this device type"  # String {0}
            Concatenate Strings("[ℹ]", w159) -> w12
            w11 = $"Error Cluster input"
            w13 = s1
            w14 = s2
          }
          frame "Reference Volume Steam Generator" {
            # G102_Volume_Steam_Generator_Norm = 11.2
            Floating Point String To Number(default (0 DBL)=0, string=w10, use system decimal point (T)=TRUE) -> (number=w13)
            Multiply(8.4, 1.1) -> w160
            Multiply(8.4, 0.9) -> w161
            In Range And Coerce(lower limit=w161, upper limit=w160, x=w13) -> (In Range?=w162)
            case (w162) {
              frame False, Default {
                w163 = "❌"  # String {0}
                Concatenate Strings(w163, " ", w6, " ", "is out of range !") -> w12
              }
              frame True {
                w12 = "✅"
              }
            }
            w11 = $"Error Cluster input"
            w14 = s2
          }
          frame "Actual Filling Volume Steam Generator" {
            Floating Point String To Number(default (0 DBL)=0, string=w10, use system decimal point (T)=TRUE) -> (number=w14)
            Multiply(s1, 0.2) -> w164
            Add(w164, s1) -> w165
            Subtract(x=s1, y=w164) -> w166
            In Range And Coerce(lower limit=w166, upper limit=w165, x=w14) -> (In Range?=w167)
            case (w167) {
              frame False, Default {
                w168 = "❌"  # String {0}
                Concatenate Strings(w168, " ", w6, " ", "doesn't fit to the norm level") -> w12
              }
              frame True {
                w12 = "✅"
              }
            }
            w11 = $"Error Cluster input"
            w13 = s1
          }
          frame "CalcCheck Volume Steam Generator" {
            Floating Point String To Number(default (0 DBL)=0, string=w10, use system decimal point (T)=TRUE) -> (number=w169)
            Is Greater(x=w169, y=s2) -> w170
            Divide(x=s2, y=w169) -> w171
            Is Less(x=w171, y=1.08) -> w172
            Logical Or(w172, w170) -> w173
            case (w173) {
              frame True {
                w174 = "❌"  # String {0}
                Concatenate Strings(w174, " ", "Too much calc in the steam generator!") -> w12
              }
              frame False {
                w12 = "✅"
              }
            }
            w11 = $"Error Cluster input"
            w13 = s1
            w14 = s2
          }
        }
      }
      frame "E201" {
        case (w6) {
          frame "False", Default {
            w11 = $"Error Cluster input"
            w12 = "✅"
            w13 = s1
            w14 = s2
          }
          frame "Ball Valve Motor M7", "Care Pump XS M18", "CleanJet Pump XS M6", "Gas blower Hot Air1 M8", "Gas blower Hot Air2 M10", "Gas blower Steam M9", "Gas valve Hot Air 1 Y12", "Gas valve Hot Air 2 Y13", "Gas valve Steam Y11", "Hot Air Bottom Flame Current", "Hot Air Bottom Heat Request", "Hot Air Top Flame Current", "Hot Air Top Heat Request", "Magnetron Cooling Fan bottom", "Magnetron Cooling Fan top", "Magnetron Safety Chain bottom", "Magnetron Safety Chain top", "Microwave Anode current bottom", "Microwave Anode current top", "Microwave Heating Voltage bottom", "Microwave Heating Voltage top", "Microwave High Voltage actual bottom", "Microwave High Voltage actual top", "Microwave Target bottom", "Microwave Target top", "SC Pump XS M4", "Steam Flame Current", "Steam Heat Request" {
            w175 = " Information not required for this device type"  # String {0}
            Concatenate Strings("[ℹ]", w175) -> w12
            w11 = $"Error Cluster input"
            w13 = s1
            w14 = s2
          }
          frame "Reference Volume Steam Generator" {
            Floating Point String To Number(default (0 DBL)=0, string=w10, use system decimal point (T)=TRUE) -> (number=w13)
            Multiply(9.3, 1.1) -> w176
            Multiply(9.3, 0.9) -> w177
            In Range And Coerce(lower limit=w177, upper limit=w176, x=w13) -> (In Range?=w178)
            # E201_Volume_Steam_Generator_Norm = 9.3
            case (w178) {
              frame False, Default {
                w179 = "❌"  # String {0}
                Concatenate Strings(w179, " ", w6, " ", "is out of range !") -> w12
              }
              frame True {
                w12 = "✅"
              }
            }
            w11 = $"Error Cluster input"
            w14 = s2
          }
          frame "Actual Filling Volume Steam Generator" {
            Floating Point String To Number(default (0 DBL)=0, string=w10, use system decimal point (T)=TRUE) -> (number=w14)
            Multiply(s1, 0.2) -> w180
            Add(w180, s1) -> w181
            Subtract(x=s1, y=w180) -> w182
            In Range And Coerce(lower limit=w182, upper limit=w181, x=w14) -> (In Range?=w183)
            case (w183) {
              frame False, Default {
                w184 = "❌"  # String {0}
                Concatenate Strings(w184, " ", w6, " ", "doesn't fit to the norm level") -> w12
              }
              frame True {
                w12 = "✅"
              }
            }
            w11 = $"Error Cluster input"
            w13 = s1
          }
          frame "CalcCheck Volume Steam Generator" {
            Floating Point String To Number(default (0 DBL)=0, string=w10, use system decimal point (T)=TRUE) -> (number=w185)
            Is Greater(x=w185, y=s2) -> w186
            Divide(x=s2, y=w185) -> w187
            Is Less(x=w187, y=1.08) -> w188
            Logical Or(w188, w186) -> w189
            case (w189) {
              frame True {
                w190 = "❌"  # String {0}
                Concatenate Strings(w190, " ", "Too much calc in the steam generator!") -> w12
              }
              frame False {
                w12 = "✅"
              }
            }
            w11 = $"Error Cluster input"
            w13 = s1
            w14 = s2
          }
        }
      }
      frame "E202" {
        case (w6) {
          frame "False", Default {
            w11 = $"Error Cluster input"
            w12 = "✅"
            w13 = s1
            w14 = s2
          }
          frame "Ball Valve Motor M7", "Care Pump XS M18", "CleanJet Pump XS M6", "Gas blower Hot Air1 M8", "Gas blower Hot Air2 M10", "Gas blower Steam M9", "Gas valve Hot Air 1 Y12", "Gas valve Hot Air 2 Y13", "Gas valve Steam Y11", "Hot Air Bottom Flame Current", "Hot Air Bottom Heat Request", "Hot Air Top Flame Current", "Hot Air Top Heat Request", "Magnetron Cooling Fan bottom", "Magnetron Cooling Fan top", "Magnetron Safety Chain bottom", "Magnetron Safety Chain top", "Microwave Anode current bottom", "Microwave Anode current top", "Microwave Heating Voltage bottom", "Microwave Heating Voltage top", "Microwave High Voltage actual bottom", "Microwave High Voltage actual top", "Microwave Target bottom", "Microwave Target top", "SC Pump XS M4", "Steam Flame Current", "Steam Heat Request" {
            w191 = " Information not required for this device type"  # String {0}
            Concatenate Strings("[ℹ]", w191) -> w12
            w11 = $"Error Cluster input"
            w13 = s1
            w14 = s2
          }
          frame "Reference Volume Steam Generator" {
            Floating Point String To Number(default (0 DBL)=0, string=w10, use system decimal point (T)=TRUE) -> (number=w13)
            Multiply(13.4, 1.1) -> w192
            Multiply(13.4, 0.9) -> w193
            In Range And Coerce(lower limit=w193, upper limit=w192, x=w13) -> (In Range?=w194)
            # E202_Volume_Steam_Generator_Norm = 13.4
            case (w194) {
              frame False, Default {
                w195 = "❌"  # String {0}
                Concatenate Strings(w195, " ", w6, " ", "is out of range !") -> w12
              }
              frame True {
                w12 = "✅"
              }
            }
            w11 = $"Error Cluster input"
            w14 = s2
          }
          frame "Actual Filling Volume Steam Generator" {
            Floating Point String To Number(default (0 DBL)=0, string=w10, use system decimal point (T)=TRUE) -> (number=w14)
            Multiply(s1, 0.2) -> w196
            Add(w196, s1) -> w197
            Subtract(x=s1, y=w196) -> w198
            In Range And Coerce(lower limit=w198, upper limit=w197, x=w14) -> (In Range?=w199)
            case (w199) {
              frame False, Default {
                w200 = "❌"  # String {0}
                Concatenate Strings(w200, " ", w6, " ", "doesn't fit to the norm level") -> w12
              }
              frame True {
                w12 = "✅"
              }
            }
            w11 = $"Error Cluster input"
            w13 = s1
          }
          frame "CalcCheck Volume Steam Generator" {
            Floating Point String To Number(default (0 DBL)=0, string=w10, use system decimal point (T)=TRUE) -> (number=w201)
            Is Greater(x=w201, y=s2) -> w202
            Divide(x=s2, y=w201) -> w203
            Is Less(x=w203, y=1.08) -> w204
            Logical Or(w204, w202) -> w205
            case (w205) {
              frame True {
                w206 = "❌"  # String {0}
                Concatenate Strings(w206, " ", "Too much calc in the steam generator!") -> w12
              }
              frame False {
                w12 = "✅"
              }
            }
            w11 = $"Error Cluster input"
            w13 = s1
            w14 = s2
          }
        }
      }
      frame "G201" {
        case (w6) {
          frame "False", Default {
            w11 = $"Error Cluster input"
            w12 = "✅"
            w13 = s1
            w14 = s2
          }
          frame "Ball Valve Motor M7", "Care Pump XS M18", "CleanJet Pump XS M6", "Magnetron Cooling Fan bottom", "Magnetron Cooling Fan top", "Magnetron Safety Chain bottom", "Magnetron Safety Chain top", "Microwave Anode current bottom", "Microwave Anode current top", "Microwave Heating Voltage bottom", "Microwave Heating Voltage top", "Microwave High Voltage actual bottom", "Microwave High Voltage actual top", "Microwave Target bottom", "Microwave Target top", "SC Pump XS M4" {
            w207 = " Information not required for this device type"  # String {0}
            Concatenate Strings("[ℹ]", w207) -> w12
            w11 = $"Error Cluster input"
            w13 = s1
            w14 = s2
          }
          frame "Reference Volume Steam Generator" {
            Floating Point String To Number(default (0 DBL)=0, string=w10, use system decimal point (T)=TRUE) -> (number=w13)
            Multiply(9.1, 1.1) -> w208
            Multiply(9.1, 0.9) -> w209
            In Range And Coerce(lower limit=w209, upper limit=w208, x=w13) -> (In Range?=w210)
            # G201_Volume_Steam_Generator_Norm = 9.1
            case (w210) {
              frame False, Default {
                w211 = "❌"  # String {0}
                Concatenate Strings(w211, " ", w6, " ", "is out of range !") -> w12
              }
              frame True {
                w12 = "✅"
              }
            }
            w11 = $"Error Cluster input"
            w14 = s2
          }
          frame "Actual Filling Volume Steam Generator" {
            Floating Point String To Number(default (0 DBL)=0, string=w10, use system decimal point (T)=TRUE) -> (number=w14)
            Multiply(s1, 0.2) -> w212
            Add(w212, s1) -> w213
            Subtract(x=s1, y=w212) -> w214
            In Range And Coerce(lower limit=w214, upper limit=w213, x=w14) -> (In Range?=w215)
            case (w215) {
              frame False, Default {
                w216 = "❌"  # String {0}
                Concatenate Strings(w216, " ", w6, " ", "doesn't fit to the norm level") -> w12
              }
              frame True {
                w12 = "✅"
              }
            }
            w11 = $"Error Cluster input"
            w13 = s1
          }
          frame "CalcCheck Volume Steam Generator" {
            Floating Point String To Number(default (0 DBL)=0, string=w10, use system decimal point (T)=TRUE) -> (number=w217)
            Is Greater(x=w217, y=s2) -> w218
            Divide(x=s2, y=w217) -> w219
            Is Less(x=w219, y=1.08) -> w220
            Logical Or(w220, w218) -> w221
            case (w221) {
              frame True {
                w222 = "❌"  # String {0}
                Concatenate Strings(w222, " ", "Too much calc in the steam generator!") -> w12
              }
              frame False {
                w12 = "✅"
              }
            }
            w11 = $"Error Cluster input"
            w13 = s1
            w14 = s2
          }
        }
      }
      frame "G202" {
        case (w6) {
          frame "False", Default {
            w11 = $"Error Cluster input"
            w12 = "✅"
            w13 = s1
            w14 = s2
          }
          frame "Ball Valve Motor M7", "Care Pump XS M18", "CleanJet Pump XS M6", "Magnetron Cooling Fan bottom", "Magnetron Cooling Fan top", "Magnetron Safety Chain bottom", "Magnetron Safety Chain top", "Microwave Anode current bottom", "Microwave Anode current top", "Microwave Heating Voltage bottom", "Microwave Heating Voltage top", "Microwave High Voltage actual bottom", "Microwave High Voltage actual top", "Microwave Target bottom", "Microwave Target top", "SC Pump XS M4" {
            w223 = " Information not required for this device type"  # String {0}
            Concatenate Strings("[ℹ]", w223) -> w12
            w11 = $"Error Cluster input"
            w13 = s1
            w14 = s2
          }
          frame "Reference Volume Steam Generator" {
            # G202_Volume_Steam_Generator_Norm = 13.5
            Floating Point String To Number(default (0 DBL)=0, string=w10, use system decimal point (T)=TRUE) -> (number=w13)
            Multiply(13.5, 1.1) -> w224
            Multiply(13.5, 0.9) -> w225
            In Range And Coerce(lower limit=w225, upper limit=w224, x=w13) -> (In Range?=w226)
            case (w226) {
              frame False, Default {
                w227 = "❌"  # String {0}
                Concatenate Strings(w227, " ", w6, " ", "is out of range !") -> w12
              }
              frame True {
                w12 = "✅"
              }
            }
            w11 = $"Error Cluster input"
            w14 = s2
          }
          frame "Actual Filling Volume Steam Generator" {
            Floating Point String To Number(default (0 DBL)=0, string=w10, use system decimal point (T)=TRUE) -> (number=w14)
            Multiply(s1, 0.2) -> w228
            Add(w228, s1) -> w229
            Subtract(x=s1, y=w228) -> w230
            In Range And Coerce(lower limit=w230, upper limit=w229, x=w14) -> (In Range?=w231)
            case (w231) {
              frame False, Default {
                w232 = "❌"  # String {0}
                Concatenate Strings(w232, " ", w6, " ", "doesn't fit to the norm level") -> w12
              }
              frame True {
                w12 = "✅"
              }
            }
            w11 = $"Error Cluster input"
            w13 = s1
          }
          frame "CalcCheck Volume Steam Generator" {
            Floating Point String To Number(default (0 DBL)=0, string=w10, use system decimal point (T)=TRUE) -> (number=w233)
            Is Greater(x=w233, y=s2) -> w234
            Divide(x=s2, y=w233) -> w235
            Is Less(x=w235, y=1.08) -> w236
            Logical Or(w236, w234) -> w237
            case (w237) {
              frame True {
                w238 = "❌"  # String {0}
                Concatenate Strings(w238, " ", "Too much calc in the steam generator!") -> w12
              }
              frame False {
                w12 = "✅"
              }
            }
            w11 = $"Error Cluster input"
            w13 = s1
            w14 = s2
          }
        }
      }
    }
    call "Search and Replace Pattern.gvi"(String=w7, Muster="\"", Alle ersetzen=TRUE) -> (Ergebnis-String=w239)
    call "Trim Whitespace.gvi"(string=w239) -> (trimmed string=w240)
    Property Node(instance in=T1 {all zero or empty}, "Parameter Name"=w6, "Status"=w10, "Dimension"=w240, "Comment"=w12) -> (instance out=w241)
    append w241 to w2
    next s1 = w13
    next s2 = w14
  }
  $Output_Error <- w11
  $"Diagnostic Water iCS Switch Output" <- w2
