vi "Interpret_SystemLogger.gviweb"   [G Web Development Software 22.3.0]
inputs:
  "SystemLogger Entrys": string[]
  "Error Cluster input": error
  "Startup Date and Time": string
outputs:
  "Error Cluster output": error
  "System Logger Output": T1[]
types:
  T1 = cluster{"Parameter Name": string, "Value": string, "Dimension": string, "Comment": string}
uses:
  NI::G Core::Strings::Search and Replace Pattern.gvi
  NI::G Core::Strings::Trim Whitespace.gvi
  WebApp::Change_to_validate_Date.gvi
diagram:
  # 2024.10.21.22.22.54
  # 2024.11.05_11.10.12
  for {
    w1 = each element of $"SystemLogger Entrys"
    Match Pattern(regular expression="Value=", string=w1) -> (after substring=w3, before substring=w4)
    Match Pattern(regular expression="Value_-_rel=", string=w3) -> (after substring=w5, before substring=w6, match substring=w7)
    case (w7) {
      frame "Value_-_rel=" {
        call "Search and Replace Pattern.gvi"(String=w6, Muster="\"", Alle ersetzen=TRUE) -> (Ergebnis-String=w11)
        call "Trim Whitespace.gvi"(string=w11) -> (trimmed string=w9)
        Match Pattern(regular expression="dim=", string=w5) -> (after substring=w12)
        call "Search and Replace Pattern.gvi"(String=w12, Muster="\"", Alle ersetzen=TRUE) -> (Ergebnis-String=w13)
        call "Trim Whitespace.gvi"(string=w13) -> (trimmed string=w8)
        w10 = $"Error Cluster input"
      }
      frame "False", Default {
        Match Pattern(regular expression="dim=", string=w3) -> (after substring=w14, before substring=w15)
        call "Search and Replace Pattern.gvi"(String=w15, Muster="\"", Alle ersetzen=TRUE) -> (Ergebnis-String=w9)
        call "Search and Replace Pattern.gvi"(String=w14, Muster="\"", Alle ersetzen=TRUE) -> (Ergebnis-String=w8)
        w10 = $"Error Cluster input"
      }
    }
    call "Search and Replace Pattern.gvi"(String=w4, Muster="_", Ersetzungs-String=" ", Alle ersetzen=TRUE) -> (Ergebnis-String=w16)
    call "Trim Whitespace.gvi"(string=w16) -> (trimmed string=w17)
    case (w17) {
      frame "False", Default {
        w18 = w17
        w19 = w10
        w20 = w9
      }
      frame "Last calibration", "Second Last calibration" {
        call "Change_to_validate_Date.gvi"(Date_Time_String input=w9, Error Cluster input=w10) -> (Validate date and time=w20, Error Cluster output=w19)
        w18 = w17
      }
    }
    call "Trim Whitespace.gvi"(string=w20) -> (trimmed string=w21)
    Is Empty String Or Path(string/path=w21) -> w22
    case (w22) {
      frame False, Default {
        case (w18) {
          frame "False", Default {
            w23 = "✅"
          }
          frame "Number Calibrations" {
            Decimal String To Number(default (0 I32)=0, string=w9) -> (number=w24)
            Is Greater Than 0(x=w24) -> w25
            case (w25) {
              frame True {
                w23 = "✅"
              }
              frame False {
                w26 = "❌"  # String {0}
                Concatenate Strings(w26, " ", w18, " ", "is not correct!") -> w23
              }
            }
          }
          frame "Last calibration" {
            Floating Point String To Number(default (0 DBL)=0, string=$"Startup Date and Time") -> (number=w27)
            Floating Point String To Number(default (0 DBL)=0, string=w9) -> (number=w28)
            Add(w28, 140000) -> w29
            Is Less Or Equal(x=w27, y=w29) -> w30
            case (w30) {
              frame True {
                w23 = "✅"
              }
              frame False {
                w31 = "❌"  # String {0}
                Concatenate Strings(w31, " ", w18, " ", "of the unit was before the installation !") -> w23
              }
            }
          }
          frame "Last Dry calibration" {
            Is Equal(x=w9, y="true") -> w32
            case (w32) {
              frame False {
                w23 = "✅"
              }
              frame True {
                Concatenate Strings("⚠️", " ", "The last calibration was a dry calibration!") -> w23
              }
            }
          }
          frame "Second Last Dry calibration" {
            Is Equal(x=w9, y="true") -> w33
            case (w33) {
              frame False {
                w23 = "✅"
              }
              frame True {
                Concatenate Strings("⚠️", " ", "The second last calibration was a dry calibration!") -> w23
              }
            }
          }
        }
      }
      frame True {
        w34 = " Information not required for this device type"  # String {0}
        Concatenate Strings("[ℹ]", w34) -> w23
      }
    }
    Property Node(instance in=T1 {all zero or empty}, "Parameter Name"=w18, "Value"=w21, "Dimension"=w8, "Comment"=w23) -> (instance out=w35)
    append w35 to w2
  }
  $"Error Cluster output" <- w19
  $"System Logger Output" <- w2
