vi "index.gviweb"   [G Web Development Software 22.3.0]
# Press “Analyse” and select a service report xml file
panel controls:
  "Analyse": bool  # Press the button “Analyse” and select a service report xml file.
  "Page 1": i32
  "Page selector": enum{"Page 1", "Page 2", "Page 3", "Page 4"} = "Page 1"
  "Page 2": i32
  "Page 3": i32
  "Page 4": i32
  "Device": enum{"iCombi", "iVario"} = "iCombi"
  "ivario": i32
  "Info_Plot": bool
panel indicators:
  "Device:": string
  "Board Information:": cluster{"Board": string, "Information": string}[]
  "common": T1[]
  "URL-Grafik": string
  "Basic_Settings": T2[]
  "Diagnostic RT Calibration": T3[]
  "Checkbox": bool
  "Diagnostic_Water_iCS_Switch": T4[]
  "Diagnostic-Service-History": T5[]
  "Diagnostic Running Times Comp": T6[]
  "Diagnostic Running Times Modes": T6[]
  "System Logger Output": T2[]
  "Histogram cpu pcb Temperature profile Celsius": f64[]
  "skala histogram CPU": string
  "Histogram IO Temperature profile Celsius": f64[]
  "skala histogram IO": string
  "Histogram LED hinge side Temperature profile Celsius": f64[]
  "skala Histogram LED hinge": string
  "Histogram LED handle side Temperature profile Celsius": f64[]
  "Skala Histogram LED handle": string
  "Histogram pump pcb Temperature profile Celsius": f64[]
  "skala Histogram pump pcb": string
  "Histogram gas box Temperature profile Celsius": f64[]
  "Skala Histogram Gas box": string
  "Histogram fan 1 RPM profile 1 min": f64[]
  "skala Histogram fan 1 rpm": string
  "Histogram fan 1 power profile W": f64[]
  "Skala Histogram fan power": string
  "Histogram fan 1 Temperature_profile Celsius": f64[]
  "Skala Histogram fan1 temp": string
  "Histogram fan 1 Voltage max_V_1phase_3phase": f64[]
  "Skala Histogram fan1 max Volt": string
  "Histogram fan 1 Voltage min_V_1phase_3phase": f64[]
  "Skala Histogram fan1 minVolt": string
  "Histogram fan 2 RPM profile 1 min": f64[]
  "skala Histogram fan 2 rpm": string
  "Histogram fan 2 power profile W": f64[]
  "Skala Histogram fan2 power": string
  "Histogram fan 2 Temperature_profile Celsius": f64[]
  "Skala Histogram fan2 temp": string
  "Histogram fan 2 Voltage max_V_1phase_3phase": f64[]
  "Histogram fan 2 Voltage min_V_1phase_3phase": f64[]
  "Skala Histogram fan2 minVolt": string
  "Skala Histogram fan2 maxVolt": string
  "Histogram fan 3 RPM profile 1 min": f64[]
  "skala Histogram fan 3 rpm": string
  "Histogram fan 3 power profile W": f64[]
  "Skala Histogram fan3 power": string
  "Histogram fan 3 Temperature_profile Celsius": f64[]
  "Skala Histogram fan3 temp": string
  "Histogram fan 3 Voltage max_V_1phase_3phase": f64[]
  "Histogram fan 3 Voltage min_V_1phase_3phase": f64[]
  "Skala Histogram fan3 minVolt": string
  "Skala Histogram fan3 maxVolt": string
  "Histogram MMI CPU Load Percent": f64[]
  "Skala Histogram MMI CPU": string
  "Histogram MMI RAM Load Percent": f64[]
  "Skala Histogram MMI Load": string
  "Histogram Basis CPU Load Percent": f64[]
  "Skala Histogram Basis MMI CPU": string
  "Histogram Basis RAM Load Percent": f64[]
  "Skala Histogram Basis MMI Load": string
  "Histogram Magnetron Top Temperatur profile Celsius": f64[]
  "skala Magnetron top": string
  "Histogram Magnetron bottom Temperature profile Celsius": f64[]
  "skala Magnetron bottom": string
  "Histogram Power Supply Top Temperature profile Celsius": f64[]
  "skala Power Supply top": string
  "Histogram Power Supply bottom Temperature profile Celsius": f64[]
  "skala histogram Power Supply bottom": string
  "Boards_Information:": cluster{"Board": string, "Information": string}[]
  "Device :": string
  "common Information ivario": T1[]
  "Basic Informations": T2[]
  "Diagnostic_RT_Data_Sensors_Heating": T7[]
  "Diagnostic_RT_Data_Sensors": T8[]
  "Diagnostic_RT_Data_Sensors_mouvement": T9[]
  "Diagnostic_RT_Data_Sensors_Pressure": T4[]
  "Diagnostic-Service-History_iVario": T5[]
  "Total Running Time:": T6[]
  "Diagnostic Running Times Components:": T6[]
  "String": string
types:
  T1 = cluster{"Parameter Name": string, "Value": string, "Comment": string}
  T2 = cluster{"Parameter Name": string, "Value": string, "Dimension": string, "Comment": string}
  T3 = cluster{"Parameter Name": string, "Combi": string, "Dry": string, "Wet": string, "Dimension": string, "Comment": string}
  T4 = cluster{"Parameter Name": string, "Status": string, "Dimension": string, "Comment": string}
  T5 = cluster{"Parameter Name": string, "First Time": string, "Last Time": string, "Quantity": string, "Comment": string}
  T6 = cluster{"Parameter Name": string, "Count": string, "Duration": string, "Dimension": string, "Comment": string}
  T7 = cluster{"Parameter Name": string, "Actual": string, "Dimension": string, "Comment": string}
  T8 = cluster{"Parameter Name": string, "Actual": string, "Dimension": string, "Limit": string, "maximum": string, "Time_stamp": string, "Comment": string}
  T9 = cluster{"Parameter Name": string, "Command": string, "Down_Switch": string, "Status": string, "Up_Switch": string, "Dimension": string, "Comment": string}
  T10 = cluster{"Parameter Name": string, "Status": string, "Dimension": string, "comment": string}
  T11 = cluster{"Boards": string, "Informations": string}
  T12 = cluster{"Parameter Name": string, "Actual": string, "Dimension": string, "comment": string}
  T13 = cluster{"Parameter Name": string, "Command": string, "Down_Switch": string, "Status": string, "Up_Switch": string, "dim": string, "Comment": string}
uses:
  NI::HTTP::GET.gvi
  Uppy::Function.gvi
  FileTasks::Read File Text.gvi
  NI::G Core::Error::Clear Error Cluster.gvi
  Library::Check_XML_Device.gviweb
  WebApp::Read_XML_Part.gviweb
  WebApp::Exlude_WA_Entrys.gviweb
  WebApp::Interpret_Common_Information.gviweb
  WebApp::Interpret_Common_Information_iVario.gviweb
  WebApp::Interpret_Basic_Settings.gviweb
  WebApp::Interpret_Basic_Settings_iVario.gviweb
  WebApp::Interpret_Diagnostic_RT_Data_Sensors.gviweb
  WebApp::Interpret_Diagnostic_RT_Data_Sensors_Heating.gviweb
  WebApp::Interpret_Diagnostic_RT_Data_Sensors_Movement.gviweb
  WebApp::Interpret_Diagnostic_RT_Data_Sensors_Pressure.gviweb
  WebApp::Interpret_Diagnostic_RT_Calibration.gviweb
  WebApp::Interpret_Diagnostic_Water_iCS_Switch.gviweb
  WebApp::Interpret_Diagnostic_Service_History.gviweb
  WebApp::Interpret_Diagnostic_RunningTimes_Comp.gviweb
  WebApp::Interpret_SystemLogger.gviweb
  WebApp::Interpret_Histogram_CPU_IO_Temperature.gviweb
  WebApp::Interpret_Diagnostic_RunningTimes_Modes.gviweb
diagram:
  w1 = "Init"  # State
  # "": Unit-Type
  s1 = w1  # shift register
  s2 = ""  # shift register
  s3 = string[] []  # shift register
  s4 = ""  # shift register
  s5 = ""  # shift register
  s6 = ""  # shift register
  while {
    case (s1) {
      frame "Init", Default {
        $"Skala Histogram fan1 temp" <- "skala_fan_temp.jpg"
        $"skala Histogram pump pcb" <- "skala_120.jpg"
        w9 = "Read Ini File"  # State
        $"skala histogram IO" <- "skala_120.jpg"
        $"Skala Histogram fan2 temp" <- "skala_fan_temp.jpg"
        $"skala histogram CPU" <- "skala_120.jpg"
        $"Skala Histogram fan3 temp" <- "skala_fan_temp.jpg"
        $"Device:" <- "No_Picture.jpg"
        $"skala Histogram LED hinge" <- "skala_120.jpg"
        $"Skala Histogram fan2 power" <- "skala_fan_Puis.jpg"
        $"URL-Grafik" <- "Rational_Logo.png"
        $"Skala Histogram LED handle" <- "skala_120.jpg"
        $"Skala Histogram fan power" <- "skala_fan_Puis.jpg"
        $"Skala Histogram Gas box" <- "skala_120.jpg"
        $"Skala Histogram fan3 power" <- "skala_fan_Puis.jpg"
        $"Skala Histogram fan3 minVolt" <- "skala_fan_voltage.jpg"
        $"Skala Histogram fan1 minVolt" <- "skala_fan_voltage.jpg"
        $"skala Histogram fan 3 rpm" <- "skala_fan_RPM.jpg"
        $"Skala Histogram Basis MMI Load" <- "skala_MMI.jpg"
        $"skala Magnetron top" <- "skala_120.jpg"
        $"Skala Histogram fan1 max Volt" <- "skala_fan_voltage.jpg"
        $"skala Histogram fan 1 rpm" <- "skala_fan_RPM.jpg"
        $"skala Power Supply top" <- "skala_120.jpg"
        $"Skala Histogram Basis MMI CPU" <- "skala_MMI.jpg"
        $"Skala Histogram fan2 minVolt" <- "skala_fan_voltage.jpg"
        $"skala Histogram fan 2 rpm" <- "skala_fan_RPM.jpg"
        $"skala Magnetron bottom" <- "skala_120.jpg"
        $"Skala Histogram MMI CPU" <- "skala_MMI.jpg"
        $"Skala Histogram fan2 maxVolt" <- "skala_fan_voltage.jpg"
        $"skala histogram Power Supply bottom" <- "skala_120.jpg"
        $"Skala Histogram MMI Load" <- "skala_MMI.jpg"
        $"Skala Histogram fan3 maxVolt" <- "skala_fan_voltage.jpg"
        Property Node(instance in=reference to "String", "Visible"=FALSE, error in=no error) -> (error out=w10, instance out=w11)
        Close Reference(error in=w10, reference=w11) -> (error out=w12)
        Property Node(instance in=reference to "Page 1", "Visible"=TRUE, error in=w12) -> (error out=w13, instance out=w14)
        Property Node(instance in=reference to "Page 2", "Visible"=FALSE, error in=w13) -> (error out=w15, instance out=w16)
        Property Node(instance in=reference to "Page 3", "Visible"=FALSE, error in=w15) -> (error out=w17, instance out=w18)
        Property Node(instance in=reference to "Page 4", "Visible"=FALSE, error in=w17) -> (error out=w19, instance out=w20)
        Property Node(instance in=reference to "ivario", "Visible"=FALSE, error in=w19) -> (error out=w21, instance out=w22)
        Close Reference(error in=w21, reference=w14) -> (error out=w23)
        Close Reference(error in=w23, reference=w16) -> (error out=w24)
        Close Reference(error in=w24, reference=w18) -> (error out=w25)
        Close Reference(error in=w25, reference=w20) -> (error out=w26)
        Close Reference(error in=w26, reference=w22) -> (error out=w2)
        w3 = w9
        w4 = s2
        w5 = s3
        w6 = s4
        w7 = s5
        w8 = s6
      }
      frame "Reset all" {
        $"Diagnostic Running Times Modes" <- T6[] []
        $"Total Running Time:" <- T6[] []
        $"Device :" <- "No_Picture.jpg"
        $"System Logger Output" <- T2[] []
        $Checkbox <- FALSE
        $"Device:" <- "No_Picture.jpg"
        $"Diagnostic Running Times Components:" <- T6[] []
        $"Diagnostic RT Calibration" <- T3[] []
        w27 = "Wait For Interaction"  # State
        $"Histogram Basis RAM Load Percent" <- f64[] []
        $common <- T1[] []
        $"Diagnostic Running Times Comp" <- T6[] []
        $"Histogram Basis CPU Load Percent" <- f64[] []
        $"common Information ivario" <- T1[] []
        $Diagnostic_RT_Data_Sensors_Pressure <- T10[] []
        $"Histogram MMI RAM Load Percent" <- f64[] []
        $"Diagnostic-Service-History" <- T5[] []
        $"Basic Informations" <- T2[] []
        $"Histogram MMI CPU Load Percent" <- f64[] []
        $Basic_Settings <- T2[] []
        $Diagnostic_Water_iCS_Switch <- T4[] []
        $"Boards_Information:" <- T11[] []
        $"Histogram fan 3 power profile W" <- f64[] []
        $"Board Information:" <- T11[] []
        $Diagnostic_RT_Data_Sensors <- T8[] []
        $"Diagnostic-Service-History_iVario" <- T5[] []
        $Diagnostic_RT_Data_Sensors_Heating <- T12[] []
        $Diagnostic_RT_Data_Sensors_mouvement <- T13[] []
        case ($Device) {
          frame "iCombi", Default {
            for (N = 4) (iteration -> i1) {
              case (i1) {
                frame 0, Default {
                  Property Node(instance in=reference to "Page 1", "Value"=i1, "Visible"=TRUE, error in=no error) -> (error out=w28, instance out=w29)
                  Close Reference(error in=w28, reference=w29) -> (error out=w2)
                }
                frame 1 {
                  Property Node(instance in=reference to "Page 2", "Value"=i1, "Visible"=FALSE, error in=no error) -> (error out=w30, instance out=w31)
                  Close Reference(error in=w30, reference=w31) -> (error out=w2)
                }
                frame 2 {
                  Property Node(instance in=reference to "Page 3", "Value"=i1, "Visible"=FALSE, error in=no error) -> (error out=w32, instance out=w33)
                  Close Reference(error in=w32, reference=w33) -> (error out=w2)
                }
                frame 3 {
                  Property Node(instance in=reference to "Page 4", "Value"=i1, "Visible"=FALSE, error in=no error) -> (error out=w34, instance out=w35)
                  Close Reference(error in=w34, reference=w35) -> (error out=w2)
                }
              }
            }
          }
          frame "iVario" {
            Property Node(instance in=reference to "ivario", "Value"=0, error in=no error) -> (error out=w36, instance out=w37)
            Close Reference(error in=w36, reference=w37) -> (error out=w2)
          }
        }
        $"Histogram fan 1 Voltage min_V_1phase_3phase" <- f64[] []
        $"Histogram fan 1 Voltage max_V_1phase_3phase" <- f64[] []
        $"Histogram fan 3 RPM profile 1 min" <- f64[] []
        $"Histogram fan 1 Temperature_profile Celsius" <- f64[] []
        $"Histogram fan 2 RPM profile 1 min" <- f64[] []
        $"Histogram fan 3 Voltage min_V_1phase_3phase" <- f64[] []
        $"Histogram fan 2 power profile W" <- f64[] []
        $"Histogram fan 1 power profile W" <- f64[] []
        $"Histogram fan 3 power profile W" <- f64[] []
        $"Histogram gas box Temperature profile Celsius" <- f64[] []
        $"Histogram fan 3 Temperature_profile Celsius" <- f64[] []
        $"Histogram fan 1 RPM profile 1 min" <- f64[] []
        $"Histogram fan 2 Temperature_profile Celsius" <- f64[] []
        $"Histogram pump pcb Temperature profile Celsius" <- f64[] []
        $"Histogram cpu pcb Temperature profile Celsius" <- f64[] []
        $"Histogram fan 2 Voltage max_V_1phase_3phase" <- f64[] []
        $"Histogram LED handle side Temperature profile Celsius" <- f64[] []
        $"Histogram IO Temperature profile Celsius" <- f64[] []
        $"Histogram LED hinge side Temperature profile Celsius" <- f64[] []
        w3 = w27
        w4 = s2
        w5 = s3
        w6 = s4
        w7 = s5
        w8 = s6
      }
      frame "Change Page" {
        w38 = "Wait For Interaction"  # State
        case ($"Page selector") {
          frame "Page 1", Default {
            Property Node(instance in=reference to "Page 2", "Visible"=FALSE, error in=no error) -> (error out=w44, instance out=w40)
            Property Node(instance in=reference to "Page 1", "Visible"=TRUE, error in=w44) -> (error out=w45, instance out=w41)
            Property Node(instance in=reference to "Page 3", "Visible"=FALSE, error in=w45) -> (error out=w46, instance out=w42)
            Property Node(instance in=reference to "Page 4", "Visible"=FALSE, error in=w46) -> (error out=w39, instance out=w43)
          }
          frame "Page 2" {
            Property Node(instance in=reference to "Page 2", "Visible"=TRUE, error in=no error) -> (error out=w47, instance out=w40)
            Property Node(instance in=reference to "Page 1", "Visible"=FALSE, error in=w47) -> (error out=w48, instance out=w41)
            Property Node(instance in=reference to "Page 3", "Visible"=FALSE, error in=w48) -> (error out=w49, instance out=w42)
            Property Node(instance in=reference to "Page 4", "Visible"=FALSE, error in=w49) -> (error out=w39, instance out=w43)
          }
          frame "Page 3" {
            Property Node(instance in=reference to "Page 2", "Visible"=FALSE, error in=no error) -> (error out=w50, instance out=w40)
            Property Node(instance in=reference to "Page 1", "Visible"=FALSE, error in=w50) -> (error out=w51, instance out=w41)
            Property Node(instance in=reference to "Page 3", "Visible"=TRUE, error in=w51) -> (error out=w52, instance out=w42)
            Property Node(instance in=reference to "Page 4", "Visible"=FALSE, error in=w52) -> (error out=w39, instance out=w43)
          }
          frame "Page 4" {
            Property Node(instance in=reference to "Page 2", "Visible"=FALSE, error in=no error) -> (error out=w53, instance out=w40)
            Property Node(instance in=reference to "Page 1", "Visible"=FALSE, error in=w53) -> (error out=w54, instance out=w41)
            Property Node(instance in=reference to "Page 3", "Visible"=FALSE, error in=w54) -> (error out=w55, instance out=w42)
            Property Node(instance in=reference to "Page 4", "Visible"=TRUE, error in=w55) -> (error out=w39, instance out=w43)
          }
        }
        Close Reference(error in=w39, reference=w40) -> (error out=w56)
        Close Reference(error in=w56, reference=w41) -> (error out=w57)
        Close Reference(error in=w57, reference=w42) -> (error out=w58)
        Close Reference(error in=w58, reference=w43) -> (error out=w2)
        w3 = w38
        w4 = s2
        w5 = s3
        w6 = s4
        w7 = s5
        w8 = s6
      }
      frame "Change Device" {
        w59 = "Wait For Interaction"  # State
        case ($Device) {
          frame "iCombi", Default {
            Property Node(instance in=reference to "Page selector", "Visible"=TRUE, "Value"="Page 1", error in=no error) -> (error out=w67, instance out=w66)
            Property Node(instance in=reference to "ivario", "Visible"=FALSE, error in=w67) -> (error out=w68, instance out=w65)
            Property Node(instance in=reference to "Page 2", "Visible"=FALSE, error in=w68) -> (error out=w69, instance out=w61)
            Property Node(instance in=reference to "Page 1", "Visible"=TRUE, error in=w69) -> (error out=w70, instance out=w62)
            Property Node(instance in=reference to "Page 3", "Visible"=FALSE, error in=w70) -> (error out=w71, instance out=w63)
            Property Node(instance in=reference to "Page 4", "Visible"=FALSE, error in=w71) -> (error out=w60, instance out=w64)
          }
          frame "iVario" {
            Property Node(instance in=reference to "Page selector", "Visible"=FALSE, error in=no error) -> (error out=w72, instance out=w66)
            Property Node(instance in=reference to "ivario", "Visible"=TRUE, error in=w72) -> (error out=w73, instance out=w65)
            Property Node(instance in=reference to "Page 2", "Visible"=FALSE, error in=w73) -> (error out=w74, instance out=w61)
            Property Node(instance in=reference to "Page 1", "Visible"=FALSE, error in=w74) -> (error out=w75, instance out=w62)
            Property Node(instance in=reference to "Page 3", "Visible"=FALSE, error in=w75) -> (error out=w76, instance out=w63)
            Property Node(instance in=reference to "Page 4", "Visible"=FALSE, error in=w76) -> (error out=w60, instance out=w64)
          }
        }
        Close Reference(error in=w60, reference=w61) -> (error out=w77)
        Close Reference(error in=w77, reference=w62) -> (error out=w78)
        Close Reference(error in=w78, reference=w63) -> (error out=w79)
        Close Reference(error in=w79, reference=w64) -> (error out=w80)
        Close Reference(error in=w80, reference=w65) -> (error out=w81)
        Close Reference(error in=w81, reference=w66) -> (error out=w2)
        w3 = w59
        w4 = s2
        w5 = s3
        w6 = s4
        w7 = s5
        w8 = s6
      }
      frame "Read Ini File" {
        w82 = "Wait For Interaction"  # State
        call "GET.gvi"(url="Config_XML_Datainterpreter.ini", error in=no error) -> (body=w83, error out=w84)
        call "Function.gvi"(string in=w83, Error Cluster Constant=w84) -> (Output=w5, Output_error=w2)
        w3 = w82
        w4 = s2
        w6 = s4
        w7 = s5
        w8 = s6
      }
      frame "Read XML File" {
        call "Read File Text.gvi"(allowed file types=[".xml"], error in=no error) -> (file content=w85, file name=w86, error out=w87)
        case (w87) {
          frame Error, Default {
            w88 = "Reset all"  # State
            call "Clear Error Cluster.gvi"(error in=w87) -> (error out=w2)
            w3 = w88
            w4 = ""
          }
          frame No Error {
            call "Clear Error Cluster.gvi"(error in=w87) -> (error out=w89)
            case ($Device) {
              frame "iVario" {
                call "Check_XML_Device.gviweb"(XML Name=w86, Error Input=w89, XML Content=w85, First Check="Pan", Second Check="Potentiometer", Sous-Fix="RAT") -> (Error Output=w90, XML fine ?=w91)
                case (w91) {
                  frame False, Default {
                    w92 = "Reset all"  # State
                    call "Check_XML_Device.gviweb"(XML Name=w86, Error Input=w90, XML Content=w85, First Check="Histogram", Second Check="CalibN1", Sous-Fix="RAG") -> (Error Output=w2, XML fine ?=w93)
                    case (w93) {
                      frame False, Default {
                        w94 = "The service report is invalid, please check the XML file you have opened"
                        One Button Dialog(message=w94)
                      }
                      frame True {
                        w95 = "Please select iCombi as device and reload the selected Service Report XML file !"
                        One Button Dialog(message=w95)
                      }
                    }
                    w3 = w92
                  }
                  frame True {
                    w96 = "Common Information iVario"  # State
                    w3 = w96
                    w2 = w90
                  }
                }
              }
              frame "iCombi", Default {
                call "Check_XML_Device.gviweb"(XML Name=w86, Error Input=w89, XML Content=w85, First Check="Histogram", Second Check="CalibN1", Sous-Fix="RAG") -> (Error Output=w97, XML fine ?=w98)
                case (w98) {
                  frame False, Default {
                    w99 = "Reset all"  # State
                    call "Check_XML_Device.gviweb"(XML Name=w86, Error Input=w97, XML Content=w85, First Check="Pan", Second Check="Potentiometer", Sous-Fix="RAT") -> (Error Output=w2, XML fine ?=w100)
                    case (w100) {
                      frame False, Default {
                        w101 = "The service report is invalid, please check the XML file you have opened"
                        One Button Dialog(message=w101)
                      }
                      frame True {
                        w102 = "Please select iVario as device and reload the selected Service Report XML file !"
                        One Button Dialog(message=w102)
                      }
                    }
                    w3 = w99
                  }
                  frame True {
                    w103 = "Common Information"  # State
                    w3 = w103
                    w2 = w97
                  }
                }
              }
            }
            w4 = w85
          }
        }
        w5 = s3
        w6 = s4
        w7 = s5
        w8 = s6
      }
      frame "Wait For Interaction" {
        event {
          on "Analyse" Value changed {
            w104 = "Read XML File"  # State
            w2 = no error
            w3 = w104
          }
          on "Page selector" Value changed {
            w105 = "Change Page"  # State
            w2 = no error
            w3 = w105
          }
          on "Device" Value changed {
            w106 = "Change Device"  # State
            w2 = no error
            w3 = w106
          }
          on "Info_Plot" Value changed {
            w107 = "Wait For Interaction"  # State
            Event Data() -> ("New Value"=w108)
            case (w108) {
              frame False, Default {
                Property Node(instance in=reference to "String", "Visible"=FALSE, error in=no error) -> (error out=w109, instance out=w110)
              }
              frame True {
                Property Node(instance in=reference to "String", "Visible"=TRUE, error in=no error) -> (error out=w109, instance out=w110)
                w111 = "Press the drop down menu under \"Plot\" \nand change the graph settings as desired."
                $String <- w111
              }
            }
            Close Reference(error in=w109, reference=w110) -> (error out=w2)
            w3 = w107
          }
        }
        w4 = s2
        w5 = s3
        w6 = s4
        w7 = s5
        w8 = s6
      }
      frame "Common Information" {
        call "Read_XML_Part.gviweb"(Input XML=s2, Start XML Part="<Common_Information>", End XML Part="</Common_Information>", Error in=no error) -> (Output XML array=w112, Error out=w113)
        call "Exlude_WA_Entrys.gviweb"(Input XML array=w112, Error in=w113) -> (Without_WA_Entrys=w114, Output Error=w115)
        call "Interpret_Common_Information.gviweb"(Common Information Entrys=w114, Language Entrys=s3, Error Cluster Constant=w115) -> (Startup Date and Time=w8, Device:=w116, common=w117, Boards Informations:=w118, Output Error=w2, Unit-type=w6)
        case (w116) {
          frame "No_Analyse.png" {
            w119 = "Wait For Interaction"  # State
            w3 = w119
          }
          frame "False", Default {
            w120 = "Basic Settings"  # State
            w3 = w120
          }
        }
        $"Device:" <- w116
        $common <- w117
        $"Board Information:" <- w118
        w4 = s2
        w5 = s3
        w7 = s5
      }
      frame "Common Information iVario" {
        call "Read_XML_Part.gviweb"(Input XML=s2, Start XML Part="<Common_Information>", End XML Part="</Common_Information>", Error in=no error) -> (Output XML array=w121, Error out=w122)
        call "Exlude_WA_Entrys.gviweb"(Input XML array=w121, Error in=w122) -> (Without_WA_Entrys=w123, Output Error=w124)
        call "Interpret_Common_Information_iVario.gviweb"(Common Information Entrys=w123, Language Entrys=s3, Error Cluster Constant=w124) -> (Device:=w125, common=w126, Boards Informations:=w127, Output Error=w2, Unit-type=w6)
        case (w125) {
          frame "False", Default {
            w128 = "Basic Settings iVario"  # State
            w3 = w128
          }
          frame "No_Analyse.png" {
            w129 = "Wait For Interaction"  # State
            w3 = w129
          }
        }
        $"Device :" <- w125
        $"common Information ivario" <- w126
        $"Boards_Information:" <- w127
        w4 = s2
        w5 = s3
        w7 = s5
        w8 = s6
      }
      frame "Basic Settings" {
        w130 = "Diagnostic RT Data Sensors"  # State
        call "Read_XML_Part.gviweb"(Input XML=s2, Start XML Part="<Basic_Settings>", End XML Part="</Basic_Settings>", Error in=no error) -> (Output XML array=w131, Error out=w132)
        call "Exlude_WA_Entrys.gviweb"(Input XML array=w131, Error in=w132) -> (Without_WA_Entrys=w133, Output Error=w134)
        call "Interpret_Basic_Settings.gviweb"(Basic Settings Entrys=w133, Config File infos=s3, Device Type=s4, Error input=w134) -> (Basic Informations=w135, Output Error=w2)
        $Basic_Settings <- w135
        w3 = w130
        w4 = s2
        w5 = s3
        w6 = s4
        w7 = s5
        w8 = s6
      }
      frame "Basic Settings iVario" {
        w136 = "Diagnostic RT Data Sensors Heating iVario"  # State
        call "Read_XML_Part.gviweb"(Input XML=s2, Start XML Part="<Basic_Settings>", End XML Part="</Basic_Settings>", Error in=no error) -> (Output XML array=w137, Error out=w138)
        call "Exlude_WA_Entrys.gviweb"(Input XML array=w137, Error in=w138) -> (Without_WA_Entrys=w139, Output Error=w140)
        call "Interpret_Basic_Settings_iVario.gviweb"(Basic Settings Entrys=w139, Device Type=s4, Error input=w140) -> (Basic Informations=w141, Output Error=w2)
        $"Basic Informations" <- w141
        w3 = w136
        w4 = s2
        w5 = s3
        w6 = s4
        w7 = s5
        w8 = s6
      }
      frame "Diagnostic RT Data Sensors" {
        w142 = "DIagnostic RT Calibration"  # State
        call "Read_XML_Part.gviweb"(Input XML=s2, Start XML Part="<Diagnostic_RT_Data_Sensors>", End XML Part="</Diagnostic_RT_Data_Sensors>", Error in=no error) -> (Output XML array=w143, Error out=w144)
        call "Exlude_WA_Entrys.gviweb"(Input XML array=w143, Error in=w144) -> (Without_WA_Entrys=w145, Output Error=w146)
        call "Interpret_Diagnostic_RT_Data_Sensors.gviweb"(Diagnostic Settings Entrys=w145, Config File infos=s3, Device Type=s4, Error input=w146) -> (Diagnostic_RT_Data_Sensors=w147, Output Error=w2)
        $Diagnostic_RT_Data_Sensors <- w147
        w3 = w142
        w4 = s2
        w5 = s3
        w6 = s4
        w7 = s5
        w8 = s6
      }
      frame "Diagnostic RT Data Sensors Heating iVario" {
        w148 = "Diagnostic RT Data Sensors Movement iVario"  # State
        call "Read_XML_Part.gviweb"(Input XML=s2, Start XML Part="<Diagnostic_RT_Data_Sensors_Heating>", End XML Part="</Diagnostic_RT_Data_Sensors_Heating>", Error in=no error) -> (Output XML array=w149, Error out=w150)
        Array Size(array=w149) -> (size(s)=w151)
        Is Greater Than 0(x=w151) -> w152
        case (w152) {
          frame False, Default {
            call "Read_XML_Part.gviweb"(Input XML=s2, Start XML Part="<Diagnostic_RT_Data_Sensors_(Heating)>", End XML Part="</Diagnostic_RT_Data_Sensors_(Heating)>", Error in=w150) -> (Output XML array=w154, Error out=w153)
          }
          frame True {
            w153 = w150
            w154 = w149
          }
        }
        call "Exlude_WA_Entrys.gviweb"(Input XML array=w154, Error in=w153) -> (Without_WA_Entrys=w155, Output Error=w156)
        call "Interpret_Diagnostic_RT_Data_Sensors_Heating.gviweb"(Diagnostic Settings Entrys=w155, Device Type=s4, Error input=w156) -> (Output=w157, Output Error=w2)
        $Diagnostic_RT_Data_Sensors_Heating <- w157
        w3 = w148
        w4 = s2
        w5 = s3
        w6 = s4
        w7 = s5
        w8 = s6
      }
      frame "Diagnostic RT Data Sensors Movement iVario" {
        w158 = "Diagnostic RT Data Sensors Pressure"  # State
        call "Read_XML_Part.gviweb"(Input XML=s2, Start XML Part="<Diagnostic_RT_Data_Sensors_Movement>", End XML Part="</Diagnostic_RT_Data_Sensors_Movement>", Error in=no error) -> (Output XML array=w159, Error out=w160)
        Array Size(array=w159) -> (size(s)=w161)
        Is Greater Than 0(x=w161) -> w162
        case (w162) {
          frame False, Default {
            call "Read_XML_Part.gviweb"(Input XML=s2, Start XML Part="<Diagnostic_RT_Data_Sensors_(Movement)>", End XML Part="</Diagnostic_RT_Data_Sensors_(Movement)>", Error in=w160) -> (Output XML array=w164, Error out=w163)
          }
          frame True {
            w163 = w160
            w164 = w159
          }
        }
        call "Exlude_WA_Entrys.gviweb"(Input XML array=w164, Error in=w163) -> (Without_WA_Entrys=w165, Output Error=w166)
        call "Interpret_Diagnostic_RT_Data_Sensors_Movement.gviweb"(Diagnostic Settings mouvement Entrys=w165, Device Type=s4, Error input=w166) -> (Output mouvement=w167, Output Error=w2)
        $Diagnostic_RT_Data_Sensors_mouvement <- w167
        w3 = w158
        w4 = s2
        w5 = s3
        w6 = s4
        w7 = s5
        w8 = s6
      }
      frame "Diagnostic RT Data Sensors Pressure" {
        w168 = "Diagnostic Service History iVario"  # State
        call "Read_XML_Part.gviweb"(Input XML=s2, Start XML Part="<Diagnostic_RT_Data_Sensors_Pressure>", End XML Part="</Diagnostic_RT_Data_Sensors_Pressure>", Error in=no error) -> (Output XML array=w169, Error out=w170)
        Array Size(array=w169) -> (size(s)=w171)
        Is Greater Than 0(x=w171) -> w172
        case (w172) {
          frame False, Default {
            call "Read_XML_Part.gviweb"(Input XML=s2, Start XML Part="<Diagnostic_RT_Data_Sensors_(Pressure)>", End XML Part="</Diagnostic_RT_Data_Sensors_(Pressure)>", Error in=w170) -> (Output XML array=w174, Error out=w173)
          }
          frame True {
            w173 = w170
            w174 = w169
          }
        }
        call "Exlude_WA_Entrys.gviweb"(Input XML array=w174, Error in=w173) -> (Without_WA_Entrys=w175, Output Error=w176)
        call "Interpret_Diagnostic_RT_Data_Sensors_Pressure.gviweb"(Pressure Entrys=w175, Device Type=s4, Error input=w176) -> (Output Pressure=w177, Output Error=w2)
        $Diagnostic_RT_Data_Sensors_Pressure <- w177
        w3 = w168
        w4 = s2
        w5 = s3
        w6 = s4
        w7 = s5
        w8 = s6
      }
      frame "DIagnostic RT Calibration" {
        w178 = "Diagnostic Water iCS Switch"  # State
        call "Read_XML_Part.gviweb"(Input XML=s2, Start XML Part="<Diagnostic_RT_Calibration>", End XML Part="</Diagnostic_RT_Calibration>", Error in=no error) -> (Output XML array=w179, Error out=w180)
        call "Exlude_WA_Entrys.gviweb"(Input XML array=w179, Error in=w180) -> (Without_WA_Entrys=w181, Output Error=w182)
        call "Interpret_Diagnostic_RT_Calibration.gviweb"(Diagnostic RT Calibration Entrys=w181, Error Cluster Constant=w182) -> (Diagnostic RT Calibration=w183, Calibrated=w184, Output Error=w2)
        $"Diagnostic RT Calibration" <- w183
        $Checkbox <- w184
        w3 = w178
        w4 = s2
        w5 = s3
        w6 = s4
        w7 = s5
        w8 = s6
      }
      frame "Diagnostic Water iCS Switch" {
        w185 = "Diagnostic Service History"  # State
        call "Read_XML_Part.gviweb"(Input XML=s2, Start XML Part="<Diagnostic_Water_iCS_Switch>", End XML Part="</Diagnostic_Water_iCS_Switch>", Error in=no error) -> (Output XML array=w186, Error out=w187)
        call "Exlude_WA_Entrys.gviweb"(Input XML array=w186, Error in=w187) -> (Without_WA_Entrys=w188, Output Error=w189)
        call "Interpret_Diagnostic_Water_iCS_Switch.gviweb"(Diagnostic Water iCS Switch Entrys=w188, Device Type=s4, Error Cluster input=w189) -> (Diagnostic Water iCS Switch Output=w190, Output_Error=w2)
        $Diagnostic_Water_iCS_Switch <- w190
        w3 = w185
        w4 = s2
        w5 = s3
        w6 = s4
        w7 = s5
        w8 = s6
      }
      frame "Diagnostic Service History" {
        w191 = "Diagnostic Running Times Modes"  # State
        call "Read_XML_Part.gviweb"(Input XML=s2, Start XML Part="<Diagnostic-Service-History>", End XML Part="</Diagnostic-Service-History>", Error in=no error) -> (Output XML array=w192, Error out=w193)
        call "Exlude_WA_Entrys.gviweb"(Input XML array=w192, Error in=w193) -> (Without_WA_Entrys=w194, Output Error=w195)
        call "Interpret_Diagnostic_Service_History.gviweb"(Diagnostic Service History Entrys=w194, Device Type=s4, Error Cluster input=w195) -> (Diagnostic Service History Output=w196, Error Output=w2)
        $"Diagnostic-Service-History" <- w196
        w3 = w191
        w4 = s2
        w5 = s3
        w6 = s4
        w7 = s5
        w8 = s6
      }
      frame "Diagnostic Service History iVario" {
        w197 = "Diagnostic Running Times Modes iVario "  # State
        call "Read_XML_Part.gviweb"(Input XML=s2, Start XML Part="<Diagnostic-Service-History>", End XML Part="</Diagnostic-Service-History>", Error in=no error) -> (Output XML array=w198, Error out=w199)
        call "Exlude_WA_Entrys.gviweb"(Input XML array=w198, Error in=w199) -> (Without_WA_Entrys=w200, Output Error=w201)
        call "Interpret_Diagnostic_Service_History.gviweb"(Diagnostic Service History Entrys=w200, Device Type=s4, Error Cluster input=w201) -> (Diagnostic Service History Output=w202, Error Output=w2)
        $"Diagnostic-Service-History_iVario" <- w202
        w3 = w197
        w4 = s2
        w5 = s3
        w6 = s4
        w7 = s5
        w8 = s6
      }
      frame "Diagnostic Running Times Comp" {
        w203 = "System Logger"  # State
        call "Read_XML_Part.gviweb"(Input XML=s2, Start XML Part="<Diagnostic-RunningTimes-Comp>", End XML Part="</Diagnostic-RunningTimes-Comp>", Error in=no error) -> (Output XML array=w204, Error out=w205)
        call "Exlude_WA_Entrys.gviweb"(Input XML array=w204, Error in=w205) -> (Without_WA_Entrys=w206, Output Error=w207)
        call "Interpret_Diagnostic_RunningTimes_Comp.gviweb"(Diagnostic Service History Entrys=w206, Total running time=s5, Error Cluster input=w207) -> (Running Time Component Output=w208, Error Cluster output=w2)
        $"Diagnostic Running Times Comp" <- w208
        w3 = w203
        w4 = s2
        w5 = s3
        w6 = s4
        w7 = s5
        w8 = s6
      }
      frame "Diagnostic Running Times Component iVario " {
        w209 = "System Logger"  # State
        call "Read_XML_Part.gviweb"(Input XML=s2, Start XML Part="<Diagnostic-RunningTimes-Comp>", End XML Part="</Diagnostic-RunningTimes-Comp>", Error in=no error) -> (Output XML array=w210, Error out=w211)
        call "Exlude_WA_Entrys.gviweb"(Input XML array=w210, Error in=w211) -> (Without_WA_Entrys=w212, Output Error=w213)
        call "Interpret_Diagnostic_RunningTimes_Comp.gviweb"(Diagnostic Service History Entrys=w212, Total running time=s5, Error Cluster input=w213) -> (Running Time Component Output=w214, Error Cluster output=w2)
        $"Diagnostic Running Times Components:" <- w214
        w3 = w209
        w4 = s2
        w5 = s3
        w6 = s4
        w7 = s5
        w8 = s6
      }
      frame "System Logger" {
        w215 = "Histogram temperature CPU"  # State
        call "Read_XML_Part.gviweb"(Input XML=s2, Start XML Part="<SystemLogger>", End XML Part="</SystemLogger>", Error in=no error) -> (Output XML array=w216, Error out=w217)
        call "Exlude_WA_Entrys.gviweb"(Input XML array=w216, Error in=w217) -> (Without_WA_Entrys=w218, Output Error=w219)
        call "Interpret_SystemLogger.gviweb"(SystemLogger Entrys=w218, Startup Date and Time=s6, Error Cluster input=w219) -> (System Logger Output=w220, Error Cluster output=w2)
        $"System Logger Output" <- w220
        w3 = w215
        w4 = s2
        w5 = s3
        w6 = s4
        w7 = s5
        w8 = s6
      }
      frame "Histogram temperature CPU" {
        w221 = "Histogram temperature IO"  # State
        call "Read_XML_Part.gviweb"(Input XML=s2, Start XML Part="<Histogram_cpu_pcb_-_Temperature_profile_Celsius>", End XML Part="</Histogram_cpu_pcb_-_Temperature_profile_Celsius>", Error in=no error) -> (Output XML array=w222, Error out=w223)
        call "Exlude_WA_Entrys.gviweb"(Input XML array=w222, Error in=w223) -> (Without_WA_Entrys=w224, Output Error=w225)
        call "Interpret_Histogram_CPU_IO_Temperature.gviweb"(Histogramm Entrys=w224, Error Cluster input=w225) -> (Signal=w226, Error Output=w2)
        $"Histogram cpu pcb Temperature profile Celsius" <- w226
        w3 = w221
        w4 = s2
        w5 = s3
        w6 = s4
        w7 = s5
        w8 = s6
      }
      frame "Histogram temperature IO" {
        w227 = "Histogram temperature LED hinge"  # State
        call "Read_XML_Part.gviweb"(Input XML=s2, Start XML Part="<Histogram_IO_pcb_-_Temperature_profile_Celsius>", End XML Part="</Histogram_IO_pcb_-_Temperature_profile_Celsius>", Error in=no error) -> (Output XML array=w228, Error out=w229)
        call "Exlude_WA_Entrys.gviweb"(Input XML array=w228, Error in=w229) -> (Without_WA_Entrys=w230, Output Error=w231)
        call "Interpret_Histogram_CPU_IO_Temperature.gviweb"(Histogramm Entrys=w230, Error Cluster input=w231) -> (Signal=w232, Error Output=w2)
        $"Histogram IO Temperature profile Celsius" <- w232
        w3 = w227
        w4 = s2
        w5 = s3
        w6 = s4
        w7 = s5
        w8 = s6
      }
      frame "Histogram temperature LED hinge" {
        w233 = "Histogram temperature LED handle"  # State
        call "Read_XML_Part.gviweb"(Input XML=s2, Start XML Part="<Histogram_LED_hinge_side_-_Temperature_profile_Celsius>", End XML Part="</Histogram_LED_hinge_side_-_Temperature_profile_Celsius>", Error in=no error) -> (Output XML array=w234, Error out=w235)
        call "Exlude_WA_Entrys.gviweb"(Input XML array=w234, Error in=w235) -> (Without_WA_Entrys=w236, Output Error=w237)
        call "Interpret_Histogram_CPU_IO_Temperature.gviweb"(Histogramm Entrys=w236, Error Cluster input=w237) -> (Signal=w238, Error Output=w2)
        $"Histogram LED hinge side Temperature profile Celsius" <- w238
        w3 = w233
        w4 = s2
        w5 = s3
        w6 = s4
        w7 = s5
        w8 = s6
      }
      frame "Histogram temperature LED handle" {
        w239 = "Histogram temperature pump pcb"  # State
        call "Read_XML_Part.gviweb"(Input XML=s2, Start XML Part="<Histogram_LED_handle_side_-_Temperature_profile_Celsius>", End XML Part="</Histogram_LED_handle_side_-_Temperature_profile_Celsius>", Error in=no error) -> (Output XML array=w240, Error out=w241)
        call "Exlude_WA_Entrys.gviweb"(Input XML array=w240, Error in=w241) -> (Without_WA_Entrys=w242, Output Error=w243)
        call "Interpret_Histogram_CPU_IO_Temperature.gviweb"(Histogramm Entrys=w242, Error Cluster input=w243) -> (Signal=w244, Error Output=w2)
        $"Histogram LED handle side Temperature profile Celsius" <- w244
        w3 = w239
        w4 = s2
        w5 = s3
        w6 = s4
        w7 = s5
        w8 = s6
      }
      frame "Histogram temperature pump pcb" {
        w245 = "Histogram temperature Gas Box"  # State
        call "Read_XML_Part.gviweb"(Input XML=s2, Start XML Part="<Histogram_pump_pcb_-_Temperature_profile_Celsius>", End XML Part="</Histogram_pump_pcb_-_Temperature_profile_Celsius>", Error in=no error) -> (Output XML array=w246, Error out=w247)
        call "Exlude_WA_Entrys.gviweb"(Input XML array=w246, Error in=w247) -> (Without_WA_Entrys=w248, Output Error=w249)
        call "Interpret_Histogram_CPU_IO_Temperature.gviweb"(Histogramm Entrys=w248, Error Cluster input=w249) -> (Signal=w250, Error Output=w2)
        $"Histogram pump pcb Temperature profile Celsius" <- w250
        w3 = w245
        w4 = s2
        w5 = s3
        w6 = s4
        w7 = s5
        w8 = s6
      }
      frame "Histogram temperature Gas Box" {
        w251 = "Histogram Fan 1 RPM"  # State
        call "Read_XML_Part.gviweb"(Input XML=s2, Start XML Part="<Histogram_gas_box_-_Temperature_profile_Celsius>", End XML Part="</Histogram_gas_box_-_Temperature_profile_Celsius>", Error in=no error) -> (Output XML array=w252, Error out=w253)
        call "Exlude_WA_Entrys.gviweb"(Input XML array=w252, Error in=w253) -> (Without_WA_Entrys=w254, Output Error=w255)
        call "Interpret_Histogram_CPU_IO_Temperature.gviweb"(Histogramm Entrys=w254, Error Cluster input=w255) -> (Signal=w256, Error Output=w2)
        $"Histogram gas box Temperature profile Celsius" <- w256
        w3 = w251
        w4 = s2
        w5 = s3
        w6 = s4
        w7 = s5
        w8 = s6
      }
      frame "Histogram Fan 1 RPM" {
        w257 = "Histogram Fan 1 Power"  # State
        call "Read_XML_Part.gviweb"(Input XML=s2, Start XML Part="<Histogram_fan_1_-_RPM_profile_1_min>", End XML Part="</Histogram_fan_1_-_RPM_profile_1_min>", Error in=no error) -> (Output XML array=w258, Error out=w259)
        call "Exlude_WA_Entrys.gviweb"(Input XML array=w258, Error in=w259) -> (Without_WA_Entrys=w260, Output Error=w261)
        call "Interpret_Histogram_CPU_IO_Temperature.gviweb"(Histogramm Entrys=w260, Error Cluster input=w261) -> (Signal=w262, Error Output=w2)
        $"Histogram fan 1 RPM profile 1 min" <- w262
        w3 = w257
        w4 = s2
        w5 = s3
        w6 = s4
        w7 = s5
        w8 = s6
      }
      frame "Histogram Fan 1 Power" {
        w263 = "Histogram Fan 1 Temperature"  # State
        call "Read_XML_Part.gviweb"(Input XML=s2, Start XML Part="<Histogram_fan_1_-_power_profile_W>", End XML Part="</Histogram_fan_1_-_power_profile_W>", Error in=no error) -> (Output XML array=w264, Error out=w265)
        call "Exlude_WA_Entrys.gviweb"(Input XML array=w264, Error in=w265) -> (Without_WA_Entrys=w266, Output Error=w267)
        call "Interpret_Histogram_CPU_IO_Temperature.gviweb"(Histogramm Entrys=w266, Error Cluster input=w267) -> (Signal=w268, Error Output=w2)
        $"Histogram fan 1 power profile W" <- w268
        w3 = w263
        w4 = s2
        w5 = s3
        w6 = s4
        w7 = s5
        w8 = s6
      }
      frame "Histogram Fan 1 Temperature" {
        w269 = "Histogram Fan 1 Voltage min"  # State
        call "Read_XML_Part.gviweb"(Input XML=s2, Start XML Part="<Histogram_fan_1_-_Temperature_profile_Celsius>", End XML Part="</Histogram_fan_1_-_Temperature_profile_Celsius>", Error in=no error) -> (Output XML array=w270, Error out=w271)
        call "Exlude_WA_Entrys.gviweb"(Input XML array=w270, Error in=w271) -> (Without_WA_Entrys=w272, Output Error=w273)
        call "Interpret_Histogram_CPU_IO_Temperature.gviweb"(Histogramm Entrys=w272, Error Cluster input=w273) -> (Signal=w274, Error Output=w2)
        $"Histogram fan 1 Temperature_profile Celsius" <- w274
        w3 = w269
        w4 = s2
        w5 = s3
        w6 = s4
        w7 = s5
        w8 = s6
      }
      frame "Histogram Fan 1 Voltage min" {
        w275 = "Histogram Fan 1 Voltage max"  # State
        call "Read_XML_Part.gviweb"(Input XML=s2, Start XML Part="<Histogram_fan_1_-_Voltage_min_V_-_1phase_3phase>", End XML Part="</Histogram_fan_1_-_Voltage_min_V_-_1phase_3phase>", Error in=no error) -> (Output XML array=w276, Error out=w277)
        call "Exlude_WA_Entrys.gviweb"(Input XML array=w276, Error in=w277) -> (Without_WA_Entrys=w278, Output Error=w279)
        call "Interpret_Histogram_CPU_IO_Temperature.gviweb"(Histogramm Entrys=w278, Error Cluster input=w279) -> (Signal=w280, Error Output=w2)
        $"Histogram fan 1 Voltage min_V_1phase_3phase" <- w280
        w3 = w275
        w4 = s2
        w5 = s3
        w6 = s4
        w7 = s5
        w8 = s6
      }
      frame "Histogram Fan 1 Voltage max" {
        w281 = "Histogram Fan 2 RPM"  # State
        call "Read_XML_Part.gviweb"(Input XML=s2, Start XML Part="<Histogram_fan_1_-_Voltage_min_V_-_1phase_3phase>", End XML Part="</Histogram_fan_1_-_Voltage_min_V_-_1phase_3phase>", Error in=no error) -> (Output XML array=w282, Error out=w283)
        call "Exlude_WA_Entrys.gviweb"(Input XML array=w282, Error in=w283) -> (Without_WA_Entrys=w284, Output Error=w285)
        call "Interpret_Histogram_CPU_IO_Temperature.gviweb"(Histogramm Entrys=w284, Error Cluster input=w285) -> (Signal=w286, Error Output=w2)
        $"Histogram fan 1 Voltage max_V_1phase_3phase" <- w286
        w3 = w281
        w4 = s2
        w5 = s3
        w6 = s4
        w7 = s5
        w8 = s6
      }
      frame "Histogram Fan 2 RPM" {
        w287 = "Histogram Fan 2 Power"  # State
        call "Read_XML_Part.gviweb"(Input XML=s2, Start XML Part="<Histogram_fan_2_-_RPM_profile_1_min>", End XML Part="</Histogram_fan_2_-_RPM_profile_1_min>", Error in=no error) -> (Output XML array=w288, Error out=w289)
        call "Exlude_WA_Entrys.gviweb"(Input XML array=w288, Error in=w289) -> (Without_WA_Entrys=w290, Output Error=w291)
        call "Interpret_Histogram_CPU_IO_Temperature.gviweb"(Histogramm Entrys=w290, Error Cluster input=w291) -> (Signal=w292, Error Output=w2)
        $"Histogram fan 2 RPM profile 1 min" <- w292
        w3 = w287
        w4 = s2
        w5 = s3
        w6 = s4
        w7 = s5
        w8 = s6
      }
      frame "Histogram Fan 2 Power" {
        w293 = "Histogram Fan 2 Temperature"  # State
        call "Read_XML_Part.gviweb"(Input XML=s2, Start XML Part="<Histogram_fan_2_-_power_profile_W>", End XML Part="</Histogram_fan_2_-_power_profile_W>", Error in=no error) -> (Output XML array=w294, Error out=w295)
        call "Exlude_WA_Entrys.gviweb"(Input XML array=w294, Error in=w295) -> (Without_WA_Entrys=w296, Output Error=w297)
        call "Interpret_Histogram_CPU_IO_Temperature.gviweb"(Histogramm Entrys=w296, Error Cluster input=w297) -> (Signal=w298, Error Output=w2)
        $"Histogram fan 2 power profile W" <- w298
        w3 = w293
        w4 = s2
        w5 = s3
        w6 = s4
        w7 = s5
        w8 = s6
      }
      frame "Histogram Fan 2 Temperature" {
        w299 = "Histogram Fan 2 Voltage min"  # State
        call "Read_XML_Part.gviweb"(Input XML=s2, Start XML Part="<Histogram_fan_2_-_Temperature_profile_Celsius>", End XML Part="</Histogram_fan_2_-_Temperature_profile_Celsius>", Error in=no error) -> (Output XML array=w300, Error out=w301)
        call "Exlude_WA_Entrys.gviweb"(Input XML array=w300, Error in=w301) -> (Without_WA_Entrys=w302, Output Error=w303)
        call "Interpret_Histogram_CPU_IO_Temperature.gviweb"(Histogramm Entrys=w302, Error Cluster input=w303) -> (Signal=w304, Error Output=w2)
        $"Histogram fan 2 Temperature_profile Celsius" <- w304
        w3 = w299
        w4 = s2
        w5 = s3
        w6 = s4
        w7 = s5
        w8 = s6
      }
      frame "Histogram Fan 2 Voltage min" {
        w305 = "Histogram Fan 2 Voltage max"  # State
        call "Read_XML_Part.gviweb"(Input XML=s2, Start XML Part="<Histogram_fan_2_-_Voltage_min_V_-_1phase_3phase>", End XML Part="</Histogram_fan_2_-_Voltage_min_V_-_1phase_3phase>", Error in=no error) -> (Output XML array=w306, Error out=w307)
        call "Exlude_WA_Entrys.gviweb"(Input XML array=w306, Error in=w307) -> (Without_WA_Entrys=w308, Output Error=w309)
        call "Interpret_Histogram_CPU_IO_Temperature.gviweb"(Histogramm Entrys=w308, Error Cluster input=w309) -> (Signal=w310, Error Output=w2)
        $"Histogram fan 2 Voltage min_V_1phase_3phase" <- w310
        w3 = w305
        w4 = s2
        w5 = s3
        w6 = s4
        w7 = s5
        w8 = s6
      }
      frame "Histogram Fan 2 Voltage max" {
        w311 = "Histogram Fan 3 RPM"  # State
        call "Read_XML_Part.gviweb"(Input XML=s2, Start XML Part="<Histogram_fan_2_-_Voltage_max_V_-_1phase_3phase>", End XML Part="</Histogram_fan_2_-_Voltage_max_V_-_1phase_3phase>", Error in=no error) -> (Output XML array=w312, Error out=w313)
        call "Exlude_WA_Entrys.gviweb"(Input XML array=w312, Error in=w313) -> (Without_WA_Entrys=w314, Output Error=w315)
        call "Interpret_Histogram_CPU_IO_Temperature.gviweb"(Histogramm Entrys=w314, Error Cluster input=w315) -> (Signal=w316, Error Output=w2)
        $"Histogram fan 2 Voltage max_V_1phase_3phase" <- w316
        w3 = w311
        w4 = s2
        w5 = s3
        w6 = s4
        w7 = s5
        w8 = s6
      }
      frame "Histogram Fan 3 RPM" {
        w317 = "Histogram Fan 3 Power"  # State
        call "Read_XML_Part.gviweb"(Input XML=s2, Start XML Part="<Histogram_fan_3_-_RPM_profile_1_min>", End XML Part="</Histogram_fan_3_-_RPM_profile_1_min>", Error in=no error) -> (Output XML array=w318, Error out=w319)
        call "Exlude_WA_Entrys.gviweb"(Input XML array=w318, Error in=w319) -> (Without_WA_Entrys=w320, Output Error=w321)
        call "Interpret_Histogram_CPU_IO_Temperature.gviweb"(Histogramm Entrys=w320, Error Cluster input=w321) -> (Signal=w322, Error Output=w2)
        $"Histogram fan 3 RPM profile 1 min" <- w322
        w3 = w317
        w4 = s2
        w5 = s3
        w6 = s4
        w7 = s5
        w8 = s6
      }
      frame "Histogram Fan 3 Power" {
        w323 = "Histogram Fan 3 Temperature"  # State
        call "Read_XML_Part.gviweb"(Input XML=s2, Start XML Part="<Histogram_fan_3_-_power_profile_W>", End XML Part="</Histogram_fan_3_-_power_profile_W>", Error in=no error) -> (Output XML array=w324, Error out=w325)
        call "Exlude_WA_Entrys.gviweb"(Input XML array=w324, Error in=w325) -> (Without_WA_Entrys=w326, Output Error=w327)
        call "Interpret_Histogram_CPU_IO_Temperature.gviweb"(Histogramm Entrys=w326, Error Cluster input=w327) -> (Signal=w328, Error Output=w2)
        $"Histogram fan 3 power profile W" <- w328
        w3 = w323
        w4 = s2
        w5 = s3
        w6 = s4
        w7 = s5
        w8 = s6
      }
      frame "Histogram Fan 3 Temperature" {
        w329 = "Histogram Fan 3 Voltage min"  # State
        call "Read_XML_Part.gviweb"(Input XML=s2, Start XML Part="<Histogram_fan_3_-_Temperature_profile_Celsius>", End XML Part="</Histogram_fan_3_-_Temperature_profile_Celsius>", Error in=no error) -> (Output XML array=w330, Error out=w331)
        call "Exlude_WA_Entrys.gviweb"(Input XML array=w330, Error in=w331) -> (Without_WA_Entrys=w332, Output Error=w333)
        call "Interpret_Histogram_CPU_IO_Temperature.gviweb"(Histogramm Entrys=w332, Error Cluster input=w333) -> (Signal=w334, Error Output=w2)
        $"Histogram fan 3 Temperature_profile Celsius" <- w334
        w3 = w329
        w4 = s2
        w5 = s3
        w6 = s4
        w7 = s5
        w8 = s6
      }
      frame "Histogram Fan 3 Voltage min" {
        w335 = "Histogram Fan 3 Voltage max"  # State
        call "Read_XML_Part.gviweb"(Input XML=s2, Start XML Part="<Histogram_fan_3_-_Voltage_min_V_-_1phase_3phase>", End XML Part="</Histogram_fan_3_-_Voltage_min_V_-_1phase_3phase>", Error in=no error) -> (Output XML array=w336, Error out=w337)
        call "Exlude_WA_Entrys.gviweb"(Input XML array=w336, Error in=w337) -> (Without_WA_Entrys=w338, Output Error=w339)
        call "Interpret_Histogram_CPU_IO_Temperature.gviweb"(Histogramm Entrys=w338, Error Cluster input=w339) -> (Signal=w340, Error Output=w2)
        $"Histogram fan 3 Voltage min_V_1phase_3phase" <- w340
        w3 = w335
        w4 = s2
        w5 = s3
        w6 = s4
        w7 = s5
        w8 = s6
      }
      frame "Histogram Fan 3 Voltage max" {
        w341 = "Histogram MMI CPU Load"  # State
        call "Read_XML_Part.gviweb"(Input XML=s2, Start XML Part="<Histogram_fan_3_-_Voltage_max_V_-_1phase_3phase>", End XML Part="</Histogram_fan_3_-_Voltage_max_V_-_1phase_3phase>", Error in=no error) -> (Output XML array=w342, Error out=w343)
        call "Exlude_WA_Entrys.gviweb"(Input XML array=w342, Error in=w343) -> (Without_WA_Entrys=w344, Output Error=w345)
        call "Interpret_Histogram_CPU_IO_Temperature.gviweb"(Histogramm Entrys=w344, Error Cluster input=w345) -> (Signal=w346, Error Output=w2)
        $"Histogram fan 3 Voltage max_V_1phase_3phase" <- w346
        w3 = w341
        w4 = s2
        w5 = s3
        w6 = s4
        w7 = s5
        w8 = s6
      }
      frame "Histogram MMI CPU Load" {
        w347 = "Histogram MMI RAM Load"  # State
        call "Read_XML_Part.gviweb"(Input XML=s2, Start XML Part="<Histogram_-_MMI_CPU_Load_Percent>", End XML Part="</Histogram_-_MMI_CPU_Load_Percent>", Error in=no error) -> (Output XML array=w348, Error out=w349)
        call "Exlude_WA_Entrys.gviweb"(Input XML array=w348, Error in=w349) -> (Without_WA_Entrys=w350, Output Error=w351)
        call "Interpret_Histogram_CPU_IO_Temperature.gviweb"(Histogramm Entrys=w350, Error Cluster input=w351) -> (Signal=w352, Error Output=w2)
        $"Histogram MMI CPU Load Percent" <- w352
        w3 = w347
        w4 = s2
        w5 = s3
        w6 = s4
        w7 = s5
        w8 = s6
      }
      frame "Histogram MMI RAM Load" {
        w353 = "Histogram Basis CPU Load"  # State
        call "Read_XML_Part.gviweb"(Input XML=s2, Start XML Part="<Histogram_-_MMI_RAM_Load_Percent>", End XML Part="</Histogram_-_MMI_RAM_Load_Percent>", Error in=no error) -> (Output XML array=w354, Error out=w355)
        call "Exlude_WA_Entrys.gviweb"(Input XML array=w354, Error in=w355) -> (Without_WA_Entrys=w356, Output Error=w357)
        call "Interpret_Histogram_CPU_IO_Temperature.gviweb"(Histogramm Entrys=w356, Error Cluster input=w357) -> (Signal=w358, Error Output=w2)
        $"Histogram MMI RAM Load Percent" <- w358
        w3 = w353
        w4 = s2
        w5 = s3
        w6 = s4
        w7 = s5
        w8 = s6
      }
      frame "Histogram Basis CPU Load" {
        w359 = "Histogram Basis RAM Load"  # State
        call "Read_XML_Part.gviweb"(Input XML=s2, Start XML Part="<Histogram_-_Basis_CPU_Load_Percent>", End XML Part="</Histogram_-_Basis_CPU_Load_Percent>", Error in=no error) -> (Output XML array=w360, Error out=w361)
        call "Exlude_WA_Entrys.gviweb"(Input XML array=w360, Error in=w361) -> (Without_WA_Entrys=w362, Output Error=w363)
        call "Interpret_Histogram_CPU_IO_Temperature.gviweb"(Histogramm Entrys=w362, Error Cluster input=w363) -> (Signal=w364, Error Output=w2)
        $"Histogram Basis CPU Load Percent" <- w364
        w3 = w359
        w4 = s2
        w5 = s3
        w6 = s4
        w7 = s5
        w8 = s6
      }
      frame "Histogram Basis RAM Load" {
        w365 = "Histogram Magnetron Top Temperature"  # State
        call "Read_XML_Part.gviweb"(Input XML=s2, Start XML Part="<Histogram_-_Basis_RAM_Load_Percent>", End XML Part="</Histogram_-_Basis_RAM_Load_Percent>", Error in=no error) -> (Output XML array=w366, Error out=w367)
        call "Exlude_WA_Entrys.gviweb"(Input XML array=w366, Error in=w367) -> (Without_WA_Entrys=w368, Output Error=w369)
        call "Interpret_Histogram_CPU_IO_Temperature.gviweb"(Histogramm Entrys=w368, Error Cluster input=w369) -> (Signal=w370, Error Output=w2)
        $"Histogram Basis RAM Load Percent" <- w370
        w3 = w365
        w4 = s2
        w5 = s3
        w6 = s4
        w7 = s5
        w8 = s6
      }
      frame "Histogram Magnetron Top Temperature" {
        w371 = "Histogram Magnetron bottomTemperature"  # State
        call "Read_XML_Part.gviweb"(Input XML=s2, Start XML Part="<Histogram_Magnetron_Top_Temperature_profile_Celsius>", End XML Part="</Histogram_Magnetron_Top_Temperature_profile_Celsius>", Error in=no error) -> (Output XML array=w372, Error out=w373)
        call "Exlude_WA_Entrys.gviweb"(Input XML array=w372, Error in=w373) -> (Without_WA_Entrys=w374, Output Error=w375)
        call "Interpret_Histogram_CPU_IO_Temperature.gviweb"(Histogramm Entrys=w374, Error Cluster input=w375) -> (Signal=w376, Error Output=w2)
        $"Histogram Magnetron Top Temperatur profile Celsius" <- w376
        w3 = w371
        w4 = s2
        w5 = s3
        w6 = s4
        w7 = s5
        w8 = s6
      }
      frame "Histogram Magnetron bottomTemperature" {
        w377 = "Histogram Power Supply Top Temperature"  # State
        call "Read_XML_Part.gviweb"(Input XML=s2, Start XML Part="<Histogram_Magnetron_bottom_Temperature_profile_Celsius>", End XML Part="</Histogram_Magnetron_bottom_Temperature_profile_Celsius>", Error in=no error) -> (Output XML array=w378, Error out=w379)
        call "Exlude_WA_Entrys.gviweb"(Input XML array=w378, Error in=w379) -> (Without_WA_Entrys=w380, Output Error=w381)
        call "Interpret_Histogram_CPU_IO_Temperature.gviweb"(Histogramm Entrys=w380, Error Cluster input=w381) -> (Signal=w382, Error Output=w2)
        $"Histogram Magnetron bottom Temperature profile Celsius" <- w382
        w3 = w377
        w4 = s2
        w5 = s3
        w6 = s4
        w7 = s5
        w8 = s6
      }
      frame "Histogram Power Supply Top Temperature" {
        w383 = "Histogram Power Supply bottom Temperature"  # State
        call "Read_XML_Part.gviweb"(Input XML=s2, Start XML Part="<Histogram_Power_Supply_Top_Temperature_profile_Celsius>", End XML Part="</Histogram_Power_Supply_Top_Temperature_profile_Celsius>", Error in=no error) -> (Output XML array=w384, Error out=w385)
        call "Exlude_WA_Entrys.gviweb"(Input XML array=w384, Error in=w385) -> (Without_WA_Entrys=w386, Output Error=w387)
        call "Interpret_Histogram_CPU_IO_Temperature.gviweb"(Histogramm Entrys=w386, Error Cluster input=w387) -> (Signal=w388, Error Output=w2)
        $"Histogram Power Supply Top Temperature profile Celsius" <- w388
        w3 = w383
        w4 = s2
        w5 = s3
        w6 = s4
        w7 = s5
        w8 = s6
      }
      frame "Histogram Power Supply bottom Temperature" {
        w389 = "Wait For Interaction"  # State
        w390 = "</Histogram_Power_Supply_bottom_Temperature_profile_Celsius>"
        w391 = "<Histogram_Power_Supply_bottom_Temperature_profile_Celsius>"
        call "Read_XML_Part.gviweb"(Input XML=s2, Start XML Part=w391, End XML Part=w390, Error in=no error) -> (Output XML array=w392, Error out=w393)
        call "Exlude_WA_Entrys.gviweb"(Input XML array=w392, Error in=w393) -> (Without_WA_Entrys=w394, Output Error=w395)
        call "Interpret_Histogram_CPU_IO_Temperature.gviweb"(Histogramm Entrys=w394, Error Cluster input=w395) -> (Signal=w396, Error Output=w2)
        $"Histogram Power Supply bottom Temperature profile Celsius" <- w396
        w3 = w389
        w4 = s2
        w5 = s3
        w6 = s4
        w7 = s5
        w8 = s6
      }
      frame "Diagnostic Running Times Modes" {
        w397 = "Diagnostic Running Times Comp"  # State
        call "Read_XML_Part.gviweb"(Input XML=s2, Start XML Part="<Diagnostic-RunningTimes-Modes>", End XML Part="</Diagnostic-RunningTimes-Modes>", Error in=no error) -> (Output XML array=w398, Error out=w399)
        call "Exlude_WA_Entrys.gviweb"(Input XML array=w398, Error in=w399) -> (Without_WA_Entrys=w400, Output Error=w401)
        call "Interpret_Diagnostic_RunningTimes_Modes.gviweb"(Diagnostic Service History Entrys=w400, Error Cluster input=w401) -> (Diagnostic Running Time Modes Output=w402, Total running time=w7, Error Cluster output=w2)
        $"Diagnostic Running Times Modes" <- w402
        w3 = w397
        w4 = s2
        w5 = s3
        w6 = s4
        w8 = s6
      }
      frame "Diagnostic Running Times Modes iVario " {
        w403 = "Diagnostic Running Times Component iVario "  # State
        call "Read_XML_Part.gviweb"(Input XML=s2, Start XML Part="<Diagnostic-RunningTimes-Modes>", End XML Part="</Diagnostic-RunningTimes-Modes>", Error in=no error) -> (Output XML array=w404, Error out=w405)
        call "Exlude_WA_Entrys.gviweb"(Input XML array=w404, Error in=w405) -> (Without_WA_Entrys=w406, Output Error=w407)
        call "Interpret_Diagnostic_RunningTimes_Modes.gviweb"(Diagnostic Service History Entrys=w406, Error Cluster input=w407) -> (Diagnostic Running Time Modes Output=w408, Total running time=w7, Error Cluster output=w2)
        $"Total Running Time:" <- w408
        w3 = w403
        w4 = s2
        w5 = s3
        w6 = s4
        w8 = s6
      }
    }
    next s1 = w3
    next s2 = w4
    next s3 = w5
    next s4 = w6
    next s5 = w7
    next s6 = w8
    stop if FALSE
  }
